# Grasshopper definition boudaries_from_DB.gh (Grasshopper 1.0.7)
# plug-ins: Javid, EleFront

path = FilePath("G:\My Drive\MIT\maldives\banyan\2020-2023\train_2\")
path_2 = FilePath("G:\My Drive\MIT\maldives\banyan\2020-2023\train_1\")
path_3 = FilePath("G:\My Drive\MIT\maldives\banyan\2020-2023\train_seq\")
txt = Text(path_3)
c_script = CSharpScript(dir=txt)  # -> out, files; inputs dir: String
# ---------- c_script: C# ----------
    
    string[] fileArray = System.IO.Directory.GetFiles(dir);
    files = fileArray;
# ---------- end c_script ----------
panel = Panel(txt)
tsort = SortText(Keys=c_script.files, Culture=127)  # -> Keys, Values
split = TextSplit(Text=tsort.Keys, Separators="\")
item = ListItem(List=split, Index=0, Wrap=True)  # -> Item2, Item1, Item
fragment = TextFragment(Text=item.Item1, Start=0, Count=4)
tmatch = MatchText(Text=fragment, Pattern="mask", Case=True)
cull = CullPattern(List=item.Item1, CullPattern=tmatch)  # -> flatten(List)
fragment_2 = TextFragment(Text=cull, Start=4, Count=3)
split_2 = TextSplit(Text=fragment_2, Separators=".")
item_2 = ListItem(List=split_2, Index=0, Wrap=True)  # -> flatten(Item)
panel_2 = Panel(item_2)
int = Integer(item_2)
lng = ListLength(List=item_2)
panel_3 = Panel(lng)
series = Series(Start=0, Step=1, Count=lng)
panel_4 = Panel(Slider(0, range=0..7))
num = Number("640/480")
num_2 = Number("1068/800")
division = Division(A="800", B="4")
division_2 = Division(A="1068", B="4")
panel_5 = Panel(num)
panel_6 = Panel(num_2)
series_2 = Series(Start=0, Step="4", Count=division)
series_3 = Series(Start=0, Step="4", Count=division_2)
range = Range(Domain=Domain(0, 1), Steps=expr("x-1", division))
range_2 = Range(Domain=Domain(0, 1), Steps=expr("x-1", division_2))
split_3 = TextSplit(Text=panel, Separators="\")
pt = ConstructPoint(XCoordinate=graft(series_3), YCoordinate=series_2, ZCoordinate=0)  # -> flatten(Point)
pt_2 = ConstructPoint(XCoordinate=graft(range_2), YCoordinate=range, ZCoordinate=0)  # -> flatten(Point)
item_3 = ListItem(List=split_3, Index=0, Wrap=True)  # -> Item2, Item1, Item
panel_7 = Panel(item_3.Item2)
planesrf = PlaneSurface(Plane=PlaneXY(0, 0, 0), XSize="1068", YSize="800")
multiplication = Multiplication(A="1.5", B="4")

run_bake = BooleanToggle(False)

iterator = CSharpScript(count=panel_3, run=run_bake)  # -> out, index; inputs count: Int32, run: Boolean
# ---------- iterator: C# ----------
    if(counter < count && run) {
      counter++;
      Print("Creating Panel: " + counter.ToString() + " of " + count.ToString());
      Component.ExpireSolution(true);
      index = counter - 1;
    }else{
      counter = 0;
      index = -1;
      Print("inactive");
    }
# ---------- iterator: C# additional code ----------
  int counter = 0;
# ---------- end iterator ----------

run_status = Panel(iterator.out)

panel_8 = Panel(iterator.index)
larger = LargerThan(FirstNumber=panel_8, SecondNumber=-1)  # -> LargerThan, OrEqualTo
item_4 = ListItem(List=item_2, Index=iterator.index, Wrap=True)
item_5 = ListItem(List=series, Index=iterator.index, Wrap=True)
bool = Boolean(larger.LargerThan)
expression = Expression(x=panel, y=item_4, Expression="Format(\"{0}mask{1}.png\",x, y)")
expression_2 = Expression(x=panel, y=item_4, Expression="Format(\"{0}{1}.png\",x, y)")
panel_9 = Panel(expression_2)
attributes = DefineObjectAttributes(Name=item_5, Layer=panel_7)
open = OpenBitmap(File=expression_2)
open_2 = OpenBitmap(File=expression)
preview_bitmap = PreviewBitmap(Bitmap=open, LockAspect=False)
evalbmp = EvaluateBitmap(Bitmap=open, Points=pt_2, Interpolate=False, Wrap=1)
evalbmp_2 = EvaluateBitmap(Bitmap=open_2, Points=pt_2, Interpolate=False, Wrap=1)
ahsl = SplitAHSL(Colour=evalbmp_2)  # -> Alpha, Hue, Saturation, Luminance
round = Round(Number=ahsl.Luminance)  # -> Nearest, Floor, Ceiling
bool_2 = Boolean(round.Nearest)
cull_2 = CullPattern(List=evalbmp, CullPattern=bool_2)
ahsl_2 = SplitAHSL(Colour=cull_2)  # -> Alpha, Hue, Saturation, Luminance
bnd = Bounds(Numbers=ahsl_2.Luminance)
remap = RemapNumbers(Value=ahsl_2.Luminance, Source=bnd, Target=Domain(0, 1))  # -> Mapped, Clipped
round_2 = Round(Number=remap.Mapped)  # -> Nearest, Floor, Ceiling
panel_10 = Panel(round_2.Nearest)
cull_3 = CullPattern(List=pt, CullPattern=bool_2)
del = DelaunayMesh(Points=cull_3, Plane=PlaneXY(0, 0, 0))
demesh = DeconstructMesh(Mesh=del)  # -> Vertices, Faces, Colours, Normals
cluster = Cluster(M=del)
smaller = SmallerThan(FirstNumber=cluster, SecondNumber=multiplication)  # -> SmallerThan, OrEqualTo
cull_4 = CullPattern(List=demesh.Faces, CullPattern=smaller.SmallerThan)
conmesh = ConstructMesh(Vertices=demesh.Vertices, Faces=cull_4)
bool_3 = Boolean(invert(round_2.Nearest))
medges = MeshEdges(Mesh=conmesh)  # -> NakedEdges, InteriorEdges, NonManifoldEdges
cull_5 = CullPattern(List=cull_3, CullPattern=bool_3)
join = JoinCurves(Curves=medges.NakedEdges, Preserve=False)
len = Length(Curve=join)
cluster_2 = Cluster_3(P=cull_5)
sort = SortList(Keys=len, ValuesA=join)  # -> Keys, reverse(ValuesA)
cluster_3 = Cluster_2(C=cull_5, crv=cluster_2)
item_6 = ListItem(List=sort.ValuesA, Index=0, Wrap=True)
transform = Transform(cluster_3)
smoothpline = SmoothPolyline(Polyline=item_6, Strength=1, Times=3)
transform_2 = Transform(Geometry=smoothpline, Transform=transform)
crv = Curve(transform_2)
bake = BakeObjects(Geometry=crv, Attributes=attributes, Bake=bool)

# ==== cluster Cluster
M = ClusterInput()
faceb = FaceBoundaries(Mesh=M)
explode = Explode(Curve=faceb, Recursive=True)  # -> Segments, Vertices
len = Length(Curve=explode.Segments)
sort = SortList(Keys=len)  # -> reverse(Keys), ValuesA
item = ListItem(List=sort.Keys, Index=0, Wrap=True)  # -> flatten(Item)
i = ClusterOutput(item)

# ==== cluster Cluster_2
C = ClusterInput()
crv = ClusterInput()
crv_2 = Curve(crv)
brep = Brep(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)
bbox = BoundingBox(Content=crv_2, Plane=PlaneXY(0, 0, 0), UnionBox=True)  # -> Box, Box_2
box_corners = BoxCorners(Box=brep)  # -> CornerA, CornerB, CornerC, CornerD, CornerE, CornerF, CornerG, CornerH
debox = DeconstructBox(Box=brep)  # -> Plane, X, Y, Z
debox_2 = DeconstructBox(Box=bbox.Box)  # -> Plane, X, Y, Z
box_corners_2 = BoxCorners(Box=bbox.Box)  # -> CornerA, CornerB, CornerC, CornerD, CornerE, CornerF, CornerG, CornerH
num = Number(debox.X)
num_2 = Number(debox.Y)
num_3 = Number(debox_2.X)
num_4 = Number(debox_2.Y)
vec2pt = Vector2Pt(PointA=box_corners_2.CornerA, PointB=box_corners.CornerA, Unitize=False)  # -> Vector, Length
division = Division(A=num_2, B=num_4)
division_2 = Division(A=num, B=num_3)
move = Move(Geometry=bbox.Box, Motion=vec2pt.Vector)  # -> Geometry, Transform
scale_nu = ScaleNU(Geometry=move.Geometry, Plane=box_corners.CornerA, ScaleX=division_2, ScaleY=division, ScaleZ=1)  # -> Geometry, Transform; disabled
merge = Merge(Data1=move.Transform, Data2=scale_nu.Transform)
comp = Compound(Transforms=merge)
X = ClusterOutput(comp)

# ==== cluster Cluster_3
P = ClusterInput()
del = DelaunayMesh(Points=P, Plane=PlaneXY(0, 0, 0))
medges = MeshEdges(Mesh=del)  # -> NakedEdges, InteriorEdges, NonManifoldEdges
join = JoinCurves(Curves=medges.NakedEdges, Preserve=False)
len = Length(Curve=join)
sort = SortList(Keys=len, ValuesA=join)  # -> Keys, reverse(ValuesA)
item = ListItem(List=sort.ValuesA, Index=0, Wrap=True)
smoothpline = SmoothPolyline(Polyline=item, Strength=1, Times=3)
P_2 = ClusterOutput(smoothpline)
