# Grasshopper definition fill_in_boundaries.gh (Grasshopper 1.0.7)
# plug-ins: EleFront

crv = Curve([<curve referenced from the Rhino model> x13])
c_script = CSharpScript(crv=graft(crv))  # -> A; inputs crv: Guid
# ---------- c_script: C# ----------
A = doc.Objects.Find(crv).Attributes.Name;
# ---------- end c_script ----------
toggle = BooleanToggle(False)
sort = SortList(Keys=flatten(c_script), ValuesA=crv)  # -> Keys, ValuesA
cluster = Cluster(crv=sort.ValuesA)
number_slider = Slider(2121, range=0..2121)
range = Range(Domain=Domain(0, 1), Steps="180")
shift = ShiftList(List=cluster, Shift=1, Wrap=toggle)  # -> simplify(graft(List))
shift_2 = ShiftList(List=cluster, Shift=-1, Wrap=toggle)  # -> simplify(graft(List))
len = Length(Curve=shift_2)
lng = ListLength(List=shift_2)
random = Random(Range=Domain(0, 1), Number="1", Seed=len)
cull_i = CullIndex(List=range, Indices=0, Wrap=True)
dup = DuplicateData(Data=cull_i, Number=lng, Order=True)  # -> simplify(Data)
subtraction = Subtraction(A=1, B=random)
graph = GraphMapper(
    cull_i,
    x0=0,
    x1=1,
    y0=0,
    y1=1,
    container_name="Sine Summation",
    Equation0_px=[0.1513157934, 0.3],
    Equation0_py=[0.210144937, 0.3],
    Equation1_px=[0.6195811033, 0.9910976887],
    Equation1_py=[0, 0.5754475594])
graph_2 = GraphMapper(
    cull_i,
    x0=0,
    x1=1,
    y0=0,
    y1=1,
    container_name="Sine Summation",
    Equation0_px=[0.03836192191, 0.1747644395],
    Equation0_py=[0.08780890703, 0.1645352244],
    Equation1_px=[0.6265971065, 0.9931781888],
    Equation1_py=[0.5481668711, 0.03665804863])
panel = Panel(cull_i)
multiplication = Multiplication(A=subtraction, B=graph_2)  # -> simplify(Result)
multiplication_2 = Multiplication(A=random, B=graph)  # -> simplify(Result)
addition = Addition(A=dup, B=multiplication, C=multiplication_2)
bnd = Bounds(Numbers=addition)
remap = RemapNumbers(Value=addition, Source=bnd, Target=Domain(0, 1))  # -> Mapped, Clipped
viewer = ParamViewer(addition)
item = ListItem(List=viewer, Index=Slider(0, range=0..10), Wrap=True)
branch = TreeBranch(Tree=addition, Path=item, MaintainPaths=True)
tweencrv = TweenCurve(CurveA=shift_2, CurveB=shift, Factor=remap.Mapped, BlendType=0)  # -> flatten(Tween)
graph_3 = QuickGraph(branch, SortOrder=0)
crv_2 = Curve(tweencrv)
lng_2 = ListLength(List=crv_2)
series = Series(Start=0, Step=1, Count=lng_2)
item_2 = ListItem(List=graft(series), Index=0, Wrap=True)
attributes = DefineObjectAttributes(Name=item_2, Layer="dense_boundaries")  # -> flatten(Attributes)
bake = BakeObjects(Geometry=crv_2, Attributes=attributes, Bake=False)

# ==== cluster Cluster
crv = ClusterInput()
crv_2 = Curve(crv)
item = ListItem(List=crv_2, Index=0, Wrap=True)
end = EndPoints(Curve=item)  # -> Start, End
crv_cp = CurveClosestPoint(Point=end.Start, Curve=reparameterize(crv_2))  # -> Point, Parameter, Distance
seam = Seam(Curve=reparameterize(crv_2), Seam=crv_cp.Parameter)
flip = FlipCurve(Curve=seam, Guide=item)  # -> Curve, Flag
crv_3 = Curve(flip.Curve)
crv_4 = ClusterOutput(crv_3)
