# Grasshopper definition cycle_island.gh (Grasshopper 1.0.7)

number_slider = Slider(1.706, range=0..10)
range = Range(Domain="0 to 100", Steps="2000")
lng = ListLength(List=range)
panel = Panel("1")
cir = Circle(Plane=PlaneXY(0, 0, 0), Radius=10)
divide = DivideCurve(Curve=reparameterize(cir), Count=10, Kinks=False)  # -> Points, Tangents, Parameters
col = Colour(ColourSwatch(SwatchColor=RGB(35, 161, 52)))

run = BooleanToggle(False)

iterator = CSharpScript(count=lng, run=run)  # -> out, index; inputs count: Int32, run: Boolean
# ---------- iterator: C# ----------
    if(counter < count && run) {
      counter++;
      Print("Creating Panel: " + counter.ToString() + " of " + count.ToString());
      Component.ExpireSolution(true);
      index = counter - 1;
    }else{
      counter = 0;
      index = -1;
      Print("inactive");
    }
# ---------- iterator: C# additional code ----------
  int counter = 0;
# ---------- end iterator ----------

run_status = Panel(iterator.out)

panel_2 = Panel(iterator.index)
item = ListItem(List=range, Index=panel_2, Wrap=False)
addition = Addition(A=1, B=panel_2)
int = Integer(addition)
cluster = Cluster(crv=cir, cycle="1", strength="2", slider=item)
cluster_2 = Cluster(crv=cir, cycle="5", strength="3", slider=item)
merge = Merge(Data1=graft(divide.Points), Data2=graft(cluster), Data3=graft(cluster_2))
ma = MassAddition(Input=merge)  # -> flatten(Result), PartialResults
intcrv = Interpolate(Vertices=ma.Result, Degree=3, Periodic=True, KnotStyle=1)  # -> Curve, Length, Domain
concat = Concatenate(FragmentA="cycle_island", FragmentB=int)
crv = Curve(intcrv.Curve)
c_script = CSharpScript(KEYS="name", VALUES=concat)  # -> A; inputs KEYS: list of String, VALUES: list of String
# ---------- c_script: C# ----------
    Rhino.DocObjects.ObjectAttributes att = new Rhino.DocObjects.ObjectAttributes();
    for(int i = 0 ; i < KEYS.Count ; i++){
      att.SetUserString(KEYS[i], VALUES[i]);
    }
    A = att;
# ---------- end c_script ----------
larger = LargerThan(FirstNumber=panel_2, SecondNumber=-1)  # -> LargerThan, OrEqualTo
bake_with_attributes = CSharpScript(objList=crv, layerList="cycle_island", ColorList=col, activate=larger.LargerThan, attributes=c_script, name=concat)  # -> flatten(text_out), A; inputs objList: list of GeometryBase, layerList: list of String, ColorList: list of Color, activate: Boolean, attributes: list, name: list of String
# ---------- bake_with_attributes: C# usings ----------
using System.IO;
using System.Linq;
using System.Data;
using System.Drawing;
using System.Reflection;
using System.Windows.Forms;
using System.Xml;
using System.Xml.Linq;
using System.Runtime.InteropServices;

using Rhino.DocObjects;
using Rhino.Collections;
using GH_IO;
using GH_IO.Serialization;
# ---------- bake_with_attributes: C# ----------
    Color clr = new Color();
    clr = Color.CadetBlue;
    String lyrName = "test";
    String objName = "object";

    if (activate)
    {
      for(int iCount = 0 ; iCount < objList.Count ; iCount++){
        GeometryBase obj = objList[iCount];
        clr = ColorList[iCount];
        lyrName = layerList[iCount];


        System.Guid exObj = System.Guid.NewGuid();
        objName = lyrName + "_" + iCount;

        if(obj == null)
        {
          Print("No object to bake");
          return;
        }

        //Make new attribute to set name
        Rhino.DocObjects.ObjectAttributes att = new Rhino.DocObjects.ObjectAttributes();
        if(attributes.Count >= iCount && attributes[iCount] != null){
          att = attributes[iCount] as Rhino.DocObjects.ObjectAttributes;
        }


        //Set layer
        if(!string.IsNullOrEmpty(lyrName) && Rhino.DocObjects.Layer.IsValidName(lyrName))
        {
          //Get the current layer index
          Rhino.DocObjects.Tables.LayerTable layerTable = doc.Layers;
          int layerIndex = layerTable.FindByFullPath(lyrName, -1);
          if(layerIndex < 0) //This layer does not exist, we add it
          {
            Rhino.DocObjects.Layer onlayer = new Rhino.DocObjects.Layer(); //Make a new layer
            onlayer.Name = lyrName;
            onlayer.Color = clr;
            layerIndex = layerTable.Add(onlayer); //Add the layer to the layer table
            if (layerIndex > -1) //We manged to add layer!
            {
              att.LayerIndex = layerIndex;
              Print("Added new layer to the document at position " + layerIndex + " named " + lyrName + ". ");
            } else
              Print("Layer did not add. Try cleaning up your layers."); //This never happened to me.
          }
          else
            att.LayerIndex = layerIndex; //We simply add to the existing layer
        }
        
        //set name
        att.Name = name[iCount];

        //Bake to the right type of object
        switch(obj.ObjectType)
        {
          case Rhino.DocObjects.ObjectType.Brep:
            exObj = doc.Objects.AddBrep(obj as Brep, att);
            break;
          case Rhino.DocObjects.ObjectType.Curve:
            exObj = doc.Objects.AddCurve(obj as Curve, att);
            break;
          case Rhino.DocObjects.ObjectType.Point:
            exObj = doc.Objects.AddPoint((obj as Rhino.Geometry.Point).Location, att);
            break;
          case Rhino.DocObjects.ObjectType.Surface:
            exObj = doc.Objects.AddSurface(obj as Surface, att);
            break;
          case Rhino.DocObjects.ObjectType.Mesh:
            exObj = doc.Objects.AddMesh(obj as Mesh, att);
            break;
          case Rhino.DocObjects.ObjectType.Annotation:
            if(obj.GetType().ToString() == "Rhino.Geometry.LinearDimension"){
              exObj = doc.Objects.AddLinearDimension(obj as Rhino.Geometry.LinearDimension, att);
            }else{
              exObj = doc.Objects.AddText(obj as Rhino.Geometry.TextEntity, att);
            }
            break;
          default:
            Print("The script does not know how to handle this type of geometry: " + obj.GetType().FullName);
            break;
        }
      }
    }
    else
    {
      Print("Inactive");
    }
# ---------- end bake_with_attributes ----------

# ==== cluster Cluster
crv = ClusterInput()
strength = ClusterInput()
cycle = ClusterInput()
slider = ClusterInput()
crv_2 = Curve(crv)
strength_2 = Number(strength)
cycle_2 = Number(cycle)
slider_2 = Number(slider)
slider_3 = Modulus(A=slider_2, B=cycle_2)
division = Division(A=slider_3, B=cycle_2)
divide = DivideCurve(Curve=reparameterize(crv_2), Count=10, Kinks=False)  # -> Points, Tangents, Parameters
eval = EvaluateCurve(Curve=reparameterize(crv_2), Parameter=division)  # -> Point, Tangent, Angle
dist = Distance(PointA=divide.Points, PointB=eval.Point)
bnd = Bounds(Numbers=dist)
remap = RemapNumbers(Value=dist, Source=bnd, Target=Domain(0, 1))  # -> Mapped, Clipped
subtraction = Subtraction(A="1", B=remap.Mapped)
graph = GraphMapper(subtraction, x0=0, x1=1, y0=0, y1=1, container_name="Bezier", cpx=[0, 1, 0.7045454383, 1], cpy=[0, 0, 1, 1])
multiplication = Multiplication(A=graph, B=strength_2)
amp = Amplitude(Vector=divide.Points, Amplitude=multiplication)
V = ClusterOutput(amp)
