# Grasshopper definition db_viz.gh (Grasshopper 1.0.7)

crv = Curve([<curve referenced from the Rhino model> x9])
pt = Point([<point referenced from the Rhino model> x2129])
pt_2 = Point([<point referenced from the Rhino model> x115])
area = Area(Geometry=crv)  # -> Area, Centroid
swatch = ColourSwatch(SwatchColor=RGBA(0, 204, 227, 131))
swatch_2 = ColourSwatch(SwatchColor=RGBA(171, 171, 171, 63))
swatch_3 = ColourSwatch(SwatchColor=RGBA(201, 143, 16, 162))
pdecon = Deconstruct(Point=area.Centroid)  # -> XComponent, YComponent, ZComponent
dom = ConstructDomain(DomainStart=20, DomainEnd=150)
sort = SortList(Keys=pdecon.ZComponent, ValuesA=crv)  # -> Keys, ValuesA
bnd = Bounds(Numbers=sort.Keys)
pdecon_2 = Deconstruct(Point=pt)  # -> XComponent, YComponent, ZComponent
shift = ShiftList(List=sort.ValuesA, Shift=1, Wrap=False)  # -> graft(List)
shift_2 = ShiftList(List=sort.ValuesA, Shift=-1, Wrap=False)  # -> graft(List)
remap = RemapNumbers(Value=sort.Keys, Source=bnd, Target=dom)  # -> Mapped, Clipped
swatch_4 = ColourSwatch(SwatchColor=RGBA(117, 117, 117, 13))
bnd_2 = Bounds(Numbers=pdecon_2.ZComponent)
dom_2 = ConstructDomain(DomainStart=45, DomainEnd=255)
argb = SplitARGB(Colour=swatch_3, IntegerChannels=True)  # -> Alpha, Red, Green, Blue
srf = Surface(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)
argb_2 = SplitARGB(Colour=swatch, IntegerChannels=True)  # -> Alpha, Red, Green, Blue
crv_2 = Curve(srf)
merge = Merge(Data1=shift, Data2=shift_2)
rgb = ColourRGB(Alpha=remap.Mapped, Red=argb.Red, Green=argb.Green, Blue=argb.Blue)
remap_2 = RemapNumbers(Value=pdecon_2.ZComponent, Source=bnd_2, Target=dom_2)  # -> Mapped, Clipped
rgb_2 = ColourRGB(Alpha=remap_2.Mapped, Red=argb_2.Red, Green=argb_2.Green, Blue=argb_2.Blue)
list = ValueList({"One": 1, "Two": 2, "Three": 2² - 1, "Four": Sqrt(16)}, selected="One")
dim = Dimensions(Surface=srf)  # -> UDimension, VDimension
loft = Loft(Curves=merge, Options={Adjust=True, Closed=False, LoftEnds=0, LoftSimp=0, LoftType=0, Rebuild=10, Refit=0.01})  # -> flatten(Loft)
pt_3 = Point([<point referenced from the Rhino model> x119])
pt_4 = Point([<point referenced from the Rhino model> x13])
item = ListItem(List=sort.ValuesA, Index=0, Wrap=True)  # -> Item1, Item
division = Division(A=dim.UDimension, B=".5")
division_2 = Division(A=dim.VDimension, B=".5")
boundary = BoundarySurfaces(Edges=sort.ValuesA)
symsim = SymbolSimple(Style=1, Size=10, Rotation=0, Colour=swatch)
range = Range(Domain=Domain(0, 1), Steps=division)
range_2 = Range(Domain=Domain(0, 1), Steps=division_2)
symsim_2 = SymbolSimple(Style=1, Size=10, Rotation=0, Colour=swatch_3)
dots = DotDisplay(Point=pt, Colour=rgb_2, Size=0.03)
dots_2 = DotDisplay(Point=pt_2, Colour=swatch_3, Size=0.05)
crv_3 = Curve(item.Item1)
pt_5 = ConstructPoint(XCoordinate=range, YCoordinate=range_2, ZCoordinate=0)
symbol = SymbolDisplay(Location=pt_3, Display=symsim)
symbol_2 = SymbolDisplay(Location=pt_4, Display=symsim_2)
mesh_uv = MeshSurface(Surface=srf, UCount=20, VCount=20, Overhang=True, Equalize=False)
dots_3 = DotDisplay(Point=pt, Colour=ColourSwatch(SwatchColor=RGB(255, 161, 38)), Size=0.04)
item_2 = ListItem(List=sort.ValuesA, Index=0, Wrap=True)
preview = CustomPreview(Geometry=mesh_uv, Material=swatch_4)
pdecon_3 = Deconstruct(Point=pt_2)  # -> XComponent, YComponent, ZComponent
preview_2 = CustomPreview(Geometry=sort.ValuesA, Material=swatch_2)
preview_3 = CustomPreview(Geometry=sort.ValuesA, Material=swatch_2)
pt_6 = ConstructPoint(XCoordinate=pdecon_3.XComponent, YCoordinate=pdecon_3.YComponent, ZCoordinate=0)
preview_4 = CustomPreview(Geometry=boundary, Material=rgb)
preview_5 = CustomPreview(Geometry=srf, Material=swatch_4)
preview_6 = CustomPreview(Geometry=loft, Material=rgb)
cullpt = CullDuplicates(Points=pt_6, Tolerance=0.1, CullMode=3)  # -> simplify(graft(Points)), Indices, Valence
cp = ClosestPoint(Point=pt_6, Cloud=flatten(cullpt.Points))  # -> ClosestPoint, CPIndex, Distance
pt_7 = Point(graft(pt_6))
viewer = ParamViewer(cullpt.Points)
item_3 = ListItem(List=viewer, Index=cp.CPIndex, Wrap=True)
viewer_2 = ParamViewer(pt_7)
replace = ReplacePaths(Data=pt_7, Search=viewer_2, Replace=item_3)
divide = DivideCurve(Curve=sort.ValuesA, Count=10, Kinks=False)  # -> Points, Tangents, Parameters
avr = Average(Input=replace)  # -> flatten(ArithmeticMean)
pdecon_4 = Deconstruct(Point=divide.Points)  # -> XComponent, YComponent, ZComponent
pt_8 = ConstructPoint(XCoordinate=pdecon_4.XComponent, YCoordinate=pdecon_4.YComponent, ZCoordinate=0)  # -> flatten(Point)
lng = ListLength(List=replace)
merge_2 = Merge(Data1=pt_8, Data2=avr)
bnd_3 = Bounds(Numbers=flatten(lng))
dom_3 = ConstructDomain(DomainStart=0, DomainEnd=1)
del = DelaunayMesh(Points=merge_2, Plane=PlaneXY(0, 0, 0))
remap_3 = RemapNumbers(Value=flatten(lng), Source=bnd_3, Target=dom_3)  # -> Mapped, Clipped
gradient = Gradient(LowerLimit=0, UpperLimit=1, Parameter=remap_3.Mapped, stops=[0: RGB(255, 255, 0), 1: RGB(220, 0, 40)])
argb_3 = SplitARGB(Colour=gradient, IntegerChannels=True)  # -> Alpha, Red, Green, Blue
rgb_3 = ColourRGB(Alpha="100", Red=argb_3.Red, Green=argb_3.Green, Blue=argb_3.Blue)
mspray = MeshSpray(Mesh=del, Points=flatten(avr), Colours=rgb_3, SprayMode=11)
