# Grasshopper definition island_sim2.gh (Grasshopper 1.0.7)

dom = ConstructDomain(DomainStart="-1", DomainEnd="1")
dom_2 = ConstructDomain(DomainStart="-.05", DomainEnd=".05")
pt = ConstructPoint(XCoordinate=0, YCoordinate=0, ZCoordinate=0)
crv = Curve([<curve referenced from the Rhino model> x101])
obj = CSharpScript(obj=crv)  # -> name; inputs obj: Guid
# ---------- obj: C# ----------
var the_obj = doc.Objects.Find(obj);

name = the_obj.Attributes.Name;
# ---------- end obj ----------
cir = Circle(Plane=pt, Radius=1)
range = Range(Domain=dom, Steps="200")
random = Random(Range=dom_2, Number="200", Seed=2)
split = TextSplit(Text=obj, Separators="_")
graph = GraphMapper(range, x0=0, x1=1, y0=-1, y1=1, container_name="Sine", Equation_px=[0, 0.07773851603], Equation_py=[0, 0.9662162066])
item = ListItem(List=split, Index=0, Wrap=True)  # -> Item, flatten(Item1)
sort = SortList(Keys=item.Item1, ValuesA=crv)  # -> Keys, ValuesA
path = FilePath("/Users/walterzesk/Desktop/100_boundaries.csv")  # disabled
dom_3 = ConstructDomain(DomainStart=-2.5, DomainEnd=2.5)
Y = UnitY(Factor=1)
X = UnitX(Factor=1)
divide = DivideCurve(Curve=sort.ValuesA, Count=10, Kinks=False)  # -> simplify(graft(Points)), Tangents, Parameters
range_2 = Range(Domain=dom_3, Steps=expr("x-1", "10"))
divide_2 = DivideCurve(Curve=cir, Count="10", Kinks=False)  # -> Points, Tangents, Parameters
amp = Amplitude(Vector=X, Amplitude=graph)
amp_2 = Amplitude(Vector=Y, Amplitude=random)
file = ReadFile(File=path, PerLineParse=True)  # disabled
pt_2 = ConstructPoint(XCoordinate=graft(range_2), YCoordinate=range_2, ZCoordinate=0)
addition = Addition(A=amp, B=amp_2)
pt2num = PointsToNumbers(Points=divide.Points, Mask=4)  # -> graft(Numbers)
split_2 = TextSplit(Text=file, Separators=",")  # disabled
panel = Panel("3")  # disabled
vdis = VectorDisplay(Anchor=pt, Vector=addition)
split_3 = SplitList(List=addition, Index="100")  # -> ListA, ListB
pt2num_2 = PointsToNumbers(Points=graft(split_3.ListA), Mask=4)  # -> simplify(Numbers); disabled
path_mapper = PathMapper(pt2num, source="{A;B;C;D}", target="{A}")
partition = PartitionList(List=split_2, Size=panel)  # disabled
num2pt = NumbersToPoints(Numbers=partition, Mask=4)  # -> simplify(Points); disabled
num = Number(path_mapper)  # disabled
num_2 = Number(pt2num_2)  # disabled
join = TextJoin(Text=num, Join=",")  # -> flatten(Result); disabled
join_2 = TextJoin(Text=num_2, Join=",")  # -> flatten(Result); disabled
path_mapper_2 = PathMapper(num2pt, source="{A;B}", target="{A}")  # disabled
lng = ListLength(List=split_3.ListA)
panel_2 = Panel(join)  # disabled
panel_3 = Panel(join_2)  # disabled
intcrv = Interpolate(Vertices=path_mapper_2, Degree=3, Periodic=True, KnotStyle=1)  # -> Curve, Length, Domain; disabled
panel_4 = Panel("1")
panel_5 = Panel(pt2num)
python = GhPythonScript(x=pt2num)  # -> out, a; inputs x: tree
# ---------- python: Python ----------
__author__ = "walte"
__version__ = "2023.03.01"

import rhinoscriptsyntax as rs

a = []
 
for i in range(x.BranchCount):
    branchList = x.Branch(i)
    branchPath = x.Path(i)
    
    for j in range(branchList.Count):
        s = str(branchPath) + "[" + str(j) + "] "
        s += type(branchList[j]).__name__ + ": "
        s += str(branchList[j])
        
        a.append(s)
# ---------- end python ----------
panel_6 = Panel(python.a)
gradient = Gradient(LowerLimit="0", UpperLimit="100", Parameter="0", stops=[0: RGB(135, 217, 237), 1: RGB(28, 0, 141)])
intcrv_2 = Interpolate(Vertices=divide_2.Points, Degree=3, Periodic=True, KnotStyle=1)  # -> Curve, Length, Domain
area = Area(Geometry=cir)  # -> Area, Centroid
bake = BooleanToggle(False)
concat = Concatenate(FragmentA="island_", FragmentB="0")
c_script = CSharpScript(KEYS="name", VALUES=concat)  # -> A; inputs KEYS: list of String, VALUES: list of String
# ---------- c_script: C# ----------
    Rhino.DocObjects.ObjectAttributes att = new Rhino.DocObjects.ObjectAttributes();
    for(int i = 0 ; i < KEYS.Count ; i++){
      att.SetUserString(KEYS[i], VALUES[i]);
    }
    A = att;
# ---------- end c_script ----------
panel_7 = Panel("10")

run = BooleanToggle(False)

iterator = CSharpScript(count=lng, run=run)  # -> out, index; inputs count: Int32, run: Boolean
# ---------- iterator: C# ----------
    if(counter < count && run) {
      counter++;
      Print("Creating Panel: " + counter.ToString() + " of " + count.ToString());
      Component.ExpireSolution(true);
      index = counter - 1;
    }else{
      counter = 0;
      index = -1;
      Print("inactive");
    }
# ---------- iterator: C# additional code ----------
  int counter = 0;
# ---------- end iterator ----------

run_status = Panel(iterator.out)

addition_2 = Addition(A=iterator.index, B=0)
int = Integer(addition_2)
multiplication = Multiplication(A=int, B=".25")
Z = UnitZ(Factor=multiplication)
gradient_2 = Gradient(LowerLimit="0", UpperLimit="100", Parameter=int, stops=[0: RGB(135, 217, 237), 1: RGB(28, 0, 141)])
item_2 = ListItem(List=split_3.ListA, Index=int, Wrap=True)
concat_2 = Concatenate(FragmentA="island_", FragmentB=int)
cluster = Cluster(T=concat_2, layer="island_track_vis")  # -> out_2, geometry_2, id_2
project = Project(Geometry=cluster.geometry_2, Plane=PlaneXY(0, 0, 0))  # -> Geometry, Transform
crv_2 = Curve(project.Geometry)
divide_3 = DivideCurve(Curve=crv_2, Count="10", Kinks=False)  # -> Points, Tangents, Parameters
vec = Vector(item_2)
cluster_2 = Cluster_2(V=vec, V_2=divide_3.Points)
vlen = VectorLength(Vector=vec)
multiplication_2 = Multiplication(A=vlen, B=cluster_2)
amp_3 = Amplitude(Vector=vec, Amplitude=multiplication_2)
addition_3 = Addition(A=amp_3, B=divide_3.Points)
hull = ConvexHull(Points=addition_3, Plane=PlaneXY(0, 0, 0))  # -> Hull, HullZ, Indices
intcrv_3 = Interpolate(Vertices=addition_3, Degree=3, Periodic=True, KnotStyle=1)  # -> Curve, Length, Domain
disc = Discontinuity(Curve=hull.Hull, Level=1)  # -> Points, Parameters
crv_cp = CurveClosestPoint(Point=disc.Points, Curve=intcrv_3.Curve)  # -> Point, Parameter, Distance
expression = Expression(x=disc.Points, y=crv_cp.Point, Expression="(x+y)/2")
intcrv_4 = Interpolate(Vertices=expression, Degree=3, Periodic=True, KnotStyle=1)  # -> Curve, Length, Domain
col = Colour(gradient_2)
area_2 = Area(Geometry=intcrv_4.Curve)  # -> Area, Centroid
division = Division(A=area.Area, B=area_2.Area)
larger = LargerThan(FirstNumber=int, SecondNumber=-1)  # -> LargerThan, OrEqualTo
filter = StreamFilter(Gate=larger.LargerThan, Stream0=area.Centroid, Stream1=area_2.Centroid)
filter_2 = StreamFilter(Gate=larger.LargerThan, Stream0=area.Centroid, Stream1=area_2.Centroid)
addition_4 = Addition(A=int, B="1")
sqrt = SquareRoot(Value=division)
concat_3 = Concatenate(FragmentA="island_", FragmentB=addition_4)
and = GateAnd(A=larger.LargerThan, B=bake)
scale = Scale(Geometry=intcrv_4.Curve, Center=area_2.Centroid, Factor=sqrt)  # -> Geometry, Transform
filter_3 = StreamFilter(Gate=larger.LargerThan, Stream0=intcrv_2.Curve, Stream1=scale.Geometry)
cluster_3 = Cluster_3(pt=pt_2, crv=filter_3)  # -> bool_2, A, B
move = Move(Geometry=cluster_3.A, Motion=Z)  # -> flatten(Geometry), Transform
move_2 = Move(Geometry=cluster_3.B, Motion=Z)  # -> flatten(Geometry), Transform
clean = CleanTree(RemoveNulls=True, RemoveInvalid=True, RemoveEmpty=False, Tree=move.Geometry)  # -> flatten(Tree)
clean_2 = CleanTree(RemoveNulls=True, RemoveInvalid=True, RemoveEmpty=False, Tree=move_2.Geometry)  # -> flatten(Tree)
c_script_2 = CSharpScript(KEYS="name", VALUES=concat_3)  # -> A; inputs KEYS: list of String, VALUES: list of String; same code as c_script
area_3 = Area(Geometry=filter_3)  # -> Area, Centroid
bbox = BoundingBox(Content=filter_3, Plane=PlaneXY(0, 0, 0))  # -> Box, Box_2
move_3 = Move(Geometry=scale.Geometry, Motion=Z)  # -> Geometry, Transform
move_4 = Move(Geometry=intcrv_2.Curve, Motion=Z)  # -> Geometry, Transform
debox = DeconstructBox(Box=bbox.Box)  # -> Plane, X, Y, Z
dedomain = DeconstructDomain(Domain=debox.X)  # -> Start, End
dedomain_2 = DeconstructDomain(Domain=debox.Y)  # -> Start, End
bake_with_attributes = CSharpScript(
    objList=move_4.Geometry,
    layerList="island_track_vis",
    ColorList=gradient,
    activate=Button(),
    attributes=c_script,
    name=concat)  # -> flatten(text_out), A; inputs objList: list of GeometryBase, layerList: list of String, ColorList: list of Color, activate: Boolean, attributes: list, name: list of String
# ---------- bake_with_attributes: C# usings ----------
using System.IO;
using System.Linq;
using System.Data;
using System.Drawing;
using System.Reflection;
using System.Windows.Forms;
using System.Xml;
using System.Xml.Linq;
using System.Runtime.InteropServices;

using Rhino.DocObjects;
using Rhino.Collections;
using GH_IO;
using GH_IO.Serialization;
# ---------- bake_with_attributes: C# ----------
    Color clr = new Color();
    clr = Color.CadetBlue;
    String lyrName = "test";
    String objName = "object";

    if (activate)
    {
      for(int iCount = 0 ; iCount < objList.Count ; iCount++){
        GeometryBase obj = objList[iCount];
        clr = ColorList[iCount];
        lyrName = layerList[iCount];


        System.Guid exObj = System.Guid.NewGuid();
        objName = lyrName + "_" + iCount;

        if(obj == null)
        {
          Print("No object to bake");
          return;
        }

        //Make new attribute to set name
        Rhino.DocObjects.ObjectAttributes att = new Rhino.DocObjects.ObjectAttributes();
        if(attributes.Count >= iCount && attributes[iCount] != null){
          att = attributes[iCount] as Rhino.DocObjects.ObjectAttributes;
        }


        //Set layer
        if(!string.IsNullOrEmpty(lyrName) && Rhino.DocObjects.Layer.IsValidName(lyrName))
        {
          //Get the current layer index
          Rhino.DocObjects.Tables.LayerTable layerTable = doc.Layers;
          int layerIndex = layerTable.FindByFullPath(lyrName, -1);
          if(layerIndex < 0) //This layer does not exist, we add it
          {
            Rhino.DocObjects.Layer onlayer = new Rhino.DocObjects.Layer(); //Make a new layer
            onlayer.Name = lyrName;
            onlayer.Color = clr;
            layerIndex = layerTable.Add(onlayer); //Add the layer to the layer table
            if (layerIndex > -1) //We manged to add layer!
            {
              att.LayerIndex = layerIndex;
              Print("Added new layer to the document at position " + layerIndex + " named " + lyrName + ". ");
            } else
              Print("Layer did not add. Try cleaning up your layers."); //This never happened to me.
          }
          else
            att.LayerIndex = layerIndex; //We simply add to the existing layer
        }
        
        //set name
        att.Name = name[iCount];

        //Bake to the right type of object
        switch(obj.ObjectType)
        {
          case Rhino.DocObjects.ObjectType.Brep:
            exObj = doc.Objects.AddBrep(obj as Brep, att);
            break;
          case Rhino.DocObjects.ObjectType.Curve:
            exObj = doc.Objects.AddCurve(obj as Curve, att);
            break;
          case Rhino.DocObjects.ObjectType.Point:
            exObj = doc.Objects.AddPoint((obj as Rhino.Geometry.Point).Location, att);
            break;
          case Rhino.DocObjects.ObjectType.Surface:
            exObj = doc.Objects.AddSurface(obj as Surface, att);
            break;
          case Rhino.DocObjects.ObjectType.Mesh:
            exObj = doc.Objects.AddMesh(obj as Mesh, att);
            break;
          case Rhino.DocObjects.ObjectType.Annotation:
            if(obj.GetType().ToString() == "Rhino.Geometry.LinearDimension"){
              exObj = doc.Objects.AddLinearDimension(obj as Rhino.Geometry.LinearDimension, att);
            }else{
              exObj = doc.Objects.AddText(obj as Rhino.Geometry.TextEntity, att);
            }
            break;
          default:
            Print("The script does not know how to handle this type of geometry: " + obj.GetType().FullName);
            break;
        }
      }
    }
    else
    {
      Print("Inactive");
    }
# ---------- end bake_with_attributes ----------
bake_with_attributes_2 = CSharpScript(objList=move_3.Geometry, layerList="island_track_vis", ColorList=col, activate=and, attributes=c_script_2, name=concat_3)  # -> flatten(text_out), A; inputs objList: list of GeometryBase, layerList: list of String, ColorList: list of Color, activate: Boolean, attributes: list, name: list of String; same code as bake_with_attributes
pt_3 = Point(simplify(graft(clean_2)))
bool = Boolean(flatten(cluster_3.bool_2))
pt_4 = Point(simplify(graft(clean)))
subtraction = Subtraction(A=dedomain.End, B=dedomain.Start)
subtraction_2 = Subtraction(A=dedomain_2.End, B=dedomain_2.Start)
lng_2 = ListLength(List=clean_2)
lng_3 = ListLength(List=clean)
int_2 = Integer(bool)
division_2 = Division(A=subtraction, B=subtraction_2)
dup = DuplicateData(Data=c_script, Number=lng_2, Order=True)  # -> simplify(graft(Data))
join_3 = TextJoin(Text=int_2, Join=",")
dup_2 = DuplicateData(Data=c_script, Number=lng_3, Order=True)  # -> simplify(graft(Data))
num_3 = Number(flatten(division_2))
rec = DataRecorder(num_3, DataLimit=-10, RecordData=False)
rec_2 = DataRecorder(join_3, DataLimit=-10, RecordData=False)
bake_with_attributes_3 = CSharpScript(objList=pt_4, layerList="land_pts", ColorList=gradient, activate=and, attributes=dup_2, name=concat)  # -> flatten(text_out), A; inputs objList: list of GeometryBase, layerList: list of String, ColorList: list of Color, activate: Boolean, attributes: list, name: list of String; same code as bake_with_attributes
bake_with_attributes_4 = CSharpScript(objList=pt_3, layerList="water_pts", ColorList=col, activate=and, attributes=dup, name=concat_3)  # -> flatten(text_out), A; inputs objList: list of GeometryBase, layerList: list of String, ColorList: list of Color, activate: Boolean, attributes: list, name: list of String; same code as bake_with_attributes
panel_8 = Panel(rec)
panel_9 = Panel(rec_2)
merge = Merge(Data1="10x10", Data2=panel_8)
merge_2 = Merge(Data1="10x10", Data2=panel_9)
split_4 = TextSplit(Text=merge, Separators=",")
split_5 = TextSplit(Text=merge_2, Separators=",")
panel_10 = Panel(panel_8)
panel_11 = Panel(panel_9)

# ==== cluster Cluster
layer = ClusterInput()
T = ClusterInput()
layer_2 = Text(layer)
trim = TextTrim(Text=T, Start=True, End=True)
panel = Panel(layer_2)
clean = CleanTree(RemoveNulls=True, RemoveInvalid=True, RemoveEmpty=False, Tree=trim)
c_script = CSharpScript(names=clean, layer=panel)  # -> out, geometry, id; inputs names: list of String, layer: String
# ---------- c_script: C# ----------
if(names.Count > 0){
    List<Rhino.Geometry.GeometryBase> geoms = new List<Rhino.Geometry.GeometryBase>();
    List<string> ids = new List<string>();
    foreach(string name in names){
        if(name is string && name.Length > 0){
            Print("finding: "+name);
            Rhino.DocObjects.ObjectEnumeratorSettings settings = new Rhino.DocObjects.ObjectEnumeratorSettings();

            //get frame
            settings.NameFilter = name;
            settings.HiddenObjects = true;

            int lindex = doc.Layers.FindName(layer).Index;
            settings.LayerIndexFilter = lindex;
            var obj_list = doc.Objects.FindByFilter(settings);
            Print("found "+obj_list.Length+" objects");
            for(int i= 0 ; i < obj_list.Length;i++){
               geoms.Add(obj_list[i].Geometry);
               ids.Add(name);
            }
        }
    }
    geometry = geoms;
    id = ids;
}else{
    geometry = null;
    id = null;
 }
# ---------- end c_script ----------
panel_2 = Panel(c_script.out)
clean_2 = CleanTree(RemoveNulls=True, RemoveInvalid=True, RemoveEmpty=False, Tree=c_script.out)
clean_3 = CleanTree(RemoveNulls=True, RemoveInvalid=True, RemoveEmpty=False, Tree=c_script.geometry)
clean_4 = CleanTree(RemoveNulls=True, RemoveInvalid=True, RemoveEmpty=False, Tree=c_script.id)
geometry = Geometry(clean_3)
out = Text(clean_2)
id = Text(clean_4)
id_2 = ClusterOutput(id)
geometry_2 = ClusterOutput(geometry)
out_2 = ClusterOutput(out)

# ==== cluster Cluster_2
V = ClusterInput()
V_2 = ClusterInput()
unit = UnitVector(Vector=V)
unit_2 = UnitVector(Vector=V_2)
rev = Reverse(Vector=unit_2)
dist = Distance(PointA=unit, PointB=unit_2)
dist_2 = Distance(PointA=unit, PointB=rev)
smaller = SmallerThan(FirstNumber=dist, SecondNumber=dist_2)  # -> SmallerThan, OrEqualTo
xy = XYPlane(Origin=Point(0, 0, 0))
p_n_c = PickNChoose(Pattern=smaller.SmallerThan, Stream0=rev, Stream1=unit_2)
angle = Angle(VectorA=unit, VectorB=p_n_c, Plane=xy)  # -> Angle, Reflex
min = Minimum(A=angle.Angle, B=angle.Reflex)
num = Number(min)
num_2 = ClusterOutput(num)

# ==== cluster Cluster_3
crv = ClusterInput()
pt = ClusterInput()
crv_2 = Curve(crv)
pt_2 = Point(pt)
incurve = PointInCurve(Point=pt_2, Curve=crv_2)  # -> Relationship, Point
bool = Boolean(incurve.Relationship)
dispatch = Dispatch(List=pt_2, DispatchPattern=bool)  # -> ListA, ListB
bool_2 = ClusterOutput(bool)
A = ClusterOutput(dispatch.ListA)
B = ClusterOutput(dispatch.ListB)
