# Grasshopper definition island_sim5_tspDB.gh (Grasshopper 1.0.7)
# plug-ins: LunchBox

number_slider = Slider(2, range=0..2)
crv = Curve([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])
crv_2 = Curve(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)
area = Area(Geometry=crv)  # -> Area, Centroid
panel = Panel("""0
-8
14""")
panel_2 = Panel("""0
5
6""")
points = PointList(Points=area.Centroid, Size=3)
txt = Text(["time,MT_001,MT_002,MT_003,MT_004,MT_005,MT_006,MT_007,MT_008,MT_009,MT_010,MT_011,MT_012,MT_013,MT_014,MT_015,MT_016,MT_017,MT_018,MT_019,MT_020", "2012-01-01 01:00:00,4.124365482233502,22.7596017069701,77.3240660295395,138.211382113821,72.25609756097563,348.2142857142858,8.620689655172415,279.461279461279,72.98951048951051,87.90322580645163,59.79880774962745,0.0,47.6782752902156,36.53477983407785,0.0,55.09681093394077,76.14555256064693,328.2747603833865,15.577889447236176,55.066079295154175", "2012-01-01 02:00:00,4.758883248730965,23.115220483641522,77.3240660295395,137.1951219512195,70.1219512195122,339.2857142857145,6.924816280384395,276.09427609427627,67.30769230769229,82.25806451612905,55.8867362146051,0.0,46.019900497512424,34.1416719846841,0.0,52.249430523918,73.22551662174303,305.9105431309903,15.45226130653265,51.1013215859031", "2012-01-01 03:00:00,4.124365482233502,22.937411095305798,77.3240660295395,136.686991869919,66.46341463414637,286.45833333333326,6.642170717919726,239.89898989898975,63.8111888111888,72.04301075268819,54.58271236959765,0.0,43.532338308457724,33.024888321633696,0.0,43.42255125284737,61.994609164420496,276.35782747603827,14.070351758793976,48.45814977973565", "2012-01-01 04:00:00,4.758883248730967,22.0483641536273,77.3240660295395,102.13414634146342,50.30487804878047,191.96428571428575,4.80497456189938,200.33670033670052,41.52097902097903,46.2365591397849,38.18926974664677,0.0,35.862354892205644,26.0051052967454,0.0,35.4498861047836,46.49595687331535,188.4984025559105,7.663316582914577,39.42731277533038", "2012-01-01 05:00:00,4.441624365482235,21.8705547652916,77.3240660295395,81.80894308943087,45.12195121951217,155.50595238095224,3.533069530808365,180.13468013467974,45.89160839160843,42.473118279569846,33.9046199701937,0.0,42.288557213930325,24.409700063816224,0.0,33.5990888382688,35.26504941599285,160.5431309904155,6.15577889447236,34.361233480176224"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])
pt = ConstructPoint(XCoordinate=panel, YCoordinate=panel_2, ZCoordinate=0)
split = SplitList(List=txt, Index=1)  # -> ListA, ListB
item = ListItem(List=crv, Index=number_slider, Wrap=True)
item_2 = ListItem(List=pt, Index=number_slider, Wrap=True)
split_2 = TextSplit(Text=split.ListB, Separators=",")
item_3 = ListItem(List=split_2, Index=0, Wrap=True)  # -> flatten(Item)
split_3 = TextSplit(Text=split.ListA, Separators=",")
dom = ConstructDomain(DomainStart="-1", DomainEnd="1")
dom_2 = ConstructDomain(DomainStart="-.05", DomainEnd=".05")
csv = CreateCSV(DataGridHeaders=split_3, ValueTree=item_3, Delimiter=",")  # -> flatten(CSVString)
dom_3 = ConstructDomain(DomainStart=0.1, DomainEnd=0.3)
random = Random(Range=dom_3, Number="1", Seed=item_2)
panel_3 = Panel(csv)
random_2 = Random(Range=dom_2, Number="200", Seed=item_2)
cir = Circle(Plane=item_2, Radius=1)
range = Range(Domain=dom, Steps="200")
graph = GraphMapper(range, x0=0, x1=1, y0=-1, y1=1, container_name="Sine", Equation_px=[0, 0.07773851603], Equation_py=[0, 0.9662162066])
graph_2 = GraphMapper(range, x0=0, x1=1, y0=-1, y1=1, container_name="Sine", Equation_px=[0, 0.1137545407], Equation_py=[0, 0.9712157249])
graph_3 = GraphMapper(range, x0=0, x1=1, y0=-1, y1=1, container_name="Sine", Equation_px=[0, 0.1262179017], Equation_py=[0, 0.9674039483])
crv_3 = Curve([<curve referenced from the Rhino model> x101])
obj = CSharpScript(obj=crv_3)  # -> name; inputs obj: Guid
# ---------- obj: C# ----------
var the_obj = doc.Objects.Find(obj);

name = the_obj.Attributes.Name;
# ---------- end obj ----------
bbox = BoundingBox(Content=crv_2, Plane=PlaneXY(0, 0, 0), UnionBox=True)  # -> Box, Box_2
debox = DeconstructBox(Box=bbox.Box)  # -> Plane, X, Y, Z
split_4 = TextSplit(Text=obj, Separators="_")
item_4 = ListItem(List=split_4, Index=0, Wrap=True)  # -> Item, flatten(Item1)
dedomain = DeconstructDomain(Domain=debox.X)  # -> Start, End
dedomain_2 = DeconstructDomain(Domain=debox.Y)  # -> Start, End
X = UnitX(Factor=1)
filter = StreamFilter(Gate=number_slider, Stream0=graph, Stream1=graph_2, Stream2=graph_3)
Y = UnitY(Factor=1)
subtraction = Subtraction(A=dedomain.End, B=dedomain.Start)
subtraction_2 = Subtraction(A=dedomain_2.End, B=dedomain_2.Start)
sort = SortList(Keys=item_4.Item1, ValuesA=crv_3)  # -> Keys, ValuesA
amp = Amplitude(Vector=Y, Amplitude=random_2)
amp_2 = Amplitude(Vector=X, Amplitude=filter)
path = FilePath("/Users/walterzesk/Desktop/100_boundaries.csv")  # disabled
division = Division(A=subtraction_2, B=".5")
division_2 = Division(A=subtraction, B=".5")
range_2 = Range(Domain=debox.X, Steps=division_2)
range_3 = Range(Domain=debox.Y, Steps=division)
divide = DivideCurve(Curve=sort.ValuesA, Count=10, Kinks=False)  # -> simplify(graft(Points)), Tangents, Parameters
panel_4 = Panel(random)
divide_2 = DivideCurve(Curve=cir, Count="10", Kinks=False)  # -> Points, Tangents, Parameters
addition = Addition(A=amp_2, B=amp)
Z = UnitZ(Factor=1)
file = ReadFile(File=path, PerLineParse=True)  # disabled
pt_2 = ConstructPoint(XCoordinate=graft(range_2), YCoordinate=range_3, ZCoordinate=0)
vrot = Rotate(Vector=addition, Axis=Z, Angle=panel_4)
pt2num = PointsToNumbers(Points=divide.Points, Mask=4)  # -> graft(Numbers)
crv_4 = Curve(item)
split_5 = TextSplit(Text=file, Separators=",")  # disabled
panel_5 = Panel("3")  # disabled
incurve = PointInCurve(Point=pt_2, Curve=crv_4)  # -> Relationship, Point
vdis = VectorDisplay(Anchor=item_2, Vector=vrot)
split_6 = SplitList(List=vrot, Index="100")  # -> ListA, ListB
pt2num_2 = PointsToNumbers(Points=graft(split_6.ListA), Mask=4)  # -> simplify(Numbers); disabled
path_mapper = PathMapper(pt2num, source="{A;B;C;D}", target="{A}")
partition = PartitionList(List=split_5, Size=panel_5)  # disabled
num2pt = NumbersToPoints(Numbers=partition, Mask=4)  # -> simplify(Points); disabled
cull = CullPattern(List=pt_2, CullPattern=incurve.Relationship)
num = Number(path_mapper)  # disabled
num_2 = Number(pt2num_2)  # disabled
join = TextJoin(Text=num, Join=",")  # -> flatten(Result); disabled
join_2 = TextJoin(Text=num_2, Join=",")  # -> flatten(Result); disabled
path_mapper_2 = PathMapper(num2pt, source="{A;B}", target="{A}")  # disabled
lng = ListLength(List=split_6.ListA)
panel_6 = Panel(join)  # disabled
panel_7 = Panel(join_2)  # disabled
intcrv = Interpolate(Vertices=path_mapper_2, Degree=3, Periodic=True, KnotStyle=1)  # -> Curve, Length, Domain; disabled
panel_8 = Panel("0")
int = Integer(number_slider)
concat = Concatenate(FragmentA="island", FragmentB=int)
panel_9 = Panel(pt2num)
concat_2 = Concatenate(FragmentA=concat, FragmentB="_")  # -> flatten(Result)
python = GhPythonScript(x=pt2num)  # -> out, a; inputs x: tree
# ---------- python: Python ----------
__author__ = "walte"
__version__ = "2023.03.01"

import rhinoscriptsyntax as rs

a = []
 
for i in range(x.BranchCount):
    branchList = x.Branch(i)
    branchPath = x.Path(i)
    
    for j in range(branchList.Count):
        s = str(branchPath) + "[" + str(j) + "] "
        s += type(branchList[j]).__name__ + ": "
        s += str(branchList[j])
        
        a.append(s)
# ---------- end python ----------
panel_10 = Panel(concat_2)
panel_11 = Panel(python.a)
gradient = Gradient(LowerLimit="0", UpperLimit="100", Parameter="0", stops=[0: RGB(135, 217, 237), 1: RGB(28, 0, 141)])
intcrv_2 = Interpolate(Vertices=divide_2.Points, Degree=3, Periodic=True, KnotStyle=1)  # -> Curve, Length, Domain
area_2 = Area(Geometry=cir)  # -> Area, Centroid
bake = BooleanToggle(True)
concat_3 = Concatenate(FragmentA=panel_10, FragmentB="0")
c_script = CSharpScript(KEYS="name", VALUES=concat_3)  # -> A; inputs KEYS: list of String, VALUES: list of String
# ---------- c_script: C# ----------
    Rhino.DocObjects.ObjectAttributes att = new Rhino.DocObjects.ObjectAttributes();
    for(int i = 0 ; i < KEYS.Count ; i++){
      att.SetUserString(KEYS[i], VALUES[i]);
    }
    A = att;
# ---------- end c_script ----------
panel_12 = Panel("10")

run = BooleanToggle(False)

iterator = CSharpScript(count=lng, run=run)  # -> out, index; inputs count: Int32, run: Boolean
# ---------- iterator: C# ----------
    if(counter < count && run) {
      counter++;
      Print("Creating Panel: " + counter.ToString() + " of " + count.ToString());
      Component.ExpireSolution(true);
      index = counter - 1;
    }else{
      counter = 0;
      index = -1;
      Print("inactive");
    }
# ---------- iterator: C# additional code ----------
  int counter = 0;
# ---------- end iterator ----------

run_status = Panel(iterator.out)

addition_2 = Addition(A=1, B=iterator.index)
int_2 = Integer(addition_2)
multiplication = Multiplication(A=int_2, B=".25")
Z_2 = UnitZ(Factor=multiplication)
gradient_2 = Gradient(LowerLimit="0", UpperLimit="100", Parameter=int_2, stops=[0: RGB(135, 217, 237), 1: RGB(28, 0, 141)])
concat_4 = Concatenate(FragmentA=panel_10, FragmentB=iterator.index)
item_5 = ListItem(List=split_6.ListA, Index=int_2, Wrap=True)
cluster = Cluster(T=concat_4, layer="island_track_vis")  # -> out_2, geometry_2, id_2
project = Project(Geometry=cluster.geometry_2, Plane=PlaneXY(0, 0, 0))  # -> Geometry, Transform
crv_5 = Curve(project.Geometry)
divide_3 = DivideCurve(Curve=crv_5, Count="10", Kinks=False)  # -> Points, Tangents, Parameters
vec = Vector(item_5)
cluster_2 = Cluster_2(V=vec, V_2=divide_3.Points)
vlen = VectorLength(Vector=vec)
multiplication_2 = Multiplication(A=vlen, B=cluster_2)
amp_3 = Amplitude(Vector=vec, Amplitude=multiplication_2)
addition_3 = Addition(A=amp_3, B=divide_3.Points)
hull = ConvexHull(Points=addition_3, Plane=PlaneXY(0, 0, 0))  # -> Hull, HullZ, Indices
intcrv_3 = Interpolate(Vertices=addition_3, Degree=3, Periodic=True, KnotStyle=1)  # -> Curve, Length, Domain
disc = Discontinuity(Curve=hull.Hull, Level=1)  # -> Points, Parameters
crv_cp = CurveClosestPoint(Point=disc.Points, Curve=intcrv_3.Curve)  # -> Point, Parameter, Distance
expression = Expression(x=disc.Points, y=crv_cp.Point, Expression="(x+y)/2")
larger = LargerThan(FirstNumber=iterator.index, SecondNumber=-1)  # -> LargerThan, OrEqualTo
intcrv_4 = Interpolate(Vertices=expression, Degree=3, Periodic=True, KnotStyle=1)  # -> Curve, Length, Domain
addition_4 = Addition(A=int_2, B="1")
col = Colour(gradient_2)
area_3 = Area(Geometry=intcrv_4.Curve)  # -> Area, Centroid
move = Move(Geometry=intcrv_2.Curve, Motion=Z_2)  # -> Geometry, Transform
division_3 = Division(A=area_2.Area, B=area_3.Area)
sqrt = SquareRoot(Value=division_3)
concat_5 = Concatenate(FragmentA=panel_10, FragmentB=addition_4)
and = GateAnd(A=larger.LargerThan, B=bake)
scale = Scale(Geometry=intcrv_4.Curve, Center=area_3.Centroid, Factor=sqrt)  # -> Geometry, Transform
filter_2 = StreamFilter(Gate=larger.LargerThan, Stream0=intcrv_2.Curve, Stream1=scale.Geometry)
cluster_3 = Cluster_3(pt=cull, crv=filter_2)  # -> bool_2, A, B
move_2 = Move(Geometry=cluster_3.A, Motion=Z_2)  # -> flatten(Geometry), Transform
move_3 = Move(Geometry=cluster_3.B, Motion=Z_2)  # -> flatten(Geometry), Transform
clean = CleanTree(RemoveNulls=True, RemoveInvalid=True, RemoveEmpty=False, Tree=move_2.Geometry)  # -> flatten(Tree)
clean_2 = CleanTree(RemoveNulls=True, RemoveInvalid=True, RemoveEmpty=False, Tree=move_3.Geometry)  # -> flatten(Tree)
c_script_2 = CSharpScript(KEYS="name", VALUES=concat_5)  # -> A; inputs KEYS: list of String, VALUES: list of String; same code as c_script
area_4 = Area(Geometry=filter_2)  # -> Area, Centroid
bbox_2 = BoundingBox(Content=filter_2, Plane=PlaneXY(0, 0, 0))  # -> Box, Box_2
move_4 = Move(Geometry=scale.Geometry, Motion=Z_2)  # -> Geometry, Transform
debox_2 = DeconstructBox(Box=bbox_2.Box)  # -> Plane, X, Y, Z
dedomain_3 = DeconstructDomain(Domain=debox_2.X)  # -> Start, End
dedomain_4 = DeconstructDomain(Domain=debox_2.Y)  # -> Start, End
bake_with_attributes = CSharpScript(
    objList=move.Geometry,
    layerList="island_track_vis",
    ColorList=gradient,
    activate=Button(),
    attributes=c_script,
    name=concat_3)  # -> flatten(text_out), A; inputs objList: list of GeometryBase, layerList: list of String, ColorList: list of Color, activate: Boolean, attributes: list, name: list of String
# ---------- bake_with_attributes: C# usings ----------
using System.IO;
using System.Linq;
using System.Data;
using System.Drawing;
using System.Reflection;
using System.Windows.Forms;
using System.Xml;
using System.Xml.Linq;
using System.Runtime.InteropServices;

using Rhino.DocObjects;
using Rhino.Collections;
using GH_IO;
using GH_IO.Serialization;
# ---------- bake_with_attributes: C# ----------
    Color clr = new Color();
    clr = Color.CadetBlue;
    String lyrName = "test";
    String objName = "object";

    if (activate)
    {
      for(int iCount = 0 ; iCount < objList.Count ; iCount++){
        GeometryBase obj = objList[iCount];
        clr = ColorList[iCount];
        lyrName = layerList[iCount];


        System.Guid exObj = System.Guid.NewGuid();
        objName = lyrName + "_" + iCount;

        if(obj == null)
        {
          Print("No object to bake");
          return;
        }

        //Make new attribute to set name
        Rhino.DocObjects.ObjectAttributes att = new Rhino.DocObjects.ObjectAttributes();
        if(attributes.Count >= iCount && attributes[iCount] != null){
          att = attributes[iCount] as Rhino.DocObjects.ObjectAttributes;
        }


        //Set layer
        if(!string.IsNullOrEmpty(lyrName) && Rhino.DocObjects.Layer.IsValidName(lyrName))
        {
          //Get the current layer index
          Rhino.DocObjects.Tables.LayerTable layerTable = doc.Layers;
          int layerIndex = layerTable.FindByFullPath(lyrName, -1);
          if(layerIndex < 0) //This layer does not exist, we add it
          {
            Rhino.DocObjects.Layer onlayer = new Rhino.DocObjects.Layer(); //Make a new layer
            onlayer.Name = lyrName;
            onlayer.Color = clr;
            layerIndex = layerTable.Add(onlayer); //Add the layer to the layer table
            if (layerIndex > -1) //We manged to add layer!
            {
              att.LayerIndex = layerIndex;
              Print("Added new layer to the document at position " + layerIndex + " named " + lyrName + ". ");
            } else
              Print("Layer did not add. Try cleaning up your layers."); //This never happened to me.
          }
          else
            att.LayerIndex = layerIndex; //We simply add to the existing layer
        }
        
        //set name
        att.Name = name[iCount];

        //Bake to the right type of object
        switch(obj.ObjectType)
        {
          case Rhino.DocObjects.ObjectType.Brep:
            exObj = doc.Objects.AddBrep(obj as Brep, att);
            break;
          case Rhino.DocObjects.ObjectType.Curve:
            exObj = doc.Objects.AddCurve(obj as Curve, att);
            break;
          case Rhino.DocObjects.ObjectType.Point:
            exObj = doc.Objects.AddPoint((obj as Rhino.Geometry.Point).Location, att);
            break;
          case Rhino.DocObjects.ObjectType.Surface:
            exObj = doc.Objects.AddSurface(obj as Surface, att);
            break;
          case Rhino.DocObjects.ObjectType.Mesh:
            exObj = doc.Objects.AddMesh(obj as Mesh, att);
            break;
          case Rhino.DocObjects.ObjectType.Annotation:
            if(obj.GetType().ToString() == "Rhino.Geometry.LinearDimension"){
              exObj = doc.Objects.AddLinearDimension(obj as Rhino.Geometry.LinearDimension, att);
            }else{
              exObj = doc.Objects.AddText(obj as Rhino.Geometry.TextEntity, att);
            }
            break;
          default:
            Print("The script does not know how to handle this type of geometry: " + obj.GetType().FullName);
            break;
        }
      }
    }
    else
    {
      Print("Inactive");
    }
# ---------- end bake_with_attributes ----------
bake_with_attributes_2 = CSharpScript(objList=move_4.Geometry, layerList="island_track_vis", ColorList=col, activate=and, attributes=c_script_2, name=concat_5)  # -> flatten(text_out), A; inputs objList: list of GeometryBase, layerList: list of String, ColorList: list of Color, activate: Boolean, attributes: list, name: list of String; same code as bake_with_attributes
bool = Boolean(flatten(cluster_3.bool_2))
subtraction_3 = Subtraction(A=dedomain_3.End, B=dedomain_3.Start)
subtraction_4 = Subtraction(A=dedomain_4.End, B=dedomain_4.Start)
lng_2 = ListLength(List=clean_2)
lng_3 = ListLength(List=clean)
int_3 = Integer(bool)
division_4 = Division(A=subtraction_3, B=subtraction_4)
dup = DuplicateData(Data=c_script, Number=lng_2, Order=True)  # -> simplify(graft(Data))
pt_3 = Point(simplify(graft(clean_2)))
join_3 = TextJoin(Text=int_3, Join=",")
dup_2 = DuplicateData(Data=c_script, Number=lng_3, Order=True)  # -> simplify(graft(Data))
pt_4 = Point(simplify(graft(clean)))
num_3 = Number(flatten(division_4))
rec = DataRecorder(num_3, DataLimit=-10, RecordData=False)
rec_2 = DataRecorder(join_3, DataLimit=-10, RecordData=False)
bake_with_attributes_3 = CSharpScript(objList=pt_4, layerList="land_pts", ColorList=gradient, activate=and, attributes=dup_2, name=c_script_2)  # -> flatten(text_out), A; inputs objList: list of GeometryBase, layerList: list of String, ColorList: list of Color, activate: Boolean, attributes: list, name: list of String; same code as bake_with_attributes
bake_with_attributes_4 = CSharpScript(objList=pt_3, layerList="water_pts", ColorList=col, activate=and, attributes=dup, name=concat_5)  # -> flatten(text_out), A; inputs objList: list of GeometryBase, layerList: list of String, ColorList: list of Color, activate: Boolean, attributes: list, name: list of String; same code as bake_with_attributes
panel_13 = Panel(rec)
panel_14 = Panel(rec_2)
merge = Merge(Data1="10x10", Data2=panel_13)
merge_2 = Merge(Data1="10x10", Data2=panel_14)
split_7 = TextSplit(Text=merge, Separators=",")
split_8 = TextSplit(Text=merge_2, Separators=",")
panel_15 = Panel(panel_13)
panel_16 = Panel(panel_14)

# ==== cluster Cluster
T = ClusterInput()
layer = ClusterInput()
trim = TextTrim(Text=T, Start=True, End=True)
layer_2 = Text(layer)
clean = CleanTree(RemoveNulls=True, RemoveInvalid=True, RemoveEmpty=False, Tree=trim)
panel = Panel(layer_2)
c_script = CSharpScript(names=clean, layer=panel)  # -> out, geometry, id; inputs names: list of String, layer: String
# ---------- c_script: C# ----------
if(names.Count > 0){
    List<Rhino.Geometry.GeometryBase> geoms = new List<Rhino.Geometry.GeometryBase>();
    List<string> ids = new List<string>();
    foreach(string name in names){
        if(name is string && name.Length > 0){
            Print("finding: "+name);
            Rhino.DocObjects.ObjectEnumeratorSettings settings = new Rhino.DocObjects.ObjectEnumeratorSettings();

            //get frame
            settings.NameFilter = name;
            settings.HiddenObjects = true;

            int lindex = doc.Layers.FindName(layer).Index;
            settings.LayerIndexFilter = lindex;
            var obj_list = doc.Objects.FindByFilter(settings);
            Print("found "+obj_list.Length+" objects");
            for(int i= 0 ; i < obj_list.Length;i++){
               geoms.Add(obj_list[i].Geometry);
               ids.Add(name);
            }
        }
    }
    geometry = geoms;
    id = ids;
}else{
    geometry = null;
    id = null;
 }
# ---------- end c_script ----------
panel_2 = Panel(c_script.out)
clean_2 = CleanTree(RemoveNulls=True, RemoveInvalid=True, RemoveEmpty=False, Tree=c_script.out)
clean_3 = CleanTree(RemoveNulls=True, RemoveInvalid=True, RemoveEmpty=False, Tree=c_script.geometry)
clean_4 = CleanTree(RemoveNulls=True, RemoveInvalid=True, RemoveEmpty=False, Tree=c_script.id)
geometry = Geometry(clean_3)
out = Text(clean_2)
id = Text(clean_4)
id_2 = ClusterOutput(id)
geometry_2 = ClusterOutput(geometry)
out_2 = ClusterOutput(out)

# ==== cluster Cluster_2
V = ClusterInput()
V_2 = ClusterInput()
unit = UnitVector(Vector=V)
unit_2 = UnitVector(Vector=V_2)
rev = Reverse(Vector=unit_2)
dist = Distance(PointA=unit, PointB=unit_2)
dist_2 = Distance(PointA=unit, PointB=rev)
smaller = SmallerThan(FirstNumber=dist, SecondNumber=dist_2)  # -> SmallerThan, OrEqualTo
xy = XYPlane(Origin=Point(0, 0, 0))
p_n_c = PickNChoose(Pattern=smaller.SmallerThan, Stream0=rev, Stream1=unit_2)
angle = Angle(VectorA=unit, VectorB=p_n_c, Plane=xy)  # -> Angle, Reflex
min = Minimum(A=angle.Angle, B=angle.Reflex)
num = Number(min)
num_2 = ClusterOutput(num)

# ==== cluster Cluster_3
crv = ClusterInput()
pt = ClusterInput()
crv_2 = Curve(crv)
pt_2 = Point(pt)
incurve = PointInCurve(Point=pt_2, Curve=crv_2)  # -> Relationship, Point
bool = Boolean(incurve.Relationship)
dispatch = Dispatch(List=pt_2, DispatchPattern=bool)  # -> ListA, ListB
bool_2 = ClusterOutput(bool)
A = ClusterOutput(dispatch.ListA)
B = ClusterOutput(dispatch.ListB)
