# Grasshopper definition island_sim7_tspDB.gh (Grasshopper 1.0.7)

number_slider = Slider(0, range=0..2)
crv = Curve(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)
crv_2 = Curve([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])
panel = Panel("""0
-8
14""")
panel_2 = Panel("""0
5
6""")
pt = ConstructPoint(XCoordinate=panel, YCoordinate=panel_2, ZCoordinate=0)
item = ListItem(List=crv_2, Index=number_slider, Wrap=True)
item_2 = ListItem(List=pt, Index=number_slider, Wrap=True)
dom = ConstructDomain(DomainStart="-1", DomainEnd="1")
dom_2 = ConstructDomain(DomainStart="-.05", DomainEnd=".05")
dom_3 = ConstructDomain(DomainStart=0.1, DomainEnd=0.3)
random = Random(Range=dom_3, Number="1", Seed=item_2)
range = Range(Domain=dom, Steps="27000")
random_2 = Random(Range=dom_2, Number="27000", Seed=item_2)
cir = Circle(Plane=item_2, Radius=1)
graph = GraphMapper(
    range,
    x0=0,
    x1=1,
    y0=-1,
    y1=1,
    container_name="Sine",
    Equation_px=[0, 0.05757575855],
    Equation_py=[0.2096773982, 0.7016128898])
graph_2 = GraphMapper(
    range,
    x0=0,
    x1=1,
    y0=-1,
    y1=1,
    container_name="Sine",
    Equation_px=[0, 0.1030303016],
    Equation_py=[0.1290322542, 0.9233871102])
graph_3 = GraphMapper(
    range,
    x0=0,
    x1=1,
    y0=-1,
    y1=1,
    container_name="Sine",
    Equation_px=[0.02121212147, 0.3454545438],
    Equation_py=[0.2016128898, 0.8064516187])
X = UnitX(Factor=1)
filter = StreamFilter(Gate=number_slider, Stream0=graph, Stream1=graph_2, Stream2=graph_3)
Y = UnitY(Factor=1)
amp = Amplitude(Vector=Y, Amplitude=random_2)
amp_2 = Amplitude(Vector=X, Amplitude=filter)
panel_3 = Panel(random)
addition = Addition(A=amp_2, B=amp)
Z = UnitZ(Factor=1)
divide = DivideCurve(Curve=cir, Count="10", Kinks=False)  # -> Points, Tangents, Parameters
vrot = Rotate(Vector=addition, Axis=Z, Angle=panel_3)
vdis = VectorDisplay(Anchor=item_2, Vector=vrot)
split = SplitList(List=vrot, Index="27000")  # -> ListA, ListB
panel_4 = Panel("10")
lng = ListLength(List=split.ListA)
int = Integer(number_slider)
concat = Concatenate(FragmentA="island", FragmentB=int)
concat_2 = Concatenate(FragmentA=concat, FragmentB="_")  # -> flatten(Result)
panel_5 = Panel(concat_2)
gradient = Gradient(LowerLimit="0", UpperLimit="27000", Parameter="0", stops=[0: RGB(135, 217, 237), 1: RGB(28, 0, 141)])
area = Area(Geometry=cir)  # -> Area, Centroid
intcrv = Interpolate(Vertices=divide.Points, Degree=3, Periodic=True, KnotStyle=1)  # -> Curve, Length, Domain
bake = BooleanToggle(True)
concat_3 = Concatenate(FragmentA=panel_5, FragmentB="0")
c_script = CSharpScript(KEYS="name", VALUES=concat_3)  # -> A; inputs KEYS: list of String, VALUES: list of String
# ---------- c_script: C# ----------
    Rhino.DocObjects.ObjectAttributes att = new Rhino.DocObjects.ObjectAttributes();
    for(int i = 0 ; i < KEYS.Count ; i++){
      att.SetUserString(KEYS[i], VALUES[i]);
    }
    A = att;
# ---------- end c_script ----------

run = BooleanToggle(False)

iterator = CSharpScript(count=lng, run=run)  # -> out, index; inputs count: Int32, run: Boolean
# ---------- iterator: C# ----------
    if(counter < count && run) {
      counter++;
      Print("Creating Panel: " + counter.ToString() + " of " + count.ToString());
      Component.ExpireSolution(true);
      index = counter - 1;
    }else{
      counter = 0;
      index = -1;
      Print("inactive");
    }
# ---------- iterator: C# additional code ----------
  int counter = 0;
# ---------- end iterator ----------

run_status = Panel(iterator.out)

panel_6 = Panel(iterator.index)
addition_2 = Addition(A=1, B=panel_6)
int_2 = Integer(addition_2)
concat_4 = Concatenate(FragmentA=panel_5, FragmentB=panel_6)
item_3 = ListItem(List=split.ListA, Index=int_2, Wrap=True)
gradient_2 = Gradient(LowerLimit="0", UpperLimit="27000", Parameter=int_2, stops=[0: RGB(135, 217, 237), 1: RGB(28, 0, 141)])
multiplication = Multiplication(A=int_2, B=".25")
Z_2 = UnitZ(Factor=multiplication)
cluster = Cluster(T=concat_4, layer="island_track_vis")  # -> out_2, geometry_2, id_2
project = Project(Geometry=cluster.geometry_2, Plane=PlaneXY(0, 0, 0))  # -> Geometry, Transform
crv_3 = Curve(project.Geometry)
divide_2 = DivideCurve(Curve=crv_3, Count="10", Kinks=False)  # -> Points, Tangents, Parameters
vec = Vector(item_3)
cluster_2 = Cluster_2(V=vec, V_2=divide_2.Points)
vlen = VectorLength(Vector=vec)
multiplication_2 = Multiplication(A=vlen, B=cluster_2)
amp_3 = Amplitude(Vector=vec, Amplitude=multiplication_2)
addition_3 = Addition(A=amp_3, B=divide_2.Points)
hull = ConvexHull(Points=addition_3, Plane=PlaneXY(0, 0, 0))  # -> Hull, HullZ, Indices
intcrv_2 = Interpolate(Vertices=addition_3, Degree=3, Periodic=True, KnotStyle=1)  # -> Curve, Length, Domain
disc = Discontinuity(Curve=hull.Hull, Level=1)  # -> Points, Parameters
crv_cp = CurveClosestPoint(Point=disc.Points, Curve=intcrv_2.Curve)  # -> Point, Parameter, Distance
expression = Expression(x=disc.Points, y=crv_cp.Point, Expression="(x+y)/2")
intcrv_3 = Interpolate(Vertices=expression, Degree=3, Periodic=True, KnotStyle=1)  # -> Curve, Length, Domain
area_2 = Area(Geometry=intcrv_3.Curve)  # -> Area, Centroid
division = Division(A=area.Area, B=area_2.Area)
move = Move(Geometry=intcrv.Curve, Motion=Z_2)  # -> Geometry, Transform
sqrt = SquareRoot(Value=division)
addition_4 = Addition(A=int_2, B="1")
scale = Scale(Geometry=intcrv_3.Curve, Center=area_2.Centroid, Factor=sqrt)  # -> Geometry, Transform
larger = LargerThan(FirstNumber=panel_6, SecondNumber=-1)  # -> LargerThan, OrEqualTo
col = Colour(gradient_2)
concat_5 = Concatenate(FragmentA=panel_5, FragmentB=int_2)
and = GateAnd(A=larger.LargerThan, B=bake)
c_script_2 = CSharpScript(KEYS="name", VALUES=concat_5)  # -> A; inputs KEYS: list of String, VALUES: list of String; same code as c_script
move_2 = Move(Geometry=scale.Geometry, Motion=Z_2)  # -> Geometry, Transform
bake_with_attributes = CSharpScript(
    objList=move.Geometry,
    layerList="island_track_vis",
    ColorList=gradient,
    activate=Button(),
    attributes=c_script,
    name=concat_3)  # -> flatten(text_out), A; inputs objList: list of GeometryBase, layerList: list of String, ColorList: list of Color, activate: Boolean, attributes: list, name: list of String
# ---------- bake_with_attributes: C# usings ----------
using System.IO;
using System.Linq;
using System.Data;
using System.Drawing;
using System.Reflection;
using System.Windows.Forms;
using System.Xml;
using System.Xml.Linq;
using System.Runtime.InteropServices;

using Rhino.DocObjects;
using Rhino.Collections;
using GH_IO;
using GH_IO.Serialization;
# ---------- bake_with_attributes: C# ----------
    Color clr = new Color();
    clr = Color.CadetBlue;
    String lyrName = "test";
    String objName = "object";

    if (activate)
    {
      for(int iCount = 0 ; iCount < objList.Count ; iCount++){
        GeometryBase obj = objList[iCount];
        clr = ColorList[iCount];
        lyrName = layerList[iCount];


        System.Guid exObj = System.Guid.NewGuid();
        objName = lyrName + "_" + iCount;

        if(obj == null)
        {
          Print("No object to bake");
          return;
        }

        //Make new attribute to set name
        Rhino.DocObjects.ObjectAttributes att = new Rhino.DocObjects.ObjectAttributes();
        if(attributes.Count >= iCount && attributes[iCount] != null){
          att = attributes[iCount] as Rhino.DocObjects.ObjectAttributes;
        }


        //Set layer
        if(!string.IsNullOrEmpty(lyrName) && Rhino.DocObjects.Layer.IsValidName(lyrName))
        {
          //Get the current layer index
          Rhino.DocObjects.Tables.LayerTable layerTable = doc.Layers;
          int layerIndex = layerTable.FindByFullPath(lyrName, -1);
          if(layerIndex < 0) //This layer does not exist, we add it
          {
            Rhino.DocObjects.Layer onlayer = new Rhino.DocObjects.Layer(); //Make a new layer
            onlayer.Name = lyrName;
            onlayer.Color = clr;
            layerIndex = layerTable.Add(onlayer); //Add the layer to the layer table
            if (layerIndex > -1) //We manged to add layer!
            {
              att.LayerIndex = layerIndex;
              Print("Added new layer to the document at position " + layerIndex + " named " + lyrName + ". ");
            } else
              Print("Layer did not add. Try cleaning up your layers."); //This never happened to me.
          }
          else
            att.LayerIndex = layerIndex; //We simply add to the existing layer
        }
        
        //set name
        att.Name = name[iCount];

        //Bake to the right type of object
        switch(obj.ObjectType)
        {
          case Rhino.DocObjects.ObjectType.Brep:
            exObj = doc.Objects.AddBrep(obj as Brep, att);
            break;
          case Rhino.DocObjects.ObjectType.Curve:
            exObj = doc.Objects.AddCurve(obj as Curve, att);
            break;
          case Rhino.DocObjects.ObjectType.Point:
            exObj = doc.Objects.AddPoint((obj as Rhino.Geometry.Point).Location, att);
            break;
          case Rhino.DocObjects.ObjectType.Surface:
            exObj = doc.Objects.AddSurface(obj as Surface, att);
            break;
          case Rhino.DocObjects.ObjectType.Mesh:
            exObj = doc.Objects.AddMesh(obj as Mesh, att);
            break;
          case Rhino.DocObjects.ObjectType.Annotation:
            if(obj.GetType().ToString() == "Rhino.Geometry.LinearDimension"){
              exObj = doc.Objects.AddLinearDimension(obj as Rhino.Geometry.LinearDimension, att);
            }else{
              exObj = doc.Objects.AddText(obj as Rhino.Geometry.TextEntity, att);
            }
            break;
          default:
            Print("The script does not know how to handle this type of geometry: " + obj.GetType().FullName);
            break;
        }
      }
    }
    else
    {
      Print("Inactive");
    }
# ---------- end bake_with_attributes ----------
bake_with_attributes_2 = CSharpScript(objList=move_2.Geometry, layerList="island_track_vis", ColorList=col, activate=and, attributes=c_script_2, name=concat_5)  # -> flatten(text_out), A; inputs objList: list of GeometryBase, layerList: list of String, ColorList: list of Color, activate: Boolean, attributes: list, name: list of String; same code as bake_with_attributes

# ==== cluster Cluster
layer = ClusterInput()
T = ClusterInput()
layer_2 = Text(layer)
trim = TextTrim(Text=T, Start=True, End=True)
clean = CleanTree(RemoveNulls=True, RemoveInvalid=True, RemoveEmpty=False, Tree=trim)
panel = Panel(layer_2)
c_script = CSharpScript(names=clean, layer=panel)  # -> out, geometry, id; inputs names: list of String, layer: String
# ---------- c_script: C# ----------
if(names.Count > 0){
    List<Rhino.Geometry.GeometryBase> geoms = new List<Rhino.Geometry.GeometryBase>();
    List<string> ids = new List<string>();
    foreach(string name in names){
        if(name is string && name.Length > 0){
            Print("finding: "+name);
            Rhino.DocObjects.ObjectEnumeratorSettings settings = new Rhino.DocObjects.ObjectEnumeratorSettings();

            //get frame
            settings.NameFilter = name;
            settings.HiddenObjects = true;

            int lindex = doc.Layers.FindName(layer).Index;
            settings.LayerIndexFilter = lindex;
            var obj_list = doc.Objects.FindByFilter(settings);
            Print("found "+obj_list.Length+" objects");
            for(int i= 0 ; i < obj_list.Length;i++){
               geoms.Add(obj_list[i].Geometry);
               ids.Add(name);
            }
        }
    }
    geometry = geoms;
    id = ids;
}else{
    geometry = null;
    id = null;
 }
# ---------- end c_script ----------
panel_2 = Panel(c_script.out)
clean_2 = CleanTree(RemoveNulls=True, RemoveInvalid=True, RemoveEmpty=False, Tree=c_script.out)
clean_3 = CleanTree(RemoveNulls=True, RemoveInvalid=True, RemoveEmpty=False, Tree=c_script.geometry)
clean_4 = CleanTree(RemoveNulls=True, RemoveInvalid=True, RemoveEmpty=False, Tree=c_script.id)
geometry = Geometry(clean_3)
out = Text(clean_2)
id = Text(clean_4)
id_2 = ClusterOutput(id)
geometry_2 = ClusterOutput(geometry)
out_2 = ClusterOutput(out)

# ==== cluster Cluster_2
V = ClusterInput()
V_2 = ClusterInput()
unit = UnitVector(Vector=V)
unit_2 = UnitVector(Vector=V_2)
rev = Reverse(Vector=unit_2)
dist = Distance(PointA=unit, PointB=unit_2)
dist_2 = Distance(PointA=unit, PointB=rev)
smaller = SmallerThan(FirstNumber=dist, SecondNumber=dist_2)  # -> SmallerThan, OrEqualTo
xy = XYPlane(Origin=Point(0, 0, 0))
p_n_c = PickNChoose(Pattern=smaller.SmallerThan, Stream0=rev, Stream1=unit_2)
angle = Angle(VectorA=unit, VectorB=p_n_c, Plane=xy)  # -> Angle, Reflex
min = Minimum(A=angle.Angle, B=angle.Reflex)
num = Number(min)
num_2 = ClusterOutput(num)
