# Grasshopper definition load shorelines.gh (Grasshopper 1.0.7)
# plug-ins: LunchBoxML

path = FilePath("D:\Github\CoastSat\data\Madhirivaadhoo\Madhirivaadhoo_output.csv")  # disabled
panel = Panel(path)  # disabled
panel_2 = Panel("D:\Github\CoastSat\data\dharavandhoo\dharavandhoo_output.csv")  # disabled
file = ReadFile(File=panel_2, PerLineParse=True)  # disabled
split = SplitList(List=file, Index=1)  # -> ListA, ListB; disabled
item = ListItem(List=split.ListB, Index=0, Wrap=True)  # -> Item1, Item; disabled
split_2 = TextSplit(Text=split.ListB, Separators=",")  # disabled
split_3 = TextSplit(Text=split.ListB, Separators=",")  # disabled
split_4 = TextSplit(Text=item.Item1, Separators=",")  # disabled
split_5 = TextSplit(Text=item.Item, Separators=",")  # disabled
split_6 = SplitList(List=split_2, Index=1)  # -> ListA, ListB; disabled
panel_3 = Panel("[")  # disabled
item_2 = ListItem(List=split_3, Index=0, Wrap=True)  # -> flatten(Item); disabled
split_7 = SplitList(List=split_4, Index=1)  # -> ListA, ListB; disabled
split_8 = SplitList(List=split_5, Index=1)  # -> ListA, ListB; disabled
rep = ReplaceText(Text=split_6.ListB, Find=panel_3, RecursiveReplace=False)  # disabled
panel_4 = Panel("]")  # disabled
panel_5 = Panel(split_8.ListA)  # disabled
panel_6 = Panel(item_2)  # disabled
rep_2 = ReplaceText(Text=rep, Find=panel_4, RecursiveReplace=False)  # disabled
trim = TextTrim(Text=rep_2, Start=True, End=True)  # disabled
panel_7 = Panel(" ")  # disabled
split_9 = TextSplit(Text=trim, Separators=panel_7)  # disabled
len = TextLength(Text=split_9)  # disabled
bool = Boolean(len)  # disabled
cull = CullPattern(List=split_9, CullPattern=bool)  # disabled
num2pt = NumbersToPoints(Numbers=cull, Mask=2)  # -> simplify(Points); disabled
path_mapper = PathMapper(num2pt, source="{A;B}", target="{A}")  # disabled
panel_8 = Panel("100")  # disabled
pt = Point(path_mapper)  # disabled
crv = Curve(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)  # disabled
pline = PolyLine(Vertices=path_mapper, Closed=True)  # disabled
pline_2 = PolyLine(Vertices=path_mapper, Closed=False)  # disabled
divide = DivideCurve(Curve=crv, Count=100, Kinks=False)  # -> graft(Points), Tangents, Parameters; disabled
explode = Explode(Curve=pline, Recursive=True)  # -> Segments, Vertices; disabled
crv_cp = CurveClosestPoint(Point=divide.Points, Curve=flatten(pline_2))  # -> Point, Parameter, Distance; disabled
panel_9 = Panel("25")  # disabled
len_2 = Length(Curve=explode.Segments)  # disabled
smaller = SmallerThan(FirstNumber=crv_cp.Distance, SecondNumber=panel_9)  # -> SmallerThan, OrEqualTo; disabled
sort = SortList(Keys=len_2)  # -> reverse(Keys), ValuesA; disabled
viewer = ParamViewer(pline)  # disabled
cull_2 = CullPattern(List=crv_cp.Point, CullPattern=smaller.SmallerThan)  # disabled
item_3 = ListItem(List=sort.Keys, Index=0, Wrap=True)  # disabled
panel_10 = Panel("10")  # disabled
lng = ListLength(List=viewer)  # disabled
avr = Average(Input=cull_2)  # -> flatten(ArithmeticMean); disabled
intcrv = Interpolate(Vertices=avr, Degree=3, Periodic=True, KnotStyle=1)  # -> Curve, Length, Domain; disabled
reb = RebuildCurve(Curve=intcrv.Curve, Count=40, Tangents=False)  # disabled
larger = LargerThan(FirstNumber=item_3, SecondNumber=panel_8)  # -> simplify(LargerThan), OrEqualTo; disabled
dispatch = Dispatch(List=pline, DispatchPattern=larger.LargerThan)  # -> ListA, simplify(ListB); disabled
lng_2 = ListLength(List=flatten(dispatch.ListB))  # disabled
viewer_2 = ParamViewer(dispatch.ListB)  # disabled
series = Series(Start=0, Step=1, Count=lng_2)  # disabled
divide_2 = DivideCurve(Curve=reb, Count=200, Kinks=False)  # -> flatten(Points), Tangents, Parameters; disabled
series_2 = Series(Start=0, Step=panel_10, Count=lng)  # disabled
intcrv_2 = Interpolate(Vertices=avr, Degree=3, Periodic=True, KnotStyle=1)  # -> Curve, Length, Domain; disabled
addition = Addition()  # disabled
Z = UnitZ(Factor=series_2)  # -> graft(UnitVector); disabled
gradient = Gradient(LowerLimit=0, UpperLimit=lng_2, Parameter=series, stops=[0.0941: RGB(192, 192, 255), 0.884: RGB(220, 0, 40)])  # disabled
crv_cp_2 = CurveClosestPoint(Point=divide_2.Points, Curve=dispatch.ListB)  # -> Point, Parameter, Distance; disabled
averaged_boundary = Curve(intcrv_2.Curve)  # disabled
move = Move(Geometry=pline_2, Motion=Z)  # -> Geometry, Transform; disabled
move_2 = Move(Geometry=pline, Motion=Z)  # -> Geometry, Transform; disabled
move_3 = Move(Geometry=crv_cp_2.Point, Motion=simplify(Z))  # -> Geometry, Transform; disabled
dispatch_2 = Dispatch(List=move_2.Transform, DispatchPattern=larger.LargerThan)  # -> ListA, ListB; disabled
dispatch_3 = Dispatch(List=move.Geometry, DispatchPattern=larger.LargerThan)  # -> ListA, ListB; disabled
dispatch_4 = Dispatch(List=move_2.Geometry, DispatchPattern=larger.LargerThan)  # -> ListA, ListB; disabled
flip = FlipMatrix(Data=move_3.Geometry)  # disabled
crv_2 = Curve(dispatch_3.ListA)  # disabled
crv_3 = Curve(dispatch_4.ListB)  # disabled
fit = FitCurve(Curve=crv_3)  # disabled
crv_4 = Curve(crv_3)  # disabled
preview = CustomPreview(Geometry=flatten(crv_4), Material=gradient)  # disabled
clean = CleanTree(RemoveNulls=True, RemoveInvalid=True, RemoveEmpty=True, Tree=crv_3)  # disabled
viewer_3 = ParamViewer(clean)  # disabled
branch = TreeBranch(Tree=dispatch_2.ListB, Path=viewer_3, MaintainPaths=True)  # disabled
area = Area(Geometry=clean)  # -> flatten(Area), flatten(Centroid); disabled
area_2 = Area(Geometry=averaged_boundary)  # -> flatten(Area), flatten(Centroid); disabled
partition = PartitionList(List=flatten(crv_3), Size=180)  # disabled
dom = ConstructDomain(DomainStart=0, DomainEnd=100)  # disabled
dom_2 = ConstructDomain(DomainStart=100, DomainEnd=150)  # disabled
pdecon = Deconstruct(Point=area.Centroid)  # -> XComponent, YComponent, ZComponent; disabled
bnd = Bounds(Numbers=area.Area)  # disabled
bnd_2 = Bounds(Numbers=pdecon.ZComponent)  # disabled
clean_2 = CleanTree(RemoveNulls=True, RemoveInvalid=True, RemoveEmpty=True, Tree=partition)  # disabled
dedomain = DeconstructDomain(Domain=bnd)  # -> Start, End; disabled
remap = RemapNumbers(Value=area.Area, Source=bnd, Target=dom_2)  # -> Mapped, Clipped; disabled
remap_2 = RemapNumbers(Value=pdecon.ZComponent, Source=bnd_2, Target=dom)  # -> Mapped, Clipped; disabled
area_3 = Area(Geometry=clean_2)  # -> flatten(Area), Centroid; disabled
pdecon_2 = Deconstruct(Point=flatten(area_3.Centroid))  # -> XComponent, YComponent, ZComponent; disabled
intcrv_3 = Interpolate(Vertices=flip, Degree=3, Periodic=False, KnotStyle=1)  # -> Curve, Length, Domain; disabled
num = Number(remap.Mapped)  # disabled
num_2 = Number(remap_2.Mapped)  # disabled
panel_11 = Panel(dedomain.End)  # disabled
divide_3 = DivideCurve(Curve=intcrv_3.Curve, Count=expr("x-1", lng), Kinks=False)  # -> Points, Tangents, Parameters; disabled
panel_12 = Panel(dedomain.Start)  # disabled
pt_2 = ConstructPoint(XCoordinate=pdecon_2.XComponent, YCoordinate=pdecon_2.YComponent, ZCoordinate=0)  # disabled
hull = ConvexHull(Points=flatten(area_3.Centroid), Plane=PlaneXY(0, 0, 0))  # -> Hull, HullZ, Indices; disabled
avr_2 = Average(Input=area_3.Centroid)  # disabled
swatch = ColourSwatch(SwatchColor=RGB(0, 81, 255))  # disabled
txt = Text(item_2)  # disabled
pline_3 = PolyLine(Vertices=flatten(pt_2), Closed=False)  # disabled
item_4 = ListItem(List=remap_2.Mapped, Index=0, Wrap=True)  # -> Item1, Item; disabled
flip_2 = FlipMatrix(Data=divide_3.Points)  # disabled
pline_4 = PolyLine(Vertices=flip_2, Closed=True)  # -> flatten(Polyline); disabled
lng_3 = ListLength(List=flatten(pline_4))  # disabled
series_3 = Series(Start=0, Step=1, Count=lng_3)  # disabled
gradient_2 = Gradient(LowerLimit=0, UpperLimit=lng_3, Parameter=series_3, stops=[0.0941: RGB(192, 192, 255), 0.884: RGB(220, 0, 40)])  # disabled
boundary = BoundarySurfaces(Edges=hull.Hull)  # disabled
panel_13 = Panel("D:\Github\littoral\toy_island\dharavandhoo.csv")  # disabled
merge = Merge(Data1=item_4.Item, Data2=item_4.Item1)  # disabled
item_5 = ListItem(List=txt, Index=0, Wrap=True)  # disabled
lng_4 = ListLength(List=txt)  # disabled
X = UnitX(Factor=-10000)  # disabled
pdecon_3 = Deconstruct(Point=flip_2)  # -> XComponent, YComponent, ZComponent; disabled
linereg = LinearRegression(TestData=num_2, TrainingInputs=remap_2.Mapped, TrainingOutput=num, RandomSeed=5)  # disabled
slr_sedidment_supply = CustomPreview(Geometry=pline_3, Material=swatch)  # disabled
panel_14 = Panel(item_5)  # disabled
remap_3 = RemapNumbers(Value=linereg, Source=dom, Target=bnd)  # -> Mapped, Clipped; disabled
pdecon_4 = Deconstruct(Point=flatten(avr_2))  # -> XComponent, YComponent, ZComponent; disabled
pt_3 = ConstructPoint(XCoordinate=remap_2.Mapped, YCoordinate=num, ZCoordinate=0)  # disabled
pt_4 = ConstructPoint(XCoordinate=pdecon_3.XComponent, YCoordinate=pdecon_3.YComponent, ZCoordinate=0)  # disabled
swatch_2 = ColourSwatch(SwatchColor=RGB(255, 0, 0))  # disabled
move_4 = Move(Geometry=pline_4, Motion=X)  # -> Geometry, Transform; disabled
preview_2 = CustomPreview(Geometry=flatten(move_4.Geometry), Material=gradient_2)  # disabled
division = Division(A=area.Area, B=area_2.Area)  # disabled
division_2 = Division(A=remap_3.Mapped, B=area_2.Area)  # disabled
pt_5 = ConstructPoint(XCoordinate=pdecon_4.XComponent, YCoordinate=pdecon_4.YComponent, ZCoordinate=10)  # disabled
toggle = BooleanToggle(False)  # disabled
c_script = CSharpScript(start_time=panel_14, len=lng_4)  # -> graft(time_series); inputs len: Int32; disabled
# ---------- c_script: C# ----------
    List<DateTime> dates = new List<DateTime>();

    for(int i = 0 ; i < len ; i++){
      dates.Add(start_time.AddDays(i));
    }
    time_series = dates;
# ---------- end c_script ----------
crv_cp_3 = CurveClosestPoint(Point=pt_4, Curve=averaged_boundary)  # -> simplify(Point), Parameter, simplify(Distance); disabled
scale = Scale(Geometry=averaged_boundary, Center=area_2.Centroid, Factor=division)  # -> Geometry, Transform; disabled
scale_2 = Scale(Geometry=averaged_boundary, Center=area_2.Centroid, Factor=division_2)  # -> Geometry, Transform; disabled
dots = DotDisplay(Point=pt_5, Colour=swatch_2, Size=1)  # disabled
transform = Transform(Geometry=scale.Geometry, Transform=flatten(branch))  # -> flatten(Geometry); disabled
transform_2 = Transform(Geometry=scale_2.Geometry, Transform=flatten(branch))  # -> flatten(Geometry); disabled
pt_6 = ConstructPoint(XCoordinate=num_2, YCoordinate=linereg, ZCoordinate=0)  # disabled
txt_2 = Text(flatten(c_script))  # disabled
swatch_3 = ColourSwatch(SwatchColor=RGB(38, 143, 255))  # disabled
slr_sedidment_supply_2 = CustomPreview(Geometry=boundary, Material=swatch_3)  # disabled
loft = Loft(Curves=transform, Options={Adjust=False, Closed=False, LoftEnds=0, LoftSimp=0, LoftType=0, Rebuild=10, Refit=0.01})  # disabled
loft_2 = Loft(Curves=transform_2, Options={Adjust=False, Closed=False, LoftEnds=0, LoftSimp=0, LoftType=0, Rebuild=10, Refit=0.01})  # disabled
split_10 = TextSplit(Text=txt_2, Separators=" ")  # disabled
swatch_4 = ColourSwatch(SwatchColor=RGB(255, 20, 20))  # disabled
slr_sedidment_supply_3 = CustomPreview(Geometry=avr_2, Material=swatch_4)  # disabled
swatch_5 = ColourSwatch(SwatchColor=RGB(20, 255, 255))  # disabled
pline_5 = PolyLine(Vertices=pt_3, Closed=False)  # disabled
pline_6 = PolyLine(Vertices=pt_6, Closed=False)  # disabled
panel_15 = Panel(" 00:00:00")  # disabled
item_6 = ListItem(List=split_10, Index=0, Wrap=True)  # -> flatten(Item); disabled
slr_sedidment_supply_4 = CustomPreview(Geometry=pline_6, Material=swatch_4)  # disabled
slr_sedidment_supply_5 = CustomPreview(Geometry=pline_5, Material=swatch_5)  # disabled
concat = Concatenate(FragmentA=item_6, FragmentB=panel_15)  # disabled
panel_16 = Panel(crv_cp_3.Distance)  # disabled
lng_5 = ListLength(List=panel_16)  # -> flatten(Length); disabled
item_7 = ListItem(List=lng_5, Index=0, Wrap=True)  # disabled
panel_17 = Panel("time")  # disabled
series_4 = Series(Start=0, Step=1, Count=item_7)  # disabled
int = Integer(series_4)  # disabled
concat_2 = Concatenate(FragmentA="T", FragmentB=int)  # disabled
txt_3 = Text(concat)  # disabled
merge_2 = Merge(Data1=panel_17, Data2=flatten(concat_2))  # disabled
concat_3 = Concatenate(FragmentA=txt_3, FragmentB=",")  # disabled
join = TextJoin(Text=panel_16, Join=",")  # -> flatten(Result); disabled
join_2 = TextJoin(Text=merge_2, Join=",")  # disabled
concat_4 = Concatenate(FragmentA=concat_3, FragmentB=join)  # disabled
merge_3 = Merge(Data1=flatten(join_2), Data2=flatten(concat_4))  # disabled
c_script_2 = CSharpScript(data=merge_3, path=panel_13, save=toggle)  # -> out; inputs data: list of String, path: String, save: Boolean; disabled
# ---------- c_script_2: C# ----------
    if(save){
      using (var file = System.IO.File.CreateText(path))
      {
        foreach(var arr in data)
        {
          file.WriteLine(string.Join(",", arr));
        }
      }
    }
# ---------- end c_script_2 ----------
panel_18 = Panel(c_script_2)  # disabled
