# Grasshopper definition load shorelines_2_PancakeEmergency.gh (Grasshopper 1.0.7)

panel = Panel("D:\Github\CoastSat\data\Madhirivaadhoo\Madhirivaadhoo_output.csv")
panel_2 = Panel("D:\Github\CoastSat\data\dharavandhoo\dharavandhoo_output.csv")
name = Panel("veyofushi_finolhu")
file_path = FilePath(folder="D:\Github\CoastSat\data\veyofushi_finolhu\", name=name, type="_output")
read_boundaries = ReadBoundaries(filepath=file_path)  # -> dates_2, boundaries_as_points_2
pt = Point(read_boundaries.boundaries_as_points_2)
cull_defective_boundaries = CullDefectiveBoundaries(pt=pt, num="100")  # -> crv_2, offset_vertically_2, int_2
remove_rotation = RemoveRotation(crv=cull_defective_boundaries.crv_2, max_distance="25")
cull_dates = CullDates(txt=read_boundaries.dates_2, pt=remove_rotation)
panel_3 = Panel(cull_dates)
infill_with_tweens = InfillWithTweens(pt=remove_rotation)
calc_offsets = CalcOffsets(crv=infill_with_tweens)  # -> starting_boundary_2, offsets_2
clean = CleanTree(RemoveNulls=True, RemoveInvalid=True, RemoveEmpty=False, Tree=flatten(infill_with_tweens))
crv = Curve(infill_with_tweens)
item = ListItem(List=infill_with_tweens, Index=0, Wrap=True)
panel_4 = Panel("""x
y""")
file_path_2 = FilePath(folder="D:\Github\littoral\toy_island\", name=name, type="_offsets")
save_offsets = Save_offsets(txt=cull_dates, offsets=calc_offsets.offsets_2, path=file_path_2, save=Toggle(False))
panel_5 = Panel(save_offsets)

# ==== cluster ReadBoundaries
filepath = ClusterInput()
file = ReadFile(Filepath=filepath, PerLineParse=True)
split = SplitList(List=file, Index=1)  # -> ListA, ListB
split_2 = TextSplit(Text=split.ListB, Separators=",")
split_3 = SplitList(List=split_2, Index=1)  # -> ListA, ListB
rep = ReplaceText(Text=split_3.ListB, Find="[", RecursiveReplace=False)
rep_2 = ReplaceText(Text=rep, Find="]", RecursiveReplace=False)
item = ListItem(List=split.ListB, Index=0, Wrap=True)  # -> Item1, Item
split_4 = TextSplit(Text=split.ListB, Separators=",")
trim = TextTrim(Text=rep_2, Start=True, End=True)
split_5 = TextSplit(Text=item.Item1, Separators=",")
split_6 = TextSplit(Text=item.Item, Separators=",")
item_2 = ListItem(List=split_4, Index=0, Wrap=True)  # -> flatten(Item)
split_7 = TextSplit(Text=trim, Separators=" ")
split_8 = SplitList(List=split_5, Index=1)  # -> ListA, ListB
split_9 = SplitList(List=split_6, Index=1)  # -> ListA, ListB
panel = Panel(split_9.ListA)
len = TextLength(Text=split_7)
bool = Boolean(len)
cull = CullPattern(List=split_7, CullPattern=bool)
num2pt = NumbersToPoints(Numbers=cull, Mask=2)  # -> simplify(Points)
path_mapper = PathMapper(num2pt, source="{A;B}", target="{A}")
boundaries_as_points = Point(path_mapper)
dates = Text(item_2)
boundaries_as_points_2 = ClusterOutput(boundaries_as_points)
dates_2 = ClusterOutput(dates)

# ==== cluster Save_offsets
txt = ClusterInput()
offsets = ClusterInput()
path = ClusterInput()
save = ClusterInput()
txt_2 = Text(txt)
offsets_2 = Number(offsets)
item = ListItem(List=txt_2, Index=0, Wrap=True)
lng = ListLength(List=txt_2)
panel = Panel(item)
c_script = CSharpScript(start_time=panel, len=lng)  # -> graft(time_series); inputs len: Int32
# ---------- c_script: C# ----------
    List<DateTime> dates = new List<DateTime>();

    for(int i = 0 ; i < len ; i++){
      dates.Add(start_time.AddDays(i));
    }
    time_series = dates;
# ---------- end c_script ----------
txt_3 = Text(flatten(c_script))
split = TextSplit(Text=txt_3, Separators=" ")
item_2 = ListItem(List=split, Index=0, Wrap=True)  # -> flatten(Item)
panel_2 = Panel(offsets_2)
concat = Concatenate(FragmentA=item_2, FragmentB=" 00:00:00")
lng_2 = ListLength(List=panel_2)  # -> flatten(Length)
item_3 = ListItem(List=lng_2, Index=0, Wrap=True)
series = Series(Start=0, Step=1, Count=item_3)
int = Integer(series)
concat_2 = Concatenate(FragmentA="T", FragmentB=int)
txt_4 = Text(concat)
merge = Merge(Data1="time", Data2=flatten(concat_2))
concat_3 = Concatenate(FragmentA=txt_4, FragmentB=",")
join = TextJoin(Text=panel_2, Join=",")  # -> flatten(Result)
join_2 = TextJoin(Text=merge, Join=",")
concat_4 = Concatenate(FragmentA=concat_3, FragmentB=join)
merge_2 = Merge(Data1=flatten(join_2), Data2=flatten(concat_4))
c_script_2 = CSharpScript(data=merge_2, path=path, save=save)  # -> out; inputs data: list of String, path: String, save: Boolean
# ---------- c_script_2: C# ----------
    if(save){
      using (var file = System.IO.File.CreateText(path))
      {
        foreach(var arr in data)
        {
          file.WriteLine(string.Join(",", arr));
        }
      }
    }
# ---------- end c_script_2 ----------
out = ClusterOutput(c_script_2)

# ==== cluster RemoveRotation
max_distance = ClusterInput()
crv = ClusterInput()
crv_2 = Curve(crv)
max_distance_2 = Number(max_distance)
item = ListItem(List=flatten(crv_2), Index=0, Wrap=True)
divide = DivideCurve(Curve=item, Count=100, Kinks=False)  # -> graft(Points), Tangents, Parameters
crv_cp = CurveClosestPoint(Point=divide.Points, Curve=flatten(crv_2))  # -> Point, Parameter, Distance
smaller = SmallerThan(FirstNumber=crv_cp.Distance, SecondNumber=max_distance_2)  # -> SmallerThan, OrEqualTo
cull = CullPattern(List=crv_cp.Point, CullPattern=smaller.SmallerThan)
avr = Average(Input=cull)  # -> flatten(ArithmeticMean)
intcrv = Interpolate(Vertices=avr, Degree=3, Periodic=True, KnotStyle=1)  # -> Curve, Length, Domain
reb = RebuildCurve(Curve=intcrv.Curve, Count=40, Tangents=False)
divide_2 = DivideCurve(Curve=reb, Count=200, Kinks=False)  # -> flatten(Points), Tangents, Parameters
crv_cp_2 = CurveClosestPoint(Point=divide_2.Points, Curve=crv_2)  # -> Point, Parameter, Distance
pt = Point(crv_cp_2.Point)
pt_2 = ClusterOutput(pt)

# ==== cluster CalcOffsets
crv = ClusterInput()
crv_2 = Curve(flatten(crv))
shift = ShiftList(List=crv_2, Shift=-1, Wrap=False)  # -> simplify(graft(List))
shift_2 = ShiftList(List=crv_2, Shift=1, Wrap=False)
item = ListItem(List=flatten(crv_2), Index=0, Wrap=True)
cp = ControlPoints(Curve=shift_2)  # -> simplify(Points), Weights, Knots
project = Project(Geometry=shift, Plane=PlaneXY(0, 0, 0))  # -> simplify(Geometry), Transform
cp_2 = ControlPoints(Curve=item)  # -> simplify(Points), Weights, Knots
pdecon = Deconstruct(Point=cp.Points)  # -> XComponent, YComponent, ZComponent
pt = ConstructPoint(XCoordinate=pdecon.XComponent, YCoordinate=pdecon.YComponent, ZCoordinate=0)  # -> simplify(Point)
pdecon_2 = Deconstruct(Point=cp_2.Points)  # -> XComponent, YComponent, ZComponent
clean = CleanTree(RemoveNulls=True, RemoveInvalid=True, RemoveEmpty=True, Tree=project.Geometry)
clean_2 = CleanTree(RemoveNulls=True, RemoveInvalid=True, RemoveEmpty=True, Tree=pt)
viewer = ParamViewer(clean)
viewer_2 = ParamViewer(clean_2)
txt = Text(viewer_2)
txt_2 = Text(viewer)
intersection = SetIntersection(SetA=txt, SetB=txt_2)
branch = TreeBranch(Tree=clean_2, Path=intersection, MaintainPaths=True)
branch_2 = TreeBranch(Tree=clean, Path=intersection, MaintainPaths=True)
crv_cp = CurveClosestPoint(Point=branch, Curve=branch_2)  # -> simplify(Point), Parameter, simplify(Distance)
incurve = PointInCurve(Point=branch, Curve=branch_2)  # -> Relationship, Point
clean_3 = CleanTree(RemoveNulls=True, RemoveInvalid=True, RemoveEmpty=False, Tree=crv_cp.Distance)
clean_4 = CleanTree(RemoveNulls=True, RemoveInvalid=True, RemoveEmpty=False, Tree=incurve.Relationship)
join = TextJoin(Text=flatten(pdecon_2.XComponent), Join=",")
join_2 = TextJoin(Text=flatten(pdecon_2.YComponent), Join=",")
expression = Expression(x=clean_4, y=clean_3, Expression="if(x>0,y,-y)")
merge = Merge(Data1=join, Data2=join_2)
panel = Panel(incurve.Relationship)
starting_boundary = Text(merge)
offsets = Number(expression)
starting_boundary_2 = ClusterOutput(starting_boundary)
offsets_2 = ClusterOutput(offsets)

# ==== cluster CullDefectiveBoundaries
num = ClusterInput()
pt = ClusterInput()
pt_2 = Point(pt)
num_2 = Number(num)
cullpt = CullDuplicates(Points=pt_2, Tolerance=0.1, CullMode=3)  # -> Points, Indices, Valence
pt_3 = Point(simplify(cullpt.Points))
lng = ListLength(List=pt_3)
larger = LargerThan(FirstNumber=lng, SecondNumber="15")  # -> LargerThan, OrEqualTo
cull = CullPattern(List=pt_3, CullPattern=larger.LargerThan)
pline = PolyLine(Vertices=cull, Closed=True)
clean = CleanTree(RemoveNulls=True, RemoveInvalid=True, RemoveEmpty=True, Tree=pline)
explode = Explode(Curve=clean, Recursive=True)  # -> Segments, Vertices
len = Length(Curve=explode.Segments)
sort = SortList(Keys=len)  # -> reverse(Keys), ValuesA
viewer = ParamViewer(clean)
item = ListItem(List=sort.Keys, Index=0, Wrap=True)
lng_2 = ListLength(List=viewer)
larger_2 = LargerThan(FirstNumber=item, SecondNumber=num_2)  # -> simplify(LargerThan), OrEqualTo
series = Series(Start=0, Step="10", Count=lng_2)
Z = UnitZ(Factor=series)  # -> graft(UnitVector)
move = Move(Geometry=clean, Motion=Z)  # -> Geometry, Transform
dispatch = Dispatch(List=move.Geometry, DispatchPattern=larger_2.LargerThan)  # -> ListA, simplify(ListB)
dispatch_2 = Dispatch(List=clean, DispatchPattern=larger_2.LargerThan)  # -> ListA, simplify(ListB)
clean_2 = CleanTree(RemoveNulls=True, RemoveInvalid=True, RemoveEmpty=True, Tree=dispatch.ListB)
clean_3 = CleanTree(RemoveNulls=True, RemoveInvalid=True, RemoveEmpty=True, Tree=clean)
int = Integer(lng_2)
int_2 = ClusterOutput(int)
offset_vertically = Curve(clean_2)
offset_vertically_2 = ClusterOutput(offset_vertically)
crv = Curve(clean_3)
crv_2 = ClusterOutput(crv)

# ==== cluster InfillWithTweens
pt = ClusterInput()
pt_2 = Point(pt)
intcrv = Interpolate(Vertices=pt_2, Degree=3, Periodic=True, KnotStyle=1)  # -> Curve, Length, Domain
reb = RebuildCurve(Curve=intcrv.Curve, Degree=3, Count=100, Tangents=False)
clean = CleanTree(RemoveNulls=True, RemoveInvalid=True, RemoveEmpty=True, Tree=reb)
crv = Curve(clean)
viewer = ParamViewer(crv)
dpath = DeconstructPath(Branch=viewer)
shift = ShiftList(List=flatten(crv), Shift=-1, Wrap=False)  # -> simplify(graft(List))
shift_2 = ShiftList(List=flatten(crv), Shift=1, Wrap=False)  # -> simplify(graft(List))
shift_3 = ShiftList(List=flatten(dpath), Shift=-1, Wrap=False)
shift_4 = ShiftList(List=flatten(dpath), Shift=1, Wrap=False)
subtraction = Subtraction(A=shift_4, B=shift_3)
range = Range(Domain=Domain(0, 1), Steps=flatten(subtraction))
panel = Panel("""0
-1""")
cull_i = CullIndex(List=range, Indices=panel, Wrap=True)  # -> simplify(List)
tweencrv = TweenCurve(CurveA=shift, CurveB=shift_2, Factor=cull_i, BlendType=0)
item = ListItem(List=flatten(crv), Index=-1, Wrap=True)  # -> flatten(Item)
merge = Merge(Data1=shift, Data2=tweencrv)  # -> flatten(Result)
merge_2 = Merge(Data1=merge, Data2=item)
crv_2 = Curve(graft(merge_2))
crv_3 = ClusterOutput(crv_2)

# ==== cluster CullDates
txt = ClusterInput()
pt = ClusterInput()
txt_2 = Text(txt)
pt_2 = Point(pt)
viewer = ParamViewer(pt_2)
dpath = DeconstructPath(Branch=viewer)  # -> flatten(Indices)
item = ListItem(List=dpath, Index=-1, Wrap=True)
split = SplitList(List=txt_2, Index=expr("x+1", item))  # -> flatten(ListA), ListB
txt_3 = Text(split.ListA)
txt_4 = ClusterOutput(txt_3)

# ==== cluster FilePath
folder = ClusterInput()
type = ClusterInput()
name = ClusterInput()
folder_2 = Text(folder)
type_2 = Text(type)
name_2 = Text(name)
merge = Merge(Data1=folder_2, Data2=name_2, Data3=type_2, Data4=".csv")
join = TextJoin(Text=merge)  # -> flatten(Result)
txt = Text(join)
txt_2 = ClusterOutput(txt)
