# Grasshopper definition load shorelines_3.gh (Grasshopper 1.0.7)
# plug-ins: Pufferfish

range = Range(Domain=Domain(0, 1), Steps=40)
cull_i = CullIndex(List=range, Indices="-1", Wrap=True)
crv = Curve([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])
twnconcrvs = TweenConsecutiveCurves(Curves=crv, Factor=cull_i, InterpolationType=0, Refit=0, PointSample=0)
split = SplitList(List=twnconcrvs, Index="3")  # -> ListA, ListB
crv_2 = Curve(reparameterize(split.ListA))
item = ListItem(List=crv_2, Index=0, Wrap=True)  # -> Item, Item1
crv_3 = Curve(item.Item)
shoreline2offset = CSharpScript(shorelines=crv_2)  # -> out, offset_tracks, pt, offsets_out, plns_out; inputs shorelines: list of Curve
# ---------- shoreline2offset: C# ----------
    if(shorelines.Count > 0){
      Rhino.Geometry.Curve start_crv = shorelines[0];
      int ptcnt = 100;
      List<Rhino.Geometry.Line> tracks = new List<Rhino.Geometry.Line>();//clearing tracks list
      List<Rhino.Geometry.Point3d> ref_pts = new List<Rhino.Geometry.Point3d>();
      List<Rhino.Geometry.Point3d> new_pts = new List<Rhino.Geometry.Point3d>();

      Grasshopper.DataTree<Double> offsets = new Grasshopper.DataTree<Double>();

      //get evenly spaced points
      for(int it = 0 ; it < ptcnt ; it++){
        double t = Convert.ToDouble(it) / Convert.ToDouble(ptcnt);
        ref_pts.Add(shorelines[0].PointAtNormalizedLength(t));
      }

      //cycle through shorelines
      for(int i = 1; i < shorelines.Count ; i++){
        Rhino.Geometry.Curve w_crv = Rhino.Geometry.Curve.CreatePeriodicCurve(Rhino.Geometry.Curve.CreateInterpolatedCurve(ref_pts, 3));
        List<Rhino.Geometry.Plane> plns = new List<Rhino.Geometry.Plane>();

        //get evenly spaced points
        foreach(Rhino.Geometry.Point3d refpt in ref_pts){
          double wt = 0;
          w_crv.ClosestPoint(refpt, out wt, 0);
          var crv_tan = w_crv.TangentAt(wt);
          var crv_norm = Rhino.Geometry.Vector3d.CrossProduct(crv_tan, Rhino.Geometry.Vector3d.ZAxis);
          var pln = new Rhino.Geometry.Plane(w_crv.PointAt(wt), crv_norm, Rhino.Geometry.Vector3d.ZAxis);
          plns.Add(pln);
          Rhino.Geometry.Line ln = new Rhino.Geometry.Line(w_crv.PointAt(wt), new Rhino.Geometry.Point3d(w_crv.PointAt(wt) + crv_norm));
          Rhino.Geometry.Intersect.CurveIntersections CIs = Rhino.Geometry.Intersect.Intersection.CurveLine(shorelines[i], ln, 0.001, 0.001);
          Rhino.Geometry.Point3d int_pt = CIs[0].PointA;
          if(CIs.Count > 1){
            double dist = w_crv.PointAt(wt).DistanceTo(CIs[0].PointA);
            for(int ci = 1 ; ci < CIs.Count ; ci++){
              if(dist > w_crv.PointAt(wt).DistanceTo(CIs[ci].PointA)){
                int_pt = CIs[ci].PointA;
              }
            }
          }
          //use ref plane to calculate offset
          Rhino.Geometry.Point3d pl_pt = new Rhino.Geometry.Point3d();
          pln.RemapToPlaneSpace(int_pt, out pl_pt);
          //save offsets as final output
          offsets.Add(pl_pt.X, new Grasshopper.Kernel.Data.GH_Path(i));

          //export points for visual inspection
          new_pts.Add(int_pt);
          //export tracks for visual inspection
          tracks.Add(new Rhino.Geometry.Line(refpt, int_pt));
        }

        //        Rhino.Geometry.Curve cur_crv = shorelines[i];
        //        //find the closest points
        //        foreach(Rhino.Geometry.Point3d refpt in ref_pts){
        //          double ct = 0;
        //          cur_crv.ClosestPoint(refpt, out ct, 0);
        //          var temp_pt = cur_crv.PointAt(ct);
        //          new_pts.Add(temp_pt);
        //          tracks.Add(new Rhino.Geometry.Line(refpt, temp_pt));
        //        }
        ref_pts = new List<Rhino.Geometry.Point3d>();
        ref_pts.AddRange(new_pts);
        pt = new_pts;
        new_pts = new List<Rhino.Geometry.Point3d>();

        plns_out = plns;
      }
      offset_tracks = tracks;
      offsets_out = offsets;

    }
# ---------- end shoreline2offset ----------
viewer = ParamViewer(shoreline2offset.offsets_out)
pln = Plane(shoreline2offset.plns_out)
crv_4 = Curve(shoreline2offset.offset_tracks)
panel = Panel(shoreline2offset.offsets_out)
pt = Point(shoreline2offset.pt)

panel_2 = Panel("D:\Github\CoastSat\data\Madhirivaadhoo\Madhirivaadhoo_output.csv")
panel_3 = Panel("D:\Github\CoastSat\data\dharavandhoo\dharavandhoo_output.csv")
name = Panel("veyofushi_finolhu")
panel_4 = Panel(",")  # disabled
offsets = Text()  # disabled
cluster = Cluster_2(T=offsets, C=panel_4)  # disabled
int = Integer()  # disabled
crv_5 = Curve()  # disabled
viewer_2 = ParamViewer(cluster)  # disabled
branch = TreeBranch(Tree=cluster, Path=viewer_2, MaintainPaths=True)  # disabled
clean = CleanTree(RemoveNulls=True, RemoveInvalid=True, RemoveEmpty=True, Tree=branch)  # disabled
file_path = FilePath(folder="D:\Github\CoastSat\data\veyofushi_finolhu\", name=name, type="_output")
viewer_3 = ParamViewer(clean)  # disabled
read_boundaries = ReadBoundaries(filepath=file_path)  # -> dates_2, boundaries_as_points_2
lng = ListLength(List=viewer_3)  # disabled
smaller = SmallerThan(FirstNumber=lng, SecondNumber=int)  # -> SmallerThan, OrEqualTo; disabled
pt_2 = Point(read_boundaries.boundaries_as_points_2)
filter = StreamFilter(Gate=smaller.SmallerThan, Stream0=int, Stream1=lng)  # disabled
cull_defective_boundaries = CullDefectiveBoundaries(pt=pt_2, num="100")  # -> crv_2, offset_vertically_2, int_2; disabled
cluster_2 = Cluster_5(num=clean, int=filter)  # disabled
cluster_3 = Cluster_4(num=cluster_2)  # disabled
panel_5 = Panel("25")  # disabled
remove_rotation = RemoveRotation(crv=cull_defective_boundaries.crv_2, max_distance=panel_5)  # disabled
offset2shoreline = CSharpScript(start_curve=crv_5, offsets=cluster_3)  # -> out, crv_out, offset_tracks, last_crv, prev_crvs, planes, pts_out; inputs start_curve: Curve, offsets: tree of Double; disabled
# ---------- offset2shoreline: C# ----------
    Rhino.Geometry.Curve w_crv = start_curve;

    List<Rhino.Geometry.Line> tracks = new List<Rhino.Geometry.Line>();
    List<Rhino.Geometry.Curve> crv_seq = new List<Rhino.Geometry.Curve>();

    for(int i = 0; i < offsets.BranchCount ; i++){
      tracks = new List<Rhino.Geometry.Line>();//clearing tracks list

      List<double> offset_step = offsets.Branch(i);
      int cnt = offset_step.Count;
      var t_vals = w_crv.DivideByCount(cnt, true);
      crv_seq.Add(w_crv);

      List<Rhino.Geometry.Point3d> pts = new List<Rhino.Geometry.Point3d>();
      List<Rhino.Geometry.Plane> plns = new List<Rhino.Geometry.Plane>();

      int pt_cnt = 0;
      foreach(var t_val in t_vals){
        var crv_tan = w_crv.TangentAt(t_val);
        var crv_norm = Rhino.Geometry.Vector3d.CrossProduct(crv_tan, Rhino.Geometry.Vector3d.ZAxis);
        var pln = new Rhino.Geometry.Plane(w_crv.PointAt(t_val), crv_norm, Rhino.Geometry.Vector3d.ZAxis);
        var pt = pln.PointAt(-offset_step[pt_cnt], 0);
        pts.Add(pt);
        plns.Add(pln);
        tracks.Add(new Rhino.Geometry.Line(plns[pt_cnt].Origin, pt));
        pt_cnt++;
      }
      planes = plns;
      pts_out = pts;

      //reset start
      var str_pt = w_crv.PointAtStart;
      w_crv = Rhino.Geometry.Curve.CreatePeriodicCurve(Rhino.Geometry.Curve.CreateInterpolatedCurve(pts, 3));
      w_crv = w_crv.Rebuild(cnt / 4, 3, false);
      
      double str_t = 0;
      w_crv.ClosestPoint(str_pt, out str_t);
      w_crv.ChangeClosedCurveSeam(str_t);

      Rhino.Geometry.Intersect.CurveIntersections self_intersect = Rhino.Geometry.Intersect.Intersection.CurveSelf(w_crv, 0.01);

      if(self_intersect.Count > 0){
        List < double > tx = new List<double>();
        for(int ix = 0 ; ix < self_intersect.Count ; ix++){
          tx.Add(self_intersect[ix].ParameterA);
          tx.Add(self_intersect[ix].ParameterB);
          Print("intersection at: " + self_intersect[ix].ParameterA.ToString() + " and " + self_intersect[ix].ParameterB.ToString());
        }
        Rhino.Geometry.Curve[] crvs = w_crv.Split(tx);
        Print(crvs.Length.ToString());
        if(crvs.Length > 1){
          Print(crvs.Length.ToString());
          Print(crvs[0].ToString());
          Print(w_crv.ToString());
          Rhino.Geometry.Curve s_crv = crvs[0];
          for(int cr = 0 ; cr < crvs.Length ; cr++){
            if( crvs[cr].GetLength() > s_crv.GetLength()){
              s_crv = crvs[cr];
            }
          }
          s_crv = Rhino.Geometry.Curve.CreatePeriodicCurve(s_crv);
          s_crv = s_crv.Rebuild(cnt / 4, 3, false);


          //reset start
          str_pt = w_crv.PointAtStart;
          str_t = 0;
          s_crv.ClosestPoint(str_pt, out str_t);
          s_crv.ChangeClosedCurveSeam(str_t);

          w_crv = s_crv;
        }
      }
    }
    prev_crvs = crv_seq;
    offset_tracks = tracks;
    crv_out = w_crv;
# ---------- end offset2shoreline ----------
infill_with_tweens = InfillWithTweens(pt=remove_rotation)  # disabled
clean_2 = CleanTree(RemoveNulls=True, RemoveInvalid=True, RemoveEmpty=True, Tree=flatten(cull_defective_boundaries.crv_2))
crv_6 = Curve(flatten(infill_with_tweens))  # disabled
cull_dates = CullDates(txt=read_boundaries.dates_2, pt=remove_rotation)  # disabled
item_2 = ListItem(List=clean_2, Index=0, Wrap=True)
panel_6 = Panel(cull_dates)
pt_3 = Point(offset2shoreline.pts_out)
item_3 = ListItem(List=offset2shoreline.out, Index=0, Wrap=True)  # -> Item, Item1
crv_7 = Curve(crv_5)
split_2 = SplitList(List=reverse(offset2shoreline.prev_crvs), Index=10)  # -> reverse(ListA), ListB
calc_offsets = CalcOffsets(crv=infill_with_tweens)  # -> starting_boundary_2, offsets_2
lng_2 = ListLength(List=split_2.ListA)  # -> expr("x-1", Length)
item_4 = ListItem(List=offset2shoreline.prev_crvs, Index=0, Wrap=True)  # -> Item1, Item
range_2 = Range(Domain=Domain(0, 1), Steps=lng_2)
gradient = Gradient(LowerLimit=0, UpperLimit=1, Parameter=range_2, stops=[0.0572: RGB(192, 255, 255), 0.948: RGB(0, 128, 128)])
file_path_2 = FilePath(folder="D:\Github\littoral\toy_island\", name=name, type="_offsets")
crv_8 = Curve(item_4.Item1)
preview = CustomPreview(Geometry=crv_8, Material=ColourSwatch(SwatchColor=RGB(137, 161, 50)))
swatch = ColourSwatch(SwatchColor=RGB(199, 242, 239))  # disabled
swatch_2 = ColourSwatch(SwatchColor=RGB(150, 204, 124))  # disabled
crv_9 = Curve(offset2shoreline.crv_out)
save_offsets = Save_offsets(
    txt=cull_dates,
    starting_locations=calc_offsets.starting_boundary_2,
    offsets=calc_offsets.offsets_2,
    path=file_path_2,
    save=Toggle(False))  # -> out, out_2
cluster_4 = Cluster_6(crv=crv_9)
preview_2 = CustomPreview(Geometry=crv_9, Material=ColourSwatch(SwatchColor=RGB(0, 37, 122)))
preview_3 = CustomPreview(Geometry=crv_7, Material=swatch)  # disabled
preview_4 = CustomPreview(Geometry=offset2shoreline.offset_tracks, Material=swatch_2)  # disabled
preview_5 = CustomPreview(Geometry=split_2.ListA, Material=gradient)
panel_7 = Panel(save_offsets.out)

# ==== cluster ReadBoundaries
filepath = ClusterInput()
file = ReadFile(Filepath=filepath, PerLineParse=True)
split = SplitList(List=file, Index=1)  # -> ListA, ListB
split_2 = TextSplit(Text=split.ListB, Separators=",")
split_3 = SplitList(List=split_2, Index=1)  # -> ListA, ListB
rep = ReplaceText(Text=split_3.ListB, Find="[", RecursiveReplace=False)
rep_2 = ReplaceText(Text=rep, Find="]", RecursiveReplace=False)
item = ListItem(List=split.ListB, Index=0, Wrap=True)  # -> Item1, Item
split_4 = TextSplit(Text=split.ListB, Separators=",")
trim = TextTrim(Text=rep_2, Start=True, End=True)
split_5 = TextSplit(Text=item.Item1, Separators=",")
split_6 = TextSplit(Text=item.Item, Separators=",")
item_2 = ListItem(List=split_4, Index=0, Wrap=True)  # -> flatten(Item)
split_7 = TextSplit(Text=trim, Separators=" ")
split_8 = SplitList(List=split_5, Index=1)  # -> ListA, ListB
split_9 = SplitList(List=split_6, Index=1)  # -> ListA, ListB
panel = Panel(split_9.ListA)
len = TextLength(Text=split_7)
bool = Boolean(len)
cull = CullPattern(List=split_7, CullPattern=bool)
num2pt = NumbersToPoints(Numbers=cull, Mask=2)  # -> simplify(Points)
path_mapper = PathMapper(num2pt, source="{A;B}", target="{A}")
boundaries_as_points = Point(path_mapper)
dates = Text(item_2)
boundaries_as_points_2 = ClusterOutput(boundaries_as_points)
dates_2 = ClusterOutput(dates)

# ==== cluster Save_offsets
starting_locations = ClusterInput()
offsets = ClusterInput()
txt = ClusterInput()
path = ClusterInput()
save = ClusterInput()
offsets_2 = Number(offsets)
starting_locations_2 = Text(starting_locations)
txt_2 = Text(txt)
item = ListItem(List=txt_2, Index=0, Wrap=True)
lng = ListLength(List=txt_2)
panel = Panel(item)
c_script = CSharpScript(start_time=panel, len=lng)  # -> graft(time_series); inputs len: Int32
# ---------- c_script: C# ----------
    List<DateTime> dates = new List<DateTime>();

    for(int i = 0 ; i < len ; i++){
      dates.Add(start_time.AddDays(i));
    }
    time_series = dates;
# ---------- end c_script ----------
txt_3 = Text(flatten(c_script))
split = TextSplit(Text=txt_3, Separators=" ")
item_2 = ListItem(List=split, Index=0, Wrap=True)  # -> flatten(Item)
panel_2 = Panel(offsets_2)
concat = Concatenate(FragmentA=item_2, FragmentB=" 00:00:00")
lng_2 = ListLength(List=panel_2)  # -> flatten(Length)
item_3 = ListItem(List=lng_2, Index=0, Wrap=True)
series = Series(Start=0, Step=1, Count=item_3)
int = Integer(series)
rep = ReplaceText(Text=path, Find="_offsets.csv", Replace="_starts.csv", RecursiveReplace=False)
concat_2 = Concatenate(FragmentA="T", FragmentB=int)
txt_4 = Text(concat)
panel_3 = Panel("""x,
y,""")
merge = Merge(Data1="time", Data2=flatten(concat_2))
concat_3 = Concatenate(FragmentA=txt_4, FragmentB=",")
join = TextJoin(Text=panel_2, Join=",")  # -> flatten(Result)
merge_2 = Merge(Data1="axia", Data2=flatten(concat_2))
join_2 = TextJoin(Text=merge, Join=",")
concat_4 = Concatenate(FragmentA=panel_3, FragmentB=starting_locations_2)
join_3 = TextJoin(Text=merge_2, Join=",")
concat_5 = Concatenate(FragmentA=concat_3, FragmentB=join)
merge_3 = Merge(Data1=flatten(join_3), Data2=flatten(concat_4))
merge_4 = Merge(Data1=flatten(join_2), Data2=flatten(concat_5))
c_script_2 = CSharpScript(data=merge_4, path=path, save=save)  # -> out; inputs data: list of String, path: String, save: Boolean
# ---------- c_script_2: C# ----------
    if(save){
      using (var file = System.IO.File.CreateText(path))
      {
        foreach(var arr in data)
        {
          file.WriteLine(string.Join(",", arr));
        }
      }
    }
# ---------- end c_script_2 ----------
c_script_3 = CSharpScript(data=merge_3, path=rep, save=save)  # -> out; inputs data: list of String, path: String, save: Boolean; same code as c_script_2
out = ClusterOutput(c_script_2)
out_2 = ClusterOutput(c_script_3)

# ==== cluster RemoveRotation
max_distance = ClusterInput()
crv = ClusterInput()
crv_2 = Curve(crv)
max_distance_2 = Number(max_distance)
item = ListItem(List=flatten(crv_2), Index=0, Wrap=True)
divide = DivideCurve(Curve=item, Count=100, Kinks=False)  # -> graft(Points), Tangents, Parameters
crv_cp = CurveClosestPoint(Point=divide.Points, Curve=flatten(crv_2))  # -> Point, Parameter, Distance
smaller = SmallerThan(FirstNumber=crv_cp.Distance, SecondNumber=max_distance_2)  # -> SmallerThan, OrEqualTo
cull = CullPattern(List=crv_cp.Point, CullPattern=smaller.SmallerThan)
avr = Average(Input=cull)  # -> flatten(ArithmeticMean)
intcrv = Interpolate(Vertices=avr, Degree=3, Periodic=True, KnotStyle=1)  # -> Curve, Length, Domain
reb = RebuildCurve(Curve=intcrv.Curve, Count=40, Tangents=False)
divide_2 = DivideCurve(Curve=reb, Count=200, Kinks=False)  # -> flatten(Points), Tangents, Parameters
crv_cp_2 = CurveClosestPoint(Point=divide_2.Points, Curve=crv_2)  # -> Point, Parameter, Distance
pt = Point(crv_cp_2.Point)
pt_2 = ClusterOutput(pt)

# ==== cluster CalcOffsets
crv = ClusterInput()
crv_2 = Curve(flatten(crv))
shift = ShiftList(List=crv_2, Shift=-1, Wrap=False)  # -> simplify(graft(List))
shift_2 = ShiftList(List=crv_2, Shift=1, Wrap=False)
item = ListItem(List=flatten(crv_2), Index=0, Wrap=True)
cp = ControlPoints(Curve=shift_2)  # -> simplify(Points), Weights, Knots
project = Project(Geometry=shift, Plane=PlaneXY(0, 0, 0))  # -> simplify(Geometry), Transform
cp_2 = ControlPoints(Curve=item)  # -> simplify(Points), Weights, Knots
pdecon = Deconstruct(Point=cp.Points)  # -> XComponent, YComponent, ZComponent
pt = ConstructPoint(XCoordinate=pdecon.XComponent, YCoordinate=pdecon.YComponent, ZCoordinate=0)  # -> simplify(Point)
pdecon_2 = Deconstruct(Point=cp_2.Points)  # -> XComponent, YComponent, ZComponent
clean = CleanTree(RemoveNulls=True, RemoveInvalid=True, RemoveEmpty=True, Tree=project.Geometry)
clean_2 = CleanTree(RemoveNulls=True, RemoveInvalid=True, RemoveEmpty=True, Tree=pt)
viewer = ParamViewer(clean)
viewer_2 = ParamViewer(clean_2)
txt = Text(viewer_2)
txt_2 = Text(viewer)
intersection = SetIntersection(SetA=txt, SetB=txt_2)
branch = TreeBranch(Tree=clean_2, Path=intersection, MaintainPaths=True)
branch_2 = TreeBranch(Tree=clean, Path=intersection, MaintainPaths=True)
crv_cp = CurveClosestPoint(Point=branch, Curve=branch_2)  # -> simplify(Point), Parameter, simplify(Distance)
incurve = PointInCurve(Point=branch, Curve=branch_2)  # -> Relationship, Point
clean_3 = CleanTree(RemoveNulls=True, RemoveInvalid=True, RemoveEmpty=False, Tree=crv_cp.Distance)
clean_4 = CleanTree(RemoveNulls=True, RemoveInvalid=True, RemoveEmpty=False, Tree=incurve.Relationship)
join = TextJoin(Text=flatten(pdecon_2.XComponent), Join=",")
join_2 = TextJoin(Text=flatten(pdecon_2.YComponent), Join=",")
expression = Expression(x=clean_4, y=clean_3, Expression="if(x>0,y,-y)")
merge = Merge(Data1=join, Data2=join_2)
panel = Panel(incurve.Relationship)
starting_boundary = Text(merge)
offsets = Number(expression)
starting_boundary_2 = ClusterOutput(starting_boundary)
offsets_2 = ClusterOutput(offsets)

# ==== cluster CullDefectiveBoundaries
pt = ClusterInput()
num = ClusterInput()
pt_2 = Point(pt)
num_2 = Number(num)
cullpt = CullDuplicates(Points=pt_2, Tolerance=0.1, CullMode=3)  # -> Points, Indices, Valence
pt_3 = Point(simplify(cullpt.Points))
lng = ListLength(List=pt_3)
larger = LargerThan(FirstNumber=lng, SecondNumber="15")  # -> LargerThan, OrEqualTo
cull = CullPattern(List=pt_3, CullPattern=larger.LargerThan)
pline = PolyLine(Vertices=cull, Closed=True)
clean = CleanTree(RemoveNulls=True, RemoveInvalid=True, RemoveEmpty=True, Tree=pline)
explode = Explode(Curve=clean, Recursive=True)  # -> Segments, Vertices
len = Length(Curve=explode.Segments)
sort = SortList(Keys=len)  # -> reverse(Keys), ValuesA
viewer = ParamViewer(clean)
item = ListItem(List=sort.Keys, Index=0, Wrap=True)
lng_2 = ListLength(List=viewer)
larger_2 = LargerThan(FirstNumber=item, SecondNumber=num_2)  # -> simplify(LargerThan), OrEqualTo
series = Series(Start=0, Step="10", Count=lng_2)
Z = UnitZ(Factor=series)  # -> graft(UnitVector)
move = Move(Geometry=clean, Motion=Z)  # -> Geometry, Transform
dispatch = Dispatch(List=move.Geometry, DispatchPattern=larger_2.LargerThan)  # -> ListA, simplify(ListB)
dispatch_2 = Dispatch(List=clean, DispatchPattern=larger_2.LargerThan)  # -> ListA, simplify(ListB)
clean_2 = CleanTree(RemoveNulls=True, RemoveInvalid=True, RemoveEmpty=True, Tree=dispatch.ListB)
clean_3 = CleanTree(RemoveNulls=True, RemoveInvalid=True, RemoveEmpty=True, Tree=clean)
int = Integer(lng_2)
offset_vertically = Curve(clean_2)
crv = Curve(clean_3)
int_2 = ClusterOutput(int)
offset_vertically_2 = ClusterOutput(offset_vertically)
crv_2 = ClusterOutput(crv)

# ==== cluster InfillWithTweens
pt = ClusterInput()
pt_2 = Point(pt)
intcrv = Interpolate(Vertices=pt_2, Degree=3, Periodic=True, KnotStyle=1)  # -> Curve, Length, Domain
reb = RebuildCurve(Curve=intcrv.Curve, Degree=3, Count=100, Tangents=False)
clean = CleanTree(RemoveNulls=True, RemoveInvalid=True, RemoveEmpty=True, Tree=reb)
crv = Curve(clean)
viewer = ParamViewer(crv)
dpath = DeconstructPath(Branch=viewer)
shift = ShiftList(List=flatten(crv), Shift=-1, Wrap=False)  # -> simplify(graft(List))
shift_2 = ShiftList(List=flatten(crv), Shift=1, Wrap=False)  # -> simplify(graft(List))
shift_3 = ShiftList(List=flatten(dpath), Shift=-1, Wrap=False)
shift_4 = ShiftList(List=flatten(dpath), Shift=1, Wrap=False)
subtraction = Subtraction(A=shift_4, B=shift_3)
range = Range(Domain=Domain(0, 1), Steps=flatten(subtraction))
panel = Panel("""0
-1""")
cull_i = CullIndex(List=range, Indices=panel, Wrap=True)  # -> simplify(List)
tweencrv = TweenCurve(CurveA=shift, CurveB=shift_2, Factor=cull_i, BlendType=0)
item = ListItem(List=flatten(crv), Index=-1, Wrap=True)  # -> flatten(Item)
merge = Merge(Data1=shift, Data2=tweencrv)  # -> flatten(Result)
merge_2 = Merge(Data1=merge, Data2=item)
crv_2 = Curve(graft(merge_2))
crv_3 = ClusterOutput(crv_2)

# ==== cluster CullDates
txt = ClusterInput()
pt = ClusterInput()
txt_2 = Text(txt)
pt_2 = Point(pt)
viewer = ParamViewer(pt_2)
dpath = DeconstructPath(Branch=viewer)  # -> flatten(Indices)
item = ListItem(List=dpath, Index=-1, Wrap=True)
split = SplitList(List=txt_2, Index=expr("x+1", item))  # -> flatten(ListA), ListB
txt_3 = Text(split.ListA)
txt_4 = ClusterOutput(txt_3)

# ==== cluster FilePath
folder = ClusterInput()
type = ClusterInput()
name = ClusterInput()
folder_2 = Text(folder)
type_2 = Text(type)
name_2 = Text(name)
merge = Merge(Data1=folder_2, Data2=name_2, Data3=type_2, Data4=".csv")
join = TextJoin(Text=merge)  # -> flatten(Result)
txt = Text(join)
txt_2 = ClusterOutput(txt)

# ==== cluster Cluster_2
T = ClusterInput()
C = ClusterInput()
split = TextSplit(Text=T, Separators=C)  # -> simplify(Result)
len = TextLength(Text=split)
larger = LargerThan(FirstNumber=len, SecondNumber=0)  # -> LargerThan, OrEqualTo
cull = CullPattern(List=split, CullPattern=larger.LargerThan)
lng = ListLength(List=cull)
cluster = Cluster(int=lng)
cull_2 = CullPattern(List=cull, CullPattern=cluster)
num = Number(cull_2)
num_2 = ClusterOutput(num)

# ==== cluster Cluster_4
num = ClusterInput()
num_2 = Number(simplify(num))
len = TextLength(Text=num_2)
smaller = SmallerThan(FirstNumber=len, SecondNumber="1")  # -> SmallerThan, OrEqualTo
concat = Concatenate(FragmentA=num_2, FragmentB="0")
p_n_c = PickNChoose(Pattern=smaller.SmallerThan, Stream0=num_2, Stream1=concat)  # -> simplify(Result)
num_3 = Number(p_n_c)
cluster = Cluster_3(num=num_3)
num_4 = ClusterOutput(cluster)

# ==== cluster Cluster_5
num = ClusterInput()
num_2 = Number(simplify(num))
viewer = ParamViewer(num_2)
int = ClusterInput()
int_2 = Integer(int)
split = SplitList(List=viewer, Index=int_2)  # -> ListA, ListB
branch = TreeBranch(Tree=num_2, Path=split.ListA, MaintainPaths=True)
B = ClusterOutput(branch)

# ==== cluster Cluster_6
crv = ClusterInput()
crv_2 = Curve(crv)
eval = EvaluateCurve(Curve=reparameterize(crv_2), Parameter=0.5)  # -> Point, Tangent, Angle
vdis = VectorDisplay(Anchor=eval.Point, Vector=eval.Tangent)

# ==== cluster Cluster
int = ClusterInput()
int_2 = Integer(int)
c_script = CSharpScript(nums=flatten(int_2))  # -> out, A; inputs nums: list of Int32
# ---------- c_script: C# ----------
    A = Mode(nums);
# ---------- c_script: C# additional code ----------
  static List<int> Mode(List<int> values)
  {
    int[] sorted = new int[values.Count];
    values.CopyTo(sorted, 0);
    Array.Sort(sorted);

    List<int> result = new List<int>();
    var counts = new Dictionary<int, int>();
    int max = 0;
    foreach (int num in sorted)

    {
      if (counts.ContainsKey(num))
        counts[num] = counts[num] + 1;
      else
        counts[num] = 1;
    }

    foreach (var key in counts.Keys)
    {
      if (counts[key] > max)
      {
        max = counts[key];
        result.Add(max);
      }
    }

    return result;

  }
# ---------- end c_script ----------
viewer = ParamViewer(int_2)
replace = ReplacePaths(Data=int_2, Search=viewer, Replace=flatten(int_2))
panel = Panel(c_script.A)
lng = ListLength(List=replace)
viewer_2 = ParamViewer(replace)
sort = SortList(Keys=flatten(lng), ValuesA=viewer_2)  # -> Keys, reverse(ValuesA)
item = ListItem(List=sort.ValuesA, Index=0, Wrap=True)
branch = TreeBranch(Tree=replace, Path=item, MaintainPaths=True)
avr = Average(Input=branch)  # -> flatten(ArithmeticMean)
equals = Equality(FirstNumber=avr, SecondNumber=int_2)  # -> Equality, Inequality
bool = Boolean(equals.Equality)
bool_2 = ClusterOutput(bool)

# ==== cluster Cluster_3
num = ClusterInput()
num_2 = Number(num)
ma = MassAddition(Input=num_2)  # -> Result, PartialResults
viewer = ParamViewer(num_2)
bool = Boolean(ma.Result)
dispatch = Dispatch(List=viewer, DispatchPattern=flatten(bool))  # -> ListA, ListB
branch = TreeBranch(Tree=num_2, Path=dispatch.ListA, MaintainPaths=True)
branch_2 = TreeBranch(Tree=num_2, Path=dispatch.ListB, MaintainPaths=True)
num_3 = Number(branch)
abs = Absolute(Value=num_3)
division = Division(A=num_3, B=abs)
avr = Average(Input=abs)
division_2 = Division(A=abs, B=avr)
multiplication = Multiplication(A=avr, B=division)
larger = LargerThan(FirstNumber=division_2, SecondNumber="10")  # -> LargerThan, OrEqualTo
p_n_c = PickNChoose(Pattern=larger.LargerThan, Stream0=num_3, Stream1=multiplication)
merge = Merge(Data1=p_n_c, Data2=branch_2)
num_4 = Number(merge)
num_5 = ClusterOutput(num_4)
