# Grasshopper definition load shorelines_4.gh (Grasshopper 1.0.7)
# plug-ins: Pufferfish

crv = Curve([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])
crv_2 = Curve([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])
crv_3 = Curve([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])

range = Range(Domain=Domain(0, 1), Steps=40)
cull_i = CullIndex(List=range, Indices="-1", Wrap=True)
twnconcrvs = TweenConsecutiveCurves(Curves=crv, Factor=cull_i, InterpolationType=0, Refit=0, PointSample=0)
split = SplitList(List=twnconcrvs, Index="10")  # -> ListA, ListB
crv_4 = Curve(reparameterize(split.ListA))
shoreline2offset = CSharpScript(shorelines=crv_4, transect_count="120", reset_spacing=Toggle(True))  # -> out, offset_tracks, offsets_out, plns_out; inputs shorelines: list of Curve, transect_count: Int32, reset_spacing: Boolean
# ---------- shoreline2offset: C# ----------
    if(shorelines.Count > 0){
      Rhino.Geometry.Curve start_crv = shorelines[0];
      int ptcnt = transect_count;
      List<Rhino.Geometry.Line> tracks = new List<Rhino.Geometry.Line>();//clearing tracks list
      List<Rhino.Geometry.Point3d> ref_pts = new List<Rhino.Geometry.Point3d>();
      List<Rhino.Geometry.Point3d> new_pts = new List<Rhino.Geometry.Point3d>();

      Grasshopper.DataTree<Double> offsets = new Grasshopper.DataTree<Double>();

      //get evenly spaced points for first curve
      for(int it = 0 ; it < ptcnt ; it++){
        double t = Convert.ToDouble(it) / Convert.ToDouble(ptcnt);
        ref_pts.Add(shorelines[0].PointAtNormalizedLength(t));
      }
      //create a smooth curve to get normals
      Rhino.Geometry.Curve w_crv = Rhino.Geometry.Curve.CreatePeriodicCurve(Rhino.Geometry.Curve.CreateInterpolatedCurve(ref_pts, 3));

      //cycle through shorelines
      for(int i = 1; i < shorelines.Count ; i++){
        List<Rhino.Geometry.Plane> plns = new List<Rhino.Geometry.Plane>();

        if(ref_pts.Count == ptcnt){
          //get evenly spaced points
          foreach(Rhino.Geometry.Point3d refpt in ref_pts){
            double wt = 0;
            w_crv.ClosestPoint(refpt, out wt, 0);
            var crv_tan = w_crv.TangentAt(wt);
            var crv_norm = Rhino.Geometry.Vector3d.CrossProduct(crv_tan, Rhino.Geometry.Vector3d.ZAxis);
            var pln = new Rhino.Geometry.Plane(w_crv.PointAt(wt), crv_norm, Rhino.Geometry.Vector3d.ZAxis);
            plns.Add(pln);
            Rhino.Geometry.Line ln = new Rhino.Geometry.Line(w_crv.PointAt(wt), new Rhino.Geometry.Point3d(w_crv.PointAt(wt) + crv_norm));
            Rhino.Geometry.Intersect.CurveIntersections CIs = Rhino.Geometry.Intersect.Intersection.CurveLine(shorelines[i], ln, 0.001, 0.001);

            //initialize int_pt as plane origin
            Rhino.Geometry.Point3d int_pt = pln.Origin;
            if(CIs.Count > 0){
              //if an intersection is found, use that as new point
              int_pt = CIs[0].PointA;
              if(CIs.Count > 1){
                double dist = w_crv.PointAt(wt).DistanceTo(CIs[0].PointA);
                for(int ci = 1 ; ci < CIs.Count ; ci++){
                  if(dist > w_crv.PointAt(wt).DistanceTo(CIs[ci].PointA)){
                    int_pt = CIs[ci].PointA;
                  }
                }
              }
            }else{
              //if no intersection, use closest point
              double nt = 0;
              shorelines[i].ClosestPoint(pln.Origin, out nt, 0);
              int_pt = shorelines[i].PointAt(nt);
            }

            //use ref plane to calculate offset
            Rhino.Geometry.Point3d pl_pt = new Rhino.Geometry.Point3d();
            pln.RemapToPlaneSpace(int_pt, out pl_pt);

            //save offsets as final output
            offsets.Add(pl_pt.X, new Grasshopper.Kernel.Data.GH_Path(i));

            //export points for visual inspection
            new_pts.Add(int_pt);
            //export tracks for visual inspection
            tracks.Add(new Rhino.Geometry.Line(refpt, int_pt));
          }
        }
        //optional reset the spacing
        ref_pts = new List<Rhino.Geometry.Point3d>();

        if(reset_spacing)
        {
          //update the smooth curve
          w_crv = Rhino.Geometry.Curve.CreatePeriodicCurve(Rhino.Geometry.Curve.CreateInterpolatedCurve(new_pts, 3));
          for(int it = 0 ; it < ptcnt ; it++){
            double t = Convert.ToDouble(it) / Convert.ToDouble(ptcnt);
            ref_pts.Add(w_crv.PointAtNormalizedLength(t));
          }
        }
        else
        {
          ref_pts.AddRange(new_pts);
        }
        new_pts = new List<Rhino.Geometry.Point3d>();

        plns_out = plns;
      }
      offset_tracks = tracks;
      offsets_out = offsets;

    }
# ---------- end shoreline2offset ----------
viewer = ParamViewer(shoreline2offset.offsets_out)
crv_5 = Curve(shoreline2offset.offset_tracks)
panel = Panel(shoreline2offset.offsets_out)

item = ListItem(List=crv_4, Index=0, Wrap=True)  # -> Item1, Item
crv_6 = Curve(item.Item1)
item_2 = ListItem(List=crv_4, Index=0, Wrap=True)
offset2shoreline = CSharpScript(start_curve=item_2, offsets=shoreline2offset.offsets_out)  # -> out, crv_out, offset_tracks, prev_crvs, planes, pts_out; inputs start_curve: Curve, offsets: tree of Double
# ---------- offset2shoreline: C# ----------
    Rhino.Geometry.Curve w_crv = start_curve;

    List<Rhino.Geometry.Line> tracks = new List<Rhino.Geometry.Line>();
    List<Rhino.Geometry.Curve> crv_seq = new List<Rhino.Geometry.Curve>();

    for(int i = 0; i < offsets.BranchCount ; i++){
      tracks = new List<Rhino.Geometry.Line>();//clearing tracks list

      List<double> offset_step = offsets.Branch(i);
      int cnt = offset_step.Count;

      List<double> t_vals = new List<double>();
      //get evenly spaced points for first curve
      for(int it = 0 ; it < cnt ; it++){
        double t = Convert.ToDouble(it) / Convert.ToDouble(cnt);
        double tp = 0;
        w_crv.ClosestPoint(w_crv.PointAtNormalizedLength(t), out tp, 0);
        t_vals.Add(tp);
      }
      //var t_vals = w_crv.DivideByCount(cnt, true);

      crv_seq.Add(w_crv);

      List<Rhino.Geometry.Point3d> pts = new List<Rhino.Geometry.Point3d>();
      List<Rhino.Geometry.Plane> plns = new List<Rhino.Geometry.Plane>();

      int pt_cnt = 0;
      foreach(var t_val in t_vals){
        var crv_tan = w_crv.TangentAt(t_val);
        var crv_norm = Rhino.Geometry.Vector3d.CrossProduct(crv_tan, Rhino.Geometry.Vector3d.ZAxis);
        var pln = new Rhino.Geometry.Plane(w_crv.PointAt(t_val), crv_norm, Rhino.Geometry.Vector3d.ZAxis);
        var pt = pln.PointAt(offset_step[pt_cnt], 0);
        pts.Add(pt);
        plns.Add(pln);
        tracks.Add(new Rhino.Geometry.Line(plns[pt_cnt].Origin, pt));
        pt_cnt++;
      }
      planes = plns;
      pts_out = pts;

      //reset start
      var str_pt = w_crv.PointAtStart;
      w_crv = Rhino.Geometry.Curve.CreatePeriodicCurve(Rhino.Geometry.Curve.CreateInterpolatedCurve(pts, 3));
      w_crv = w_crv.Rebuild(cnt / 4, 3, false);

      double str_t = 0;
      w_crv.ClosestPoint(str_pt, out str_t);
      w_crv.ChangeClosedCurveSeam(str_t);

      Rhino.Geometry.Intersect.CurveIntersections self_intersect = Rhino.Geometry.Intersect.Intersection.CurveSelf(w_crv, 0.01);

      if(self_intersect.Count > 0){
        List < double > tx = new List<double>();
        for(int ix = 0 ; ix < self_intersect.Count ; ix++){
          tx.Add(self_intersect[ix].ParameterA);
          tx.Add(self_intersect[ix].ParameterB);
          Print("intersection at: " + self_intersect[ix].ParameterA.ToString() + " and " + self_intersect[ix].ParameterB.ToString());
        }
        Rhino.Geometry.Curve[] crvs = w_crv.Split(tx);
        Print(crvs.Length.ToString());
        if(crvs.Length > 1){
          Print(crvs.Length.ToString());
          Print(crvs[0].ToString());
          Print(w_crv.ToString());
          Rhino.Geometry.Curve s_crv = crvs[0];
          for(int cr = 0 ; cr < crvs.Length ; cr++){
            if( crvs[cr].GetLength() > s_crv.GetLength()){
              s_crv = crvs[cr];
            }
          }
          s_crv = Rhino.Geometry.Curve.CreatePeriodicCurve(s_crv);
          s_crv = s_crv.Rebuild(cnt / 4, 3, false);


          //reset start
          str_pt = w_crv.PointAtStart;
          str_t = 0;
          s_crv.ClosestPoint(str_pt, out str_t);
          s_crv.ChangeClosedCurveSeam(str_t);

          w_crv = s_crv;
        }
      }
    }
    prev_crvs = crv_seq;
    offset_tracks = tracks;
    crv_out = w_crv;
# ---------- end offset2shoreline ----------
offset2shoreline_2 = CSharpScript(start_curve=item_2, offsets=shoreline2offset.offsets_out)  # -> out, crv_out, offset_tracks, last_crv, prev_crvs, planes, pts_out; inputs start_curve: Curve, offsets: tree of Double; disabled
# ---------- offset2shoreline_2: C# ----------
    Rhino.Geometry.Curve w_crv = start_curve;

    List<Rhino.Geometry.Line> tracks = new List<Rhino.Geometry.Line>();
    List<Rhino.Geometry.Curve> crv_seq = new List<Rhino.Geometry.Curve>();

    for(int i = 0; i < offsets.BranchCount ; i++){
      tracks = new List<Rhino.Geometry.Line>();//clearing tracks list

      List<double> offset_step = offsets.Branch(i);
      int cnt = offset_step.Count;
      var t_vals = w_crv.DivideByCount(cnt, true);
      crv_seq.Add(w_crv);

      List<Rhino.Geometry.Point3d> pts = new List<Rhino.Geometry.Point3d>();
      List<Rhino.Geometry.Plane> plns = new List<Rhino.Geometry.Plane>();

      int pt_cnt = 0;
      foreach(var t_val in t_vals){
        var crv_tan = w_crv.TangentAt(t_val);
        var crv_norm = Rhino.Geometry.Vector3d.CrossProduct(crv_tan, Rhino.Geometry.Vector3d.ZAxis);
        var pln = new Rhino.Geometry.Plane(w_crv.PointAt(t_val), crv_norm, Rhino.Geometry.Vector3d.ZAxis);
        var pt = pln.PointAt(-offset_step[pt_cnt], 0);
        pts.Add(pt);
        plns.Add(pln);
        tracks.Add(new Rhino.Geometry.Line(plns[pt_cnt].Origin, pt));
        pt_cnt++;
      }
      planes = plns;
      pts_out = pts;

      //reset start
      var str_pt = w_crv.PointAtStart;
      w_crv = Rhino.Geometry.Curve.CreatePeriodicCurve(Rhino.Geometry.Curve.CreateInterpolatedCurve(pts, 3));
      w_crv = w_crv.Rebuild(cnt / 4, 3, false);
      
      double str_t = 0;
      w_crv.ClosestPoint(str_pt, out str_t);
      w_crv.ChangeClosedCurveSeam(str_t);

      Rhino.Geometry.Intersect.CurveIntersections self_intersect = Rhino.Geometry.Intersect.Intersection.CurveSelf(w_crv, 0.01);

      if(self_intersect.Count > 0){
        List < double > tx = new List<double>();
        for(int ix = 0 ; ix < self_intersect.Count ; ix++){
          tx.Add(self_intersect[ix].ParameterA);
          tx.Add(self_intersect[ix].ParameterB);
          Print("intersection at: " + self_intersect[ix].ParameterA.ToString() + " and " + self_intersect[ix].ParameterB.ToString());
        }
        Rhino.Geometry.Curve[] crvs = w_crv.Split(tx);
        Print(crvs.Length.ToString());
        if(crvs.Length > 1){
          Print(crvs.Length.ToString());
          Print(crvs[0].ToString());
          Print(w_crv.ToString());
          Rhino.Geometry.Curve s_crv = crvs[0];
          for(int cr = 0 ; cr < crvs.Length ; cr++){
            if( crvs[cr].GetLength() > s_crv.GetLength()){
              s_crv = crvs[cr];
            }
          }
          s_crv = Rhino.Geometry.Curve.CreatePeriodicCurve(s_crv);
          s_crv = s_crv.Rebuild(cnt / 4, 3, false);


          //reset start
          str_pt = w_crv.PointAtStart;
          str_t = 0;
          s_crv.ClosestPoint(str_pt, out str_t);
          s_crv.ChangeClosedCurveSeam(str_t);

          w_crv = s_crv;
        }
      }
    }
    prev_crvs = crv_seq;
    offset_tracks = tracks;
    crv_out = w_crv;
# ---------- end offset2shoreline_2 ----------
crv_7 = Curve(offset2shoreline.crv_out)
pt = Point(offset2shoreline.pts_out)
crv_8 = Curve(item_2)
panel_2 = Panel(offset2shoreline.out)
crv_9 = Curve(offset2shoreline.prev_crvs)
lng = ListLength(List=crv_9)  # -> expr("x-1", Length)
item_3 = ListItem(List=offset2shoreline.prev_crvs, Index=0, Wrap=True)  # -> Item1, Item
range_2 = Range(Domain=Domain(0, 1), Steps=lng)
gradient = Gradient(LowerLimit=0, UpperLimit=1, Parameter=range_2, stops=[0.0572: RGB(192, 255, 255), 0.948: RGB(0, 128, 128)])
crv_10 = Curve(item_3.Item1)
preview = CustomPreview(Geometry=crv_10, Material=ColourSwatch(SwatchColor=RGB(137, 161, 50)))
swatch = ColourSwatch(SwatchColor=RGB(199, 242, 239))  # disabled
crv_11 = Curve(crv_7)
preview_2 = CustomPreview(Geometry=crv_9, Material=gradient)
cluster = Cluster(crv=crv_11)
preview_3 = CustomPreview(Geometry=crv_11, Material=ColourSwatch(SwatchColor=RGB(0, 37, 122)))
preview_4 = CustomPreview(Geometry=crv_8, Material=swatch)  # disabled
preview_5 = CustomPreview(Geometry=offset2shoreline.offset_tracks, Material=ColourSwatch(SwatchColor=RGB(150, 204, 124)))

# ==== cluster Cluster
crv = ClusterInput()
crv_2 = Curve(crv)
eval = EvaluateCurve(Curve=reparameterize(crv_2), Parameter=0.5)  # -> Point, Tangent, Angle
vdis = VectorDisplay(Anchor=eval.Point, Vector=eval.Tangent)
