# Grasshopper definition load shorelines_6.gh (Grasshopper 1.0.7)
# plug-ins: LunchBox

# ---- group: load from csv and bake
path = FilePath("D:\new_downloads\ukulhas_shorelines\")
path_2 = FilePath("D:\new_downloads\veyofushi_finolhu_shorelines\")
path_3 = FilePath("D:\new_downloads\Madhirivaadhoo_shorelines\")
c_script = CSharpScript(directory=path_3)  # -> A; inputs directory: String
# ---------- c_script: C# ----------
    string[] files = System.IO.Directory.GetFiles(directory, "*.csv", System.IO.SearchOption.AllDirectories);
    A = files;
# ---------- end c_script ----------
cluster = Cluster_4(F=c_script)  # -> flatten(crv_2)
cluster_2 = Cluster_5(T=c_script)
bake = ObjectBake(
    BakeToggle=Toggle(False),
    GeometryObjects=cluster,
    Layer="GH_Bake",
    ObjectName=cluster_2,
    ObjectColor=RGB(255, 255, 255),
    LayerColor=RGB(255, 255, 255))

# ---- group: load rhino crvs
crv = Curve([<curve referenced from the Rhino model> x2702])  # disabled
obj = CSharpScript(obj=crv)  # -> name; inputs obj: Guid; disabled; same code as obj
panel = Panel("_")  # disabled
split = TextSplit(Text=obj, Separators=panel)  # disabled
item = ListItem(List=split, Index=0, Wrap=True)  # -> Item, flatten(Item1); disabled
sort = SortList(Keys=item.Item1, ValuesA=crv)  # -> Keys, ValuesA; disabled
crv_2 = Curve(sort.ValuesA)  # disabled

# ---- group: load rhino poly lines and clean
crv_3 = Curve([<curve referenced from the Rhino model> x165])
load = Load(num="2", crv=crv_3)  # -> R, pt_3, bool_2
dispatch = Dispatch(List=crv_3, DispatchPattern=load.bool_2)  # -> ListA, ListB
sort_2 = Sort(crv=dispatch.ListA)  # -> txt_2, flatten(crv_4)
crv_4 = Curve(dispatch.ListA)
crv_5 = Curve(dispatch.ListB)
txt = Text(sort_2.txt_2)
crv_6 = Curve(sort_2.crv_4)

# ----
cluster_3 = Cluster_3(crv=sort_2.crv_4, num="2")  # -> crv_5, crv_6
panel_2 = Panel(txt)
crv_7 = Curve(cluster_3.crv_6)
item_2 = ListItem(List=c_script, Index=Slider(18, range=0..61), Wrap=True)
panel_3 = Panel("10")  # disabled
crv_8 = Curve([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])  # disabled
split_2 = SplitList(List=crv_8, Index=panel_3)  # -> ListA, ListB; disabled
crv_9 = Curve(crv_8)  # disabled
lng = ListLength(List=crv_9)  # disabled
panel_4 = Panel("7")  # disabled
toggle = BooleanToggle(True)  # disabled
panel_5 = Panel("200")  # disabled
panel_6 = Panel("G:\My Drive\tspdb_sync\shoreline_offsets.csv")
panel_7 = Panel("D:\Github\littoral\toy_island\island_cycle.csv")
number_slider = Slider(80, range=0..3001)
panel_8 = Panel("d")
file = ReadFile(File=panel_6, PerLineParse=True)
split_3 = TextSplit(Text=file, Separators=",")
item_3 = ListItem(List=split_3, Index=0, Wrap=True)  # -> flatten(Item)
mindex = MemberIndex(Set=item_3, Member="04/30/2021 00:00:00")  # -> Index, Count
file_2 = ReadFile(File="G:\My Drive\tspdb_sync\toy_island_act.csv", PerLineParse=True)
file_3 = ReadFile(File="G:\My Drive\tspdb_sync\toy_island_pred.csv", PerLineParse=True)
split_4 = SplitList(List=file, Index=mindex.Index)  # -> flatten(ListA), ListB
split_5 = SplitList(List=file_2, Index=1)  # -> flatten(ListA), ListB
split_6 = SplitList(List=file_3, Index=1)  # -> flatten(ListA), ListB
addition = Addition(A=mindex.Index, B=number_slider)
split_7 = SplitList(List=split_6.ListB, Index=number_slider)  # -> flatten(ListA), ListB
txt_2 = Text([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])
split_8 = SplitList(List=split_5.ListB, Index=number_slider)  # -> flatten(ListA), ListB
split_9 = SplitList(List=split_4.ListB, Index=number_slider)  # -> flatten(ListA), ListB
item_4 = ListItem(List=crv_9, Index=mindex.Index, Wrap=True)
item_5 = ListItem(List=crv_9, Index=addition, Wrap=True)
split_10 = TextSplit(Text=split_7.ListA, Separators=",")
split_11 = TextSplit(Text=split_9.ListA, Separators=",")
split_12 = TextSplit(Text=split_8.ListA, Separators=",")
panel_9 = Panel(txt_2)
split_13 = SplitList(List=split_10, Index=1)  # -> flatten(ListA), ListB
split_14 = SplitList(List=split_11, Index=1)  # -> flatten(ListA), simplify(ListB)
split_15 = SplitList(List=split_12, Index=1)  # -> flatten(ListA), simplify(ListB)
split_16 = SplitList(List=crv_9, Index=mindex.Index)  # -> ListA, ListB
split_17 = SplitList(List=split_16.ListB, Index=number_slider)  # -> ListA, ListB
item_6 = ListItem(List=crv_9, Index=0, Wrap=True)  # -> Item1, Item
split_18 = TextSplit(Text=panel_9, Separators=",")
crv_10 = Curve()
num = Number(split_18)
crv_11 = Curve(item_6.Item1)
crv_12 = Curve(item_6.Item)
shoreline2offset = CSharpScript(shorelines=crv_10, transect_count="200", reset_spacing=Toggle(True))  # -> out, offset_tracks, offsets_out, plns_out, preview; inputs shorelines: list of Curve, transect_count: Int32, reset_spacing: Boolean; disabled
# ---------- shoreline2offset: C# ----------
    if(shorelines.Count > 0){
      Rhino.Geometry.Curve start_crv = shorelines[0];

      //transect density
      int ptcnt = transect_count;

      //lists to track points
      List<Rhino.Geometry.Point3d> ref_pts = new List<Rhino.Geometry.Point3d>();
      List<Rhino.Geometry.Point3d> new_pts = new List<Rhino.Geometry.Point3d>();

      //outputs
      List<Rhino.Geometry.Line> tracks = new List<Rhino.Geometry.Line>();
      Grasshopper.DataTree<Double> offsets = new Grasshopper.DataTree<Double>();
      List<Rhino.Geometry.Point3d> prev_pts = new List<Rhino.Geometry.Point3d>();

      //get evenly spaced points for first curve
      for(int it = 0 ; it < ptcnt ; it++){
        double t = Convert.ToDouble(it) / Convert.ToDouble(ptcnt);
        ref_pts.Add(shorelines[0].PointAtNormalizedLength(t));
      }
      //create a smooth curve to get normals
      Rhino.Geometry.Curve w_crv = Rhino.Geometry.Curve.CreatePeriodicCurve(Rhino.Geometry.Curve.CreateInterpolatedCurve(ref_pts, 3));

      //cycle through shorelines
      for(int i = 1; i < shorelines.Count ; i++){
        List<Rhino.Geometry.Plane> plns = new List<Rhino.Geometry.Plane>();

        if(ref_pts.Count == ptcnt){
          //get evenly spaced points
          foreach(Rhino.Geometry.Point3d refpt in ref_pts){
            double wt = 0;
            w_crv.ClosestPoint(refpt, out wt, 0);
            var crv_tan = w_crv.TangentAt(wt);
            var crv_norm = Rhino.Geometry.Vector3d.CrossProduct(crv_tan, Rhino.Geometry.Vector3d.ZAxis);
            var pln = new Rhino.Geometry.Plane(w_crv.PointAt(wt), crv_norm, Rhino.Geometry.Vector3d.ZAxis);
            plns.Add(pln);
            Rhino.Geometry.Line ln = new Rhino.Geometry.Line(w_crv.PointAt(wt), new Rhino.Geometry.Point3d(w_crv.PointAt(wt) + crv_norm));
            Rhino.Geometry.Intersect.CurveIntersections CIs = Rhino.Geometry.Intersect.Intersection.CurveLine(shorelines[i], ln, 0.001, 0.001);

            //initialize int_pt as plane origin
            Rhino.Geometry.Point3d int_pt = pln.Origin;
            if(CIs.Count > 0){
              //if an intersection is found, use that as new point
              int_pt = CIs[0].PointA;
              if(CIs.Count > 1){
                double dist = pln.Origin.DistanceTo(CIs[0].PointA);//w_crv.PointAt(wt).DistanceTo(CIs[0].PointA);
                for(int ci = 1 ; ci < CIs.Count ; ci++){
                  if(dist > pln.Origin.DistanceTo(CIs[ci].PointA)){//w_crv.PointAt(wt).DistanceTo(CIs[ci].PointA)){
                    int_pt = CIs[ci].PointA;
                  }
                }

              }
            }else{
              //if no intersection was found set it as a point very far away
              int_pt = int_pt + new Rhino.Geometry.Point3d(1000000, 1000000, 1000000);
            }
            //calcultate neararest point. If the intersection did not work, use this point.
            double int_dist = pln.Origin.DistanceTo(int_pt);
            double nt = 0;
            shorelines[i].ClosestPoint(pln.Origin, out nt, 0);
            double cl_dist = pln.Origin.DistanceTo(shorelines[i].PointAt(nt));
            if(int_dist > cl_dist * 3){
              prev_pts.Add(int_pt);
              int_pt = shorelines[i].PointAt(nt);
              Print(CIs.Count.ToString());
            }

            //use ref plane to calculate offset
            Rhino.Geometry.Point3d pl_pt = new Rhino.Geometry.Point3d();
            pln.RemapToPlaneSpace(int_pt, out pl_pt);

            //save offsets as final output
            offsets.Add(pl_pt.X, new Grasshopper.Kernel.Data.GH_Path(i));

            //export points for visual inspection
            new_pts.Add(int_pt);
            //export tracks for visual inspection
            tracks.Add(new Rhino.Geometry.Line(refpt, int_pt));
          }
        }
        //optional reset the spacing
        ref_pts = new List<Rhino.Geometry.Point3d>();

        if(reset_spacing)
        {
          //update the smooth curve
          w_crv = Rhino.Geometry.Curve.CreatePeriodicCurve(Rhino.Geometry.Curve.CreateInterpolatedCurve(new_pts, 3));
          for(int it = 0 ; it < ptcnt ; it++){
            double t = Convert.ToDouble(it) / Convert.ToDouble(ptcnt);
            ref_pts.Add(w_crv.PointAtNormalizedLength(t));
          }
        }
        else
        {
          ref_pts.AddRange(new_pts);
        }
        new_pts = new List<Rhino.Geometry.Point3d>();

        plns_out = plns;
      }
      offset_tracks = tracks;
      offsets_out = offsets;
      preview = prev_pts;
    }
# ---------- end shoreline2offset ----------
offset2shoreline = CSharpScript(start_curve=item_6.Item, offsets=num)  # -> out, crv_out, offset_tracks, prev_crvs, planes, pts_out; inputs start_curve: Curve, offsets: tree of Double
# ---------- offset2shoreline: C# ----------
    Rhino.Geometry.Curve w_crv = start_curve;

    List<Rhino.Geometry.Line> tracks = new List<Rhino.Geometry.Line>();
    List<Rhino.Geometry.Curve> crv_seq = new List<Rhino.Geometry.Curve>();

    for(int i = 0; i < offsets.BranchCount ; i++){
      tracks = new List<Rhino.Geometry.Line>();//clearing tracks list

      List<double> offset_step = offsets.Branch(i);
      int cnt = offset_step.Count;

      List<double> t_vals = new List<double>();
      //get evenly spaced points for first curve
      for(int it = 0 ; it < cnt ; it++){
        double t = Convert.ToDouble(it) / Convert.ToDouble(cnt);
        double tp = 0;
        w_crv.ClosestPoint(w_crv.PointAtNormalizedLength(t), out tp, 0);
        t_vals.Add(tp);
      }
      //var t_vals = w_crv.DivideByCount(cnt, true);

      crv_seq.Add(w_crv);

      List<Rhino.Geometry.Point3d> pts = new List<Rhino.Geometry.Point3d>();
      List<Rhino.Geometry.Plane> plns = new List<Rhino.Geometry.Plane>();

      int pt_cnt = 0;
      foreach(var t_val in t_vals){
        var crv_tan = w_crv.TangentAt(t_val);
        var crv_norm = Rhino.Geometry.Vector3d.CrossProduct(crv_tan, Rhino.Geometry.Vector3d.ZAxis);
        var pln = new Rhino.Geometry.Plane(w_crv.PointAt(t_val), crv_norm, Rhino.Geometry.Vector3d.ZAxis);
        var pt = pln.PointAt(offset_step[pt_cnt], 0);
        pts.Add(pt);
        plns.Add(pln);
        tracks.Add(new Rhino.Geometry.Line(plns[pt_cnt].Origin, pt));
        pt_cnt++;
      }
      planes = plns;
      pts_out = pts;

      //reset start
      var str_pt = w_crv.PointAtStart;
      w_crv = Rhino.Geometry.Curve.CreatePeriodicCurve(Rhino.Geometry.Curve.CreateInterpolatedCurve(pts, 3));
      w_crv = w_crv.Rebuild(cnt / 4, 3, false);

      double str_t = 0;
      w_crv.ClosestPoint(str_pt, out str_t);
      w_crv.ChangeClosedCurveSeam(str_t);

      Rhino.Geometry.Intersect.CurveIntersections self_intersect = Rhino.Geometry.Intersect.Intersection.CurveSelf(w_crv, 0.01);

      if(self_intersect.Count > 0){
        List < double > tx = new List<double>();
        for(int ix = 0 ; ix < self_intersect.Count ; ix++){
          tx.Add(self_intersect[ix].ParameterA);
          tx.Add(self_intersect[ix].ParameterB);
          Print("intersection at: " + self_intersect[ix].ParameterA.ToString() + " and " + self_intersect[ix].ParameterB.ToString());
        }
        Rhino.Geometry.Curve[] crvs = w_crv.Split(tx);
        Print(crvs.Length.ToString());
        if(crvs.Length > 1){
          Print(crvs.Length.ToString());
          Print(crvs[0].ToString());
          Print(w_crv.ToString());
          Rhino.Geometry.Curve s_crv = crvs[0];
          for(int cr = 0 ; cr < crvs.Length ; cr++){
            if( crvs[cr].GetLength() > s_crv.GetLength()){
              s_crv = crvs[cr];
            }
          }
          s_crv = Rhino.Geometry.Curve.CreatePeriodicCurve(s_crv);
          s_crv = s_crv.Rebuild(cnt / 4, 3, false);


          //reset start
          str_pt = w_crv.PointAtStart;
          str_t = 0;
          s_crv.ClosestPoint(str_pt, out str_t);
          s_crv.ChangeClosedCurveSeam(str_t);

          w_crv = s_crv;
        }
      }
    }
    prev_crvs = crv_seq;
    offset_tracks = tracks;
    crv_out = w_crv;
# ---------- end offset2shoreline ----------
crv_13 = Curve(offset2shoreline.prev_crvs)
item_7 = ListItem(List=crv_10, Index=0, Wrap=True)
lng_2 = ListLength(List=crv_13)  # -> expr("x-1", Length)
range = Range(Domain=Domain(0, 1), Steps=lng_2)
gradient = Gradient(LowerLimit=0, UpperLimit=1, Parameter=range, stops=[0.0572: RGB(192, 255, 255), 0.948: RGB(0, 128, 128)])
offset2shoreline_2 = CSharpScript(start_curve=item_7, offsets=shoreline2offset.offsets_out)  # -> out, crv_out, offset_tracks, prev_crvs, planes, pts_out; inputs start_curve: Curve, offsets: tree of Double; same code as offset2shoreline
offset2shoreline_3 = CSharpScript(start_curve=item_7, offsets=shoreline2offset.offsets_out)  # -> out, crv_out, offset_tracks, last_crv, prev_crvs, planes, pts_out; inputs start_curve: Curve, offsets: tree of Double; disabled
# ---------- offset2shoreline_3: C# ----------
    Rhino.Geometry.Curve w_crv = start_curve;

    List<Rhino.Geometry.Line> tracks = new List<Rhino.Geometry.Line>();
    List<Rhino.Geometry.Curve> crv_seq = new List<Rhino.Geometry.Curve>();

    for(int i = 0; i < offsets.BranchCount ; i++){
      tracks = new List<Rhino.Geometry.Line>();//clearing tracks list

      List<double> offset_step = offsets.Branch(i);
      int cnt = offset_step.Count;
      var t_vals = w_crv.DivideByCount(cnt, true);
      crv_seq.Add(w_crv);

      List<Rhino.Geometry.Point3d> pts = new List<Rhino.Geometry.Point3d>();
      List<Rhino.Geometry.Plane> plns = new List<Rhino.Geometry.Plane>();

      int pt_cnt = 0;
      foreach(var t_val in t_vals){
        var crv_tan = w_crv.TangentAt(t_val);
        var crv_norm = Rhino.Geometry.Vector3d.CrossProduct(crv_tan, Rhino.Geometry.Vector3d.ZAxis);
        var pln = new Rhino.Geometry.Plane(w_crv.PointAt(t_val), crv_norm, Rhino.Geometry.Vector3d.ZAxis);
        var pt = pln.PointAt(-offset_step[pt_cnt], 0);
        pts.Add(pt);
        plns.Add(pln);
        tracks.Add(new Rhino.Geometry.Line(plns[pt_cnt].Origin, pt));
        pt_cnt++;
      }
      planes = plns;
      pts_out = pts;

      //reset start
      var str_pt = w_crv.PointAtStart;
      w_crv = Rhino.Geometry.Curve.CreatePeriodicCurve(Rhino.Geometry.Curve.CreateInterpolatedCurve(pts, 3));
      w_crv = w_crv.Rebuild(cnt / 4, 3, false);
      
      double str_t = 0;
      w_crv.ClosestPoint(str_pt, out str_t);
      w_crv.ChangeClosedCurveSeam(str_t);

      Rhino.Geometry.Intersect.CurveIntersections self_intersect = Rhino.Geometry.Intersect.Intersection.CurveSelf(w_crv, 0.01);

      if(self_intersect.Count > 0){
        List < double > tx = new List<double>();
        for(int ix = 0 ; ix < self_intersect.Count ; ix++){
          tx.Add(self_intersect[ix].ParameterA);
          tx.Add(self_intersect[ix].ParameterB);
          Print("intersection at: " + self_intersect[ix].ParameterA.ToString() + " and " + self_intersect[ix].ParameterB.ToString());
        }
        Rhino.Geometry.Curve[] crvs = w_crv.Split(tx);
        Print(crvs.Length.ToString());
        if(crvs.Length > 1){
          Print(crvs.Length.ToString());
          Print(crvs[0].ToString());
          Print(w_crv.ToString());
          Rhino.Geometry.Curve s_crv = crvs[0];
          for(int cr = 0 ; cr < crvs.Length ; cr++){
            if( crvs[cr].GetLength() > s_crv.GetLength()){
              s_crv = crvs[cr];
            }
          }
          s_crv = Rhino.Geometry.Curve.CreatePeriodicCurve(s_crv);
          s_crv = s_crv.Rebuild(cnt / 4, 3, false);


          //reset start
          str_pt = w_crv.PointAtStart;
          str_t = 0;
          s_crv.ClosestPoint(str_pt, out str_t);
          s_crv.ChangeClosedCurveSeam(str_t);

          w_crv = s_crv;
        }
      }
    }
    prev_crvs = crv_seq;
    offset_tracks = tracks;
    crv_out = w_crv;
# ---------- end offset2shoreline_3 ----------
crv_14 = Curve(offset2shoreline.crv_out)
preview = CustomPreview(Geometry=crv_14, Material=ColourSwatch(SwatchColor=RGB(0, 37, 122)))
cluster_4 = Cluster(crv=crv_14)
preview_2 = CustomPreview(Geometry=crv_13, Material=gradient)
preview_3 = CustomPreview(Geometry=offset2shoreline.offset_tracks, Material=ColourSwatch(SwatchColor=RGB(150, 204, 124)))
crv_15 = Curve(offset2shoreline_2.crv_out)
pt = Point(offset2shoreline_2.pts_out)
crv_16 = Curve(item_7)
panel_10 = Panel(offset2shoreline_2.out)
crv_17 = Curve(offset2shoreline_2.prev_crvs)
lng_3 = ListLength(List=crv_17)  # -> expr("x-1", Length)
item_8 = ListItem(List=offset2shoreline_2.prev_crvs, Index=0, Wrap=True)  # -> Item1, Item
range_2 = Range(Domain=Domain(0, 1), Steps=lng_3)
gradient_2 = Gradient(LowerLimit=0, UpperLimit=1, Parameter=range_2, stops=[0.0572: RGB(192, 255, 255), 0.948: RGB(0, 128, 128)])
crv_18 = Curve(item_8.Item1)
preview_4 = CustomPreview(Geometry=crv_18, Material=ColourSwatch(SwatchColor=RGB(137, 161, 50)))
swatch = ColourSwatch(SwatchColor=RGB(199, 242, 239))  # disabled
crv_19 = Curve(crv_15)
preview_5 = CustomPreview(Geometry=crv_17, Material=gradient_2)
cluster_5 = Cluster(crv=crv_19)
preview_6 = CustomPreview(Geometry=crv_19, Material=ColourSwatch(SwatchColor=RGB(0, 37, 122)))
preview_7 = CustomPreview(Geometry=crv_16, Material=swatch)  # disabled
preview_8 = CustomPreview(Geometry=offset2shoreline_2.offset_tracks, Material=ColourSwatch(SwatchColor=RGB(150, 204, 124)))

run = BooleanToggle(True)  # disabled

iterator = CSharpScript(count=lng, run=run)  # -> out, index; inputs count: Int32, run: Boolean; disabled
# ---------- iterator: C# ----------
    if(counter < count && run) {
      counter++;
      Print("Creating Panel: " + counter.ToString() + " of " + count.ToString());
      Component.ExpireSolution(true);
      index = counter - 1;
    }else{
      counter = 0;
      index = -1;
      Print("inactive");
    }
# ---------- iterator: C# additional code ----------
  int counter = 0;
# ---------- end iterator ----------

run_status = Panel(iterator.out)  # disabled

panel_11 = Panel(iterator.index)  # disabled
int = Integer(panel_11)  # disabled
shoreline2offset_2 = CSharpScript(shorelines=crv_9, transect_count=panel_5, reset_spacing=toggle, step=int)  # -> out, offsets_out; inputs shorelines: list of Curve, transect_count: Int32, reset_spacing: Boolean, step: Int32; disabled
# ---------- shoreline2offset_2: C# ----------
    if(shorelines.Count > 0){
      if(step > -1){

        //transect density
        int ptcnt = transect_count;

        //outputs
        List<Double> offsets = new List<Double>();

        if(ref_pts.Count < 1){
          //get evenly spaced points for first curve
          for(int it = 0 ; it < ptcnt ; it++){
            double t = Convert.ToDouble(it) / Convert.ToDouble(ptcnt);
            ref_pts.Add(shorelines[step].PointAtNormalizedLength(t));
          }
        }
        //create a smooth curve to get normals
        Rhino.Geometry.Curve w_crv = Rhino.Geometry.Curve.CreatePeriodicCurve(Rhino.Geometry.Curve.CreateInterpolatedCurve(ref_pts, 3));

        List<Rhino.Geometry.Plane> plns = new List<Rhino.Geometry.Plane>();

        if(ref_pts.Count == ptcnt){
          //get evenly spaced points
          foreach(Rhino.Geometry.Point3d refpt in ref_pts){
            double wt = 0;
            w_crv.ClosestPoint(refpt, out wt, 0);
            var crv_tan = w_crv.TangentAt(wt);
            var crv_norm = Rhino.Geometry.Vector3d.CrossProduct(crv_tan, Rhino.Geometry.Vector3d.ZAxis);
            var pln = new Rhino.Geometry.Plane(w_crv.PointAt(wt), crv_norm, Rhino.Geometry.Vector3d.ZAxis);
            plns.Add(pln);
            Rhino.Geometry.Line ln = new Rhino.Geometry.Line(w_crv.PointAt(wt), new Rhino.Geometry.Point3d(w_crv.PointAt(wt) + crv_norm));
            Rhino.Geometry.Intersect.CurveIntersections CIs = Rhino.Geometry.Intersect.Intersection.CurveLine(shorelines[step + 1], ln, 0.001, 0.001);

            //initialize int_pt as plane origin
            Rhino.Geometry.Point3d int_pt = pln.Origin;
            if(CIs.Count > 0){
              //if an intersection is found, use that as new point
              int_pt = CIs[0].PointA;
              if(CIs.Count > 1){
                double dist = pln.Origin.DistanceTo(CIs[0].PointA);//w_crv.PointAt(wt).DistanceTo(CIs[0].PointA);
                for(int ci = 1 ; ci < CIs.Count ; ci++){
                  if(dist > pln.Origin.DistanceTo(CIs[ci].PointA)){//w_crv.PointAt(wt).DistanceTo(CIs[ci].PointA)){
                    int_pt = CIs[ci].PointA;
                  }
                }

              }
            }else{
              //if no intersection was found set it as a point very far away
              int_pt = int_pt + new Rhino.Geometry.Point3d(1000000, 1000000, 1000000);
            }
            //calcultate neararest point. If the intersection did not work, use this point.
            double int_dist = pln.Origin.DistanceTo(int_pt);
            double nt = 0;
            shorelines[step + 1].ClosestPoint(pln.Origin, out nt, 0);
            double cl_dist = pln.Origin.DistanceTo(shorelines[step + 1].PointAt(nt));
            if(int_dist > cl_dist * 3){
              int_pt = shorelines[step + 1].PointAt(nt);
              Print(CIs.Count.ToString());
            }

            //use ref plane to calculate offset
            Rhino.Geometry.Point3d pl_pt = new Rhino.Geometry.Point3d();
            pln.RemapToPlaneSpace(int_pt, out pl_pt);

            //save offsets as final output
            offsets.Add(pl_pt.X);

            //export points for visual inspection
            new_pts.Add(int_pt);
          }
        }
        offsets_out = offsets;

        //optional reset the spacing
        ref_pts = new List<Rhino.Geometry.Point3d>();

        if(reset_spacing)
        {
          //update the smooth curve
          w_crv = Rhino.Geometry.Curve.CreatePeriodicCurve(Rhino.Geometry.Curve.CreateInterpolatedCurve(new_pts, 3));
          for(int it = 0 ; it < ptcnt ; it++){
            double t = Convert.ToDouble(it) / Convert.ToDouble(ptcnt);
            ref_pts.Add(w_crv.PointAtNormalizedLength(t));
          }
        }
        else
        {
          ref_pts.AddRange(new_pts);
        }
        //reset new_pts for next cycle
        new_pts = new List<Rhino.Geometry.Point3d>();
        Print(new_pts.ToString());
      }else{
        //reset ref_pts once sequence is complete
        ref_pts = new List<Rhino.Geometry.Point3d>();
        new_pts = new List<Rhino.Geometry.Point3d>();
        Print("resetting points");
      }
    }
# ---------- shoreline2offset_2: C# additional code ----------
  //lists to track points
  List<Rhino.Geometry.Point3d> ref_pts = new List<Rhino.Geometry.Point3d>();
  List<Rhino.Geometry.Point3d> new_pts = new List<Rhino.Geometry.Point3d>();
# ---------- end shoreline2offset_2 ----------
panel_12 = Panel(shoreline2offset_2.out)
join = TextJoin(Text=shoreline2offset_2.offsets_out, Join=",")  # -> flatten(Result)
larger = LargerThan(FirstNumber=panel_11, SecondNumber=-1)  # -> LargerThan, OrEqualTo
filter = StreamFilter(Gate=larger.LargerThan, Stream1=join)
rec = DataRecorder(filter, DataLimit=-10, RecordData=True)
len = TextLength(Text=rec)
cull = CullPattern(List=rec, CullPattern=len)
clean = CleanTree(RemoveNulls=True, RemoveInvalid=True, RemoveEmpty=True, Tree=flatten(cull))  # disabled
cluster_6 = Cluster_2(start_time="2015-06-01", txt=clean)
c_script_2 = CSharpScript(data=cluster_6, path=panel_6, save=Toggle(False))  # -> out; inputs data: list of String, path: String, save: Boolean
# ---------- c_script_2: C# ----------
    if(save){
      using (var file = System.IO.File.CreateText(path))
      {
        foreach(var arr in data)
        {
          file.WriteLine(string.Join(",", arr));
        }
      }
    }
# ---------- end c_script_2 ----------
panel_13 = Panel(c_script_2)
txt_3 = Text(clean)
split_19 = SplitList(List=clean, Index=mindex.Index)  # -> flatten(ListA), ListB
split_20 = SplitList(List=split_19.ListB, Index=number_slider)  # -> flatten(ListA), ListB
split_21 = TextSplit(Text=split_20.ListA, Separators=",")  # -> simplify(Result)
offset2shoreline_4 = CSharpScript(start_curve=item_4, offsets=split_21)  # -> out, crv_out, offset_tracks, prev_crvs, planes, pts_out; inputs start_curve: Curve, offsets: tree of Double; same code as offset2shoreline
crv_20 = Curve(offset2shoreline_4.prev_crvs)
lng_4 = ListLength(List=crv_20)  # -> expr("x-1", Length)
range_3 = Range(Domain=Domain(0, 1), Steps=lng_4)
gradient_3 = Gradient(LowerLimit=0, UpperLimit=1, Parameter=range_3, stops=[0.0572: RGB(192, 255, 255), 0.948: RGB(0, 128, 128)])
crv_21 = Curve(offset2shoreline_4.crv_out)
cluster_7 = Cluster(crv=crv_21)
preview_9 = CustomPreview(Geometry=crv_20, Material=gradient_3)
preview_10 = CustomPreview(Geometry=offset2shoreline_4.offset_tracks, Material=ColourSwatch(SwatchColor=RGB(150, 204, 124)))
preview_11 = CustomPreview(Geometry=crv_21, Material=ColourSwatch(SwatchColor=RGB(0, 37, 122)))

# ==== cluster Cluster
crv = ClusterInput()
crv_2 = Curve(crv)
eval = EvaluateCurve(Curve=reparameterize(crv_2), Parameter=0.5)  # -> Point, Tangent, Angle
vdis = VectorDisplay(Anchor=eval.Point, Vector=eval.Tangent)

# ==== cluster Cluster_2
txt = ClusterInput()
txt_2 = Text(txt)
start_time = ClusterInput()
lng = ListLength(List=txt_2)
c_script = CSharpScript(start_time=start_time, len=lng)  # -> graft(time_series); inputs len: Int32
# ---------- c_script: C# ----------
    List<DateTime> dates = new List<DateTime>();

    for(int i = 0 ; i < len ; i++){
      dates.Add(start_time.AddDays(i));
    }
    time_series = dates;
# ---------- end c_script ----------
txt_3 = Text(flatten(c_script))
split = TextSplit(Text=txt_3, Separators=" ")
item = ListItem(List=split, Index=0, Wrap=True)  # -> flatten(Item)
item_2 = ListItem(List=flatten(txt_2), Index=0, Wrap=True)
concat = Concatenate(FragmentA=item, FragmentB=" 00:00:00")
split_2 = TextSplit(Text=item_2, Separators=",")
lng_2 = ListLength(List=split_2)
series = Series(Start=1, Step=1, Count=lng_2)
txt_4 = Text(concat)
join = TextJoin(Text=series, Join=",")  # -> flatten(Result)
concat_2 = Concatenate(FragmentA=txt_4, FragmentB=",")
concat_3 = Concatenate(FragmentA=concat_2, FragmentB=txt_2)
concat_4 = Concatenate(FragmentA="time,", FragmentB=join)
merge = Merge(Data1=flatten(concat_4), Data2=flatten(concat_3))
R = ClusterOutput(merge)

# ==== cluster Cluster_3
num = ClusterInput()
crv = ClusterInput()
crv_2 = Curve(crv)
num_2 = Number(num)
panel = Panel(num_2)
pcol = PolylineCollapse(Polyline=crv_2, Tolerance=panel)  # -> Polyline, Count
redpline = Reduce(Polyline=pcol.Polyline, Tolerance=panel)  # -> Polyline, Reduction
explode = Explode(Curve=redpline.Polyline, Recursive=True)  # -> graft(Segments), Vertices
panel_2 = Panel(""".25
.75""")
eval = EvaluateCurve(Curve=reparameterize(explode.Segments), Parameter=panel_2)  # -> flatten(Point), Tangent, Angle
intcrv = Interpolate(Vertices=eval.Point, Degree=3, Periodic=True, KnotStyle=1)  # -> Curve, Length, Domain
crv_3 = Curve(redpline.Polyline)
crv_4 = Curve(intcrv.Curve)
crv_5 = ClusterOutput(crv_3)
crv_6 = ClusterOutput(crv_4)

# ==== cluster Load
crv = ClusterInput()
num = ClusterInput()
num_2 = Number(num)
crv_2 = Curve(crv)
pcen = PolygonCenter(Polyline=crv_2)  # -> CenterV, CenterE, CenterA
area = Area(Geometry=crv_2)  # -> Area, Centroid
pt = ConstructPoint(XCoordinate=area.Area, YCoordinate=0, ZCoordinate=0)
cullpt = CullDuplicates(Points=flatten(pcen.CenterV), Tolerance=5, CullMode=3)  # -> Points, Indices, Valence
cullpt_2 = CullDuplicates(Points=pt, Tolerance=10, CullMode=3)  # -> Points, Indices, Valence
sort = SortList(Keys=cullpt.Valence, ValuesA=cullpt.Points)  # -> Keys, reverse(ValuesA)
sort_2 = SortList(Keys=cullpt_2.Valence, ValuesA=cullpt_2.Points)  # -> Keys, reverse(ValuesA)
item = ListItem(List=sort.ValuesA, Index=0, Wrap=True)
item_2 = ListItem(List=sort_2.ValuesA, Index=0, Wrap=True)
dist = Distance(PointA=cullpt_2.Points, PointB=item_2)
dist_2 = Distance(PointA=cullpt.Points, PointB=item)
dist_3 = Distance(PointA=pcen.CenterV, PointB=item)
avr = Average(Input=dist)
avr_2 = Average(Input=dist_2)
dist_4 = Distance(PointA=pt, PointB=item_2)
multiplication = Multiplication(A=avr, B=num_2)
multiplication_2 = Multiplication(A=avr_2, B=num_2)
smaller = SmallerThan(FirstNumber=dist_3, SecondNumber=multiplication_2)  # -> SmallerThan, OrEqualTo
smaller_2 = SmallerThan(FirstNumber=dist_4, SecondNumber=multiplication)  # -> SmallerThan, OrEqualTo
R = ClusterOutput(multiplication_2)
and = GateAnd(A=smaller.SmallerThan, B=smaller_2.SmallerThan)
pt_2 = Point(item)
bool = Boolean(and)
bool_2 = ClusterOutput(bool)
pt_3 = ClusterOutput(pt_2)

# ==== cluster Cluster_4
F = ClusterInput()
file = ReadFile(File=F, PerLineParse=True)
split = TextSplit(Text=file, Separators=",")
item = ListItem(List=split, Index=0, Wrap=True)  # -> Item, Item1
multiplication = Multiplication(A=item.Item, B=-1)
pt = ConstructPoint(XCoordinate=item.Item1, YCoordinate=multiplication, ZCoordinate=0)  # -> simplify(Point)
path_mapper = PathMapper(pt, source=["{A}", "{A;B}"], target=["{0}", "{A}"])
pline = PolyLine(Vertices=path_mapper, Closed=True)
crv = Curve(pline)
crv_2 = ClusterOutput(crv)

# ==== cluster Cluster_5
T = ClusterInput()
split = TextSplit(Text=T, Separators="\")
item = ListItem(List=split, Index=0, Wrap=True)  # -> Item1, Item
split_2 = TextSplit(Text=item.Item1, Separators="RGB")
item_2 = ListItem(List=split_2, Index=0, Wrap=True)
rep = ReplaceText(Text=item_2, Find="_", RecursiveReplace=False)
rep_2 = ReplaceText(Text=rep, Find="-", RecursiveReplace=False)  # -> flatten(Result)
R = ClusterOutput(rep_2)

# ==== cluster Sort
crv = ClusterInput()
crv_2 = Curve(crv)
obj = CSharpScript(obj=crv_2)  # -> name; inputs obj: Guid
# ---------- obj: C# ----------
var the_obj = doc.Objects.Find(obj);

name = the_obj.Attributes.Name;
# ---------- end obj ----------
sort = SortList(Keys=obj, ValuesA=crv_2)  # -> Keys, ValuesA
txt = Text(sort.Keys)
txt_2 = ClusterOutput(txt)
crv_3 = Curve(sort.ValuesA)
crv_4 = ClusterOutput(crv_3)
