# Grasshopper definition load shorelines_PancakeEmergency.gh (Grasshopper 1.0.7)
# plug-ins: LunchBoxML

path = FilePath("D:\Github\CoastSat\data\Madhirivaadhoo\Madhirivaadhoo_output.csv")
panel = Panel(path)
panel_2 = Panel("D:\Github\CoastSat\data\dharavandhoo\dharavandhoo_output.csv")
file = ReadFile(File=panel_2, PerLineParse=True)
split = SplitList(List=file, Index=1)  # -> ListA, ListB
item = ListItem(List=split.ListB, Index=0, Wrap=True)  # -> Item1, Item
split_2 = TextSplit(Text=split.ListB, Separators=",")
split_3 = TextSplit(Text=split.ListB, Separators=",")
split_4 = TextSplit(Text=item.Item1, Separators=",")
split_5 = TextSplit(Text=item.Item, Separators=",")
split_6 = SplitList(List=split_2, Index=1)  # -> ListA, ListB
item_2 = ListItem(List=split_3, Index=0, Wrap=True)  # -> flatten(Item)
split_7 = SplitList(List=split_4, Index=1)  # -> ListA, ListB
split_8 = SplitList(List=split_5, Index=1)  # -> ListA, ListB
rep = ReplaceText(Text=split_6.ListB, Find="[", RecursiveReplace=False)
panel_3 = Panel(split_8.ListA)
panel_4 = Panel(item_2)
rep_2 = ReplaceText(Text=rep, Find="]", RecursiveReplace=False)
trim = TextTrim(Text=rep_2, Start=True, End=True)
split_9 = TextSplit(Text=trim, Separators=" ")
len = TextLength(Text=split_9)
bool = Boolean(len)
cull = CullPattern(List=split_9, CullPattern=bool)
num2pt = NumbersToPoints(Numbers=cull, Mask=2)  # -> simplify(Points)
path_mapper = PathMapper(num2pt, source="{A;B}", target="{A}")
pt = Point(path_mapper)
crv = Curve(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)
pline = PolyLine(Vertices=path_mapper, Closed=True)
pline_2 = PolyLine(Vertices=path_mapper, Closed=False)
divide = DivideCurve(Curve=crv, Count=100, Kinks=False)  # -> graft(Points), Tangents, Parameters
explode = Explode(Curve=pline, Recursive=True)  # -> Segments, Vertices
crv_cp = CurveClosestPoint(Point=divide.Points, Curve=flatten(pline_2))  # -> Point, Parameter, Distance
len_2 = Length(Curve=explode.Segments)
smaller = SmallerThan(FirstNumber=crv_cp.Distance, SecondNumber="25")  # -> SmallerThan, OrEqualTo
sort = SortList(Keys=len_2)  # -> reverse(Keys), ValuesA
viewer = ParamViewer(pline)
cull_2 = CullPattern(List=crv_cp.Point, CullPattern=smaller.SmallerThan)
item_3 = ListItem(List=sort.Keys, Index=0, Wrap=True)
lng = ListLength(List=viewer)
avr = Average(Input=cull_2)  # -> flatten(ArithmeticMean)
intcrv = Interpolate(Vertices=avr, Degree=3, Periodic=True, KnotStyle=1)  # -> Curve, Length, Domain
reb = RebuildCurve(Curve=intcrv.Curve, Count=40, Tangents=False)
larger = LargerThan(FirstNumber=item_3, SecondNumber="100")  # -> simplify(LargerThan), OrEqualTo
dispatch = Dispatch(List=pline, DispatchPattern=larger.LargerThan)  # -> ListA, simplify(ListB)
lng_2 = ListLength(List=flatten(dispatch.ListB))
viewer_2 = ParamViewer(dispatch.ListB)
series = Series(Start=0, Step=1, Count=lng_2)
divide_2 = DivideCurve(Curve=reb, Count=200, Kinks=False)  # -> flatten(Points), Tangents, Parameters
series_2 = Series(Start=0, Step="10", Count=lng)
intcrv_2 = Interpolate(Vertices=avr, Degree=3, Periodic=True, KnotStyle=1)  # -> Curve, Length, Domain
addition = Addition()
Z = UnitZ(Factor=series_2)  # -> graft(UnitVector)
gradient = Gradient(LowerLimit=0, UpperLimit=lng_2, Parameter=series, stops=[0.0941: RGB(192, 192, 255), 0.884: RGB(220, 0, 40)])
crv_cp_2 = CurveClosestPoint(Point=divide_2.Points, Curve=dispatch.ListB)  # -> Point, Parameter, Distance
averaged_boundary = Curve(intcrv_2.Curve)
move = Move(Geometry=pline_2, Motion=Z)  # -> Geometry, Transform
move_2 = Move(Geometry=pline, Motion=Z)  # -> Geometry, Transform
move_3 = Move(Geometry=crv_cp_2.Point, Motion=simplify(Z))  # -> Geometry, Transform
dispatch_2 = Dispatch(List=move_2.Transform, DispatchPattern=larger.LargerThan)  # -> ListA, ListB
dispatch_3 = Dispatch(List=move.Geometry, DispatchPattern=larger.LargerThan)  # -> ListA, ListB
dispatch_4 = Dispatch(List=move_2.Geometry, DispatchPattern=larger.LargerThan)  # -> ListA, ListB
flip = FlipMatrix(Data=move_3.Geometry)
crv_2 = Curve(dispatch_3.ListA)
crv_3 = Curve(dispatch_4.ListB)
fit = FitCurve(Curve=crv_3)
crv_4 = Curve(crv_3)
preview = CustomPreview(Geometry=flatten(crv_4), Material=gradient)
clean = CleanTree(RemoveNulls=True, RemoveInvalid=True, RemoveEmpty=True, Tree=crv_3)
viewer_3 = ParamViewer(clean)
branch = TreeBranch(Tree=dispatch_2.ListB, Path=viewer_3, MaintainPaths=True)
area = Area(Geometry=clean)  # -> flatten(Area), flatten(Centroid)
area_2 = Area(Geometry=averaged_boundary)  # -> flatten(Area), flatten(Centroid)
partition = PartitionList(List=flatten(crv_3), Size=180)
dom = ConstructDomain(DomainStart=0, DomainEnd=100)
dom_2 = ConstructDomain(DomainStart=100, DomainEnd=150)
pdecon = Deconstruct(Point=area.Centroid)  # -> XComponent, YComponent, ZComponent
bnd = Bounds(Numbers=area.Area)
bnd_2 = Bounds(Numbers=pdecon.ZComponent)
clean_2 = CleanTree(RemoveNulls=True, RemoveInvalid=True, RemoveEmpty=True, Tree=partition)
intcrv_3 = Interpolate(Vertices=flip, Degree=3, Periodic=False, KnotStyle=1)  # -> Curve, Length, Domain
dedomain = DeconstructDomain(Domain=bnd)  # -> Start, End
remap = RemapNumbers(Value=area.Area, Source=bnd, Target=dom_2)  # -> Mapped, Clipped
remap_2 = RemapNumbers(Value=pdecon.ZComponent, Source=bnd_2, Target=dom)  # -> Mapped, Clipped
area_3 = Area(Geometry=clean_2)  # -> flatten(Area), Centroid
pdecon_2 = Deconstruct(Point=flatten(area_3.Centroid))  # -> XComponent, YComponent, ZComponent
num = Number(remap.Mapped)
num_2 = Number(remap_2.Mapped)
divide_3 = DivideCurve(Curve=intcrv_3.Curve, Count=expr("x-1", lng), Kinks=False)  # -> Points, Tangents, Parameters
panel_5 = Panel(dedomain.End)
panel_6 = Panel(dedomain.Start)
pt_2 = ConstructPoint(XCoordinate=pdecon_2.XComponent, YCoordinate=pdecon_2.YComponent, ZCoordinate=0)
hull = ConvexHull(Points=flatten(area_3.Centroid), Plane=PlaneXY(0, 0, 0))  # -> Hull, HullZ, Indices
avr_2 = Average(Input=area_3.Centroid)
flip_2 = FlipMatrix(Data=divide_3.Points)
txt = Text(item_2)
pline_3 = PolyLine(Vertices=flatten(pt_2), Closed=False)
item_4 = ListItem(List=remap_2.Mapped, Index=0, Wrap=True)  # -> Item1, Item
boundary = BoundarySurfaces(Edges=hull.Hull)
pline_4 = PolyLine(Vertices=flip_2, Closed=True)  # -> flatten(Polyline)
lng_3 = ListLength(List=flatten(pline_4))
series_3 = Series(Start=0, Step=1, Count=lng_3)
gradient_2 = Gradient(LowerLimit=0, UpperLimit=lng_3, Parameter=series_3, stops=[0.0941: RGB(192, 192, 255), 0.884: RGB(220, 0, 40)])
merge = Merge(Data1=item_4.Item, Data2=item_4.Item1)
item_5 = ListItem(List=txt, Index=0, Wrap=True)
lng_4 = ListLength(List=txt)
linereg = LinearRegression(TestData=num_2, TrainingInputs=remap_2.Mapped, TrainingOutput=num, RandomSeed=5)
slr_sedidment_supply = CustomPreview(Geometry=pline_3, Material=ColourSwatch(SwatchColor=RGB(0, 81, 255)))
X = UnitX(Factor=-10000)
shift = ShiftList(List=pline_4, Shift=-1, Wrap=False)  # -> simplify(graft(List))
shift_2 = ShiftList(List=pline_4, Shift=1, Wrap=False)
panel_7 = Panel(item_5)
remap_3 = RemapNumbers(Value=linereg, Source=dom, Target=bnd)  # -> Mapped, Clipped
pdecon_3 = Deconstruct(Point=flatten(avr_2))  # -> XComponent, YComponent, ZComponent
pt_3 = ConstructPoint(XCoordinate=remap_2.Mapped, YCoordinate=num, ZCoordinate=0)
move_4 = Move(Geometry=pline_4, Motion=X)  # -> Geometry, Transform
preview_2 = CustomPreview(Geometry=flatten(move_4.Geometry), Material=gradient_2)
cp = ControlPoints(Curve=shift_2)  # -> simplify(Points), Weights, Knots
division = Division(A=area.Area, B=area_2.Area)
division_2 = Division(A=remap_3.Mapped, B=area_2.Area)
pt_4 = ConstructPoint(XCoordinate=pdecon_3.XComponent, YCoordinate=pdecon_3.YComponent, ZCoordinate=10)
c_script = CSharpScript(start_time=panel_7, len=lng_4)  # -> graft(time_series); inputs len: Int32
# ---------- c_script: C# ----------
    List<DateTime> dates = new List<DateTime>();

    for(int i = 0 ; i < len ; i++){
      dates.Add(start_time.AddDays(i));
    }
    time_series = dates;
# ---------- end c_script ----------
scale = Scale(Geometry=averaged_boundary, Center=area_2.Centroid, Factor=division)  # -> Geometry, Transform
scale_2 = Scale(Geometry=averaged_boundary, Center=area_2.Centroid, Factor=division_2)  # -> Geometry, Transform
pdecon_4 = Deconstruct(Point=cp.Points)  # -> XComponent, YComponent, ZComponent
dots = DotDisplay(Point=pt_4, Colour=ColourSwatch(SwatchColor=RGB(255, 0, 0)), Size=1)
project = Project(Geometry=shift, Plane=PlaneXY(0, 0, 0))  # -> simplify(Geometry), Transform
transform = Transform(Geometry=scale.Geometry, Transform=flatten(branch))  # -> flatten(Geometry)
transform_2 = Transform(Geometry=scale_2.Geometry, Transform=flatten(branch))  # -> flatten(Geometry)
pt_5 = ConstructPoint(XCoordinate=pdecon_4.XComponent, YCoordinate=pdecon_4.YComponent, ZCoordinate=0)
pt_6 = ConstructPoint(XCoordinate=num_2, YCoordinate=linereg, ZCoordinate=0)
txt_2 = Text(flatten(c_script))
slr_sedidment_supply_2 = CustomPreview(Geometry=boundary, Material=ColourSwatch(SwatchColor=RGB(38, 143, 255)))
loft = Loft(Curves=transform, Options={Adjust=False, Closed=False, LoftEnds=0, LoftSimp=0, LoftType=0, Rebuild=10, Refit=0.01})
loft_2 = Loft(Curves=transform_2, Options={Adjust=False, Closed=False, LoftEnds=0, LoftSimp=0, LoftType=0, Rebuild=10, Refit=0.01})
split_10 = TextSplit(Text=txt_2, Separators=" ")
crv_cp_3 = CurveClosestPoint(Point=pt_5, Curve=project.Geometry)  # -> simplify(Point), Parameter, simplify(Distance)
incurve = PointInCurve(Point=pt_5, Curve=project.Geometry)  # -> Relationship, Point
swatch = ColourSwatch(SwatchColor=RGB(255, 20, 20))
slr_sedidment_supply_3 = CustomPreview(Geometry=avr_2, Material=swatch)
pline_5 = PolyLine(Vertices=pt_3, Closed=False)
pline_6 = PolyLine(Vertices=pt_6, Closed=False)
item_6 = ListItem(List=split_10, Index=0, Wrap=True)  # -> flatten(Item)
slr_sedidment_supply_4 = CustomPreview(Geometry=pline_6, Material=swatch)
slr_sedidment_supply_5 = CustomPreview(Geometry=pline_5, Material=ColourSwatch(SwatchColor=RGB(20, 255, 255)))
concat = Concatenate(FragmentA=item_6, FragmentB=" 00:00:00")
expression = Expression(x=incurve.Relationship, y=crv_cp_3.Distance, Expression="if(x>0,y,-y)")
panel_8 = Panel(expression)
lng_5 = ListLength(List=panel_8)  # -> flatten(Length)
item_7 = ListItem(List=lng_5, Index=0, Wrap=True)
series_4 = Series(Start=0, Step=1, Count=item_7)
int = Integer(series_4)
concat_2 = Concatenate(FragmentA="T", FragmentB=int)
txt_3 = Text(concat)
merge_2 = Merge(Data1="time", Data2=flatten(concat_2))
concat_3 = Concatenate(FragmentA=txt_3, FragmentB=",")
join = TextJoin(Text=panel_8, Join=",")  # -> flatten(Result)
join_2 = TextJoin(Text=merge_2, Join=",")
concat_4 = Concatenate(FragmentA=concat_3, FragmentB=join)
merge_3 = Merge(Data1=flatten(join_2), Data2=flatten(concat_4))
c_script_2 = CSharpScript(data=merge_3, path="D:\Github\littoral\toy_island\dharavandhoo.csv", save=Toggle(False))  # -> out; inputs data: list of String, path: String, save: Boolean
# ---------- c_script_2: C# ----------
    if(save){
      using (var file = System.IO.File.CreateText(path))
      {
        foreach(var arr in data)
        {
          file.WriteLine(string.Join(",", arr));
        }
      }
    }
# ---------- end c_script_2 ----------
panel_9 = Panel(c_script_2)
