# Grasshopper definition load_shorelines_from_folder2.gh (Grasshopper 1.0.7)

run = BooleanToggle(False)
path = FilePath(graft("D:\new_downloads\2017-08-05-05-37-18_NIR.csv"))  # disabled
iterator = CSharpScript(count="5000", run=run)  # -> out, index; inputs count: Int32, run: Boolean
# ---------- iterator: C# ----------
    if(counter < count && run) {
      counter++;
      Print("Creating Panel: " + counter.ToString() + " of " + count.ToString());
      Component.ExpireSolution(true);
      index = counter - 1;
    }else{
      counter = 0;
      index = -1;
      Print("inactive");
    }
# ---------- iterator: C# additional code ----------
  int counter = 0;
# ---------- end iterator ----------
run_status = Panel(iterator.out)
merge = Merge(Data1=path, Data2=path)  # disabled
addition = Addition(A=iterator.index, B=2)
path_2 = FilePath("D:\new_downloads\countour-20241130T170645Z-001\countour\")
path_3 = FilePath("D:\new_downloads\output_mask_countours-20241113T204716Z-001\output_mask_countours\")
txt = Text(merge)  # disabled
file = ReadFile(File=txt, PerLineParse=True)  # disabled
cluster = Cluster_6(txt=path_2)  # -> crv_3, txt_5, crv_4
split = TextSplit(Text=file, Separators=",")  # disabled
number_slider = Slider(101, range=0..101)
non_closed_crvs = NonClosedCrvs(crv=cluster.crv_4)
non_closed_crvs_2 = NonClosedCrvs(crv=cluster.crv_3)
item = ListItem(List=split, Index=0, Wrap=True)  # -> simplify(Item), simplify(Item1); disabled
panel = Panel("6")
multiplication = Multiplication(A=item.Item1, B=-1)  # disabled
item_2 = ListItem(List=non_closed_crvs_2, Index=panel, Wrap=True)
cluster_2 = Cluster_4(crv=non_closed_crvs_2, ref_crv=item_2, num="25")
bool = Boolean(flatten(cluster_2))
cull = CullPattern(List=non_closed_crvs_2, CullPattern=bool)
cull_2 = CullPattern(List=non_closed_crvs, CullPattern=bool)
cull_3 = CullPattern(List=cluster.txt_5, CullPattern=bool)
distance_centroids = DistanceCentroids(G=cull_2, B="2")
cluster_3 = Cluster(crv=cull, txt=cull_3)  # -> crv_4, txt_4
int = Integer(addition)
cull_4 = CullPattern(List=cull, CullPattern=invert(distance_centroids))
cull_5 = CullPattern(List=cull_2, CullPattern=invert(distance_centroids))
cluster_4 = Cluster_3(crv=cluster_3.crv_4, txt=cluster_3.txt_4, int=int)
path_mapper = PathMapper(item.Item, source="{A;B}", target="{A}")  # disabled
path_mapper_2 = PathMapper(multiplication, source="{A;B}", target="{A}")  # disabled
pt = ConstructPoint(XCoordinate=path_mapper, YCoordinate=path_mapper_2, ZCoordinate=0)  # disabled
pline = PolyLine(Vertices=pt, Closed=True)  # -> flatten(Polyline); disabled
crv = Curve(pline)  # disabled
txt_2 = Text(txt)  # disabled
crv_2 = Curve(crv)  # disabled

# ==== cluster Cluster
crv = ClusterInput()
txt = ClusterInput()
crv_2 = Curve(crv)
txt_2 = Text(txt)
area = Area(Geometry=crv_2)  # -> Area, Centroid
avr = Average(Input=area.Area)
avr_2 = Average(Input=area.Centroid)
pdecon = Deconstruct(Point=avr_2)  # -> XComponent, YComponent, ZComponent
pdecon_2 = Deconstruct(Point=area.Centroid)  # -> XComponent, YComponent, ZComponent
pt = ConstructPoint(XCoordinate=pdecon.XComponent, YCoordinate=pdecon.YComponent, ZCoordinate=expr("x*2", avr))
pt_2 = ConstructPoint(XCoordinate=pdecon_2.XComponent, YCoordinate=pdecon_2.YComponent, ZCoordinate=expr("x*2", area.Area))
len = Length(Curve=crv_2)
dist = Distance(PointA=pt_2, PointB=pt)
avr_3 = Average(Input=len)
avr_4 = Average(Input=dist)
smaller = SmallerThan(FirstNumber=dist, SecondNumber=expr("x*.8", avr_4))  # -> SmallerThan, OrEqualTo
smaller_2 = SmallerThan(FirstNumber=len, SecondNumber=expr("x*1.2", avr_3))  # -> SmallerThan, OrEqualTo
and = GateAnd(A=smaller_2.SmallerThan, B=smaller.SmallerThan)
dispatch = Dispatch(List=crv_2, DispatchPattern=and)  # -> ListA, ListB
dispatch_2 = Dispatch(List=txt_2, DispatchPattern=and)  # -> ListA, ListB
crv_3 = Curve(dispatch.ListA)
txt_3 = Text(dispatch_2.ListA)
crv_4 = ClusterOutput(crv_3)
txt_4 = ClusterOutput(txt_3)

# ==== cluster Cluster_3
crv = ClusterInput()
int = ClusterInput()
txt = ClusterInput()
crv_2 = Curve(crv)
int_2 = Integer(int)
txt_2 = Text(txt)
panel = Panel("5")
cluster = Cluster_2(crv=crv_2)
crv_3 = Curve(cluster)
lng = ListLength(List=crv_3)
mod = Modulus(A=int_2, B=lng)
item = ListItem(List=txt_2, Index=mod, Wrap=True)
expression = Expression(x=mod, y=lng, Expression="if(x<y,x,y-1)")
item_2 = ListItem(List=crv_2, Index=int_2, Wrap=True)  # disabled
si = SelfIntersection(A=item_2)  # disabled
panel_2 = Panel(item)
crv_4 = Curve(si)  # disabled
len = Length(Curve=si)  # disabled
int_3 = Integer("15")
split = SplitList(List=crv_3, Index=expression)  # -> ListA, ListB
sort = SortList(Keys=len, ValuesA=crv_4)  # -> Keys, reverse(ValuesA); disabled
expression_2 = Expression(x=expression, y=int_3, Expression="if(x>y,y, x)")
item_3 = ListItem(List=sort.ValuesA, Index=0, Wrap=True)  # disabled
disc = Discontinuity(Curve=item_3, Level=1)  # -> Points, Parameters; disabled
crv_cp = CurveClosestPoint(Point=disc.Points, Curve=item_2)  # -> Point, Parameter, Distance; disabled
pline = PolyLine(Vertices=crv_cp.Point, Closed=True)  # disabled
split_2 = SplitList(List=split.ListB, Index=expression_2)  # -> ListA, ListB
smoothpline = SmoothPolyline(Polyline=pline, Strength=1, Times=1)  # disabled
divide = DivideCurve(Curve=split_2.ListA, Count=150, Kinks=False)  # -> Points, Tangents, Parameters
crv_5 = Curve(smoothpline)  # disabled
intcrv = Interpolate(Vertices=divide.Points, Degree=3, Periodic=True, KnotStyle=1)  # -> flatten(Curve), Length, Domain
crv_6 = Curve(intcrv.Curve)
lng_2 = ListLength(List=crv_6)  # -> expr("x-1", Length)
range = Range(Domain=Domain(0, 1), Steps=lng_2)
gradient = Gradient(LowerLimit=0, UpperLimit=1, Parameter=range, stops=[0: RGB(192, 255, 255), 1: RGB(0, 0, 128)])
item_4 = ListItem(List=crv_6, Index=0, Wrap=True)  # -> Item1, Item
boundary = BoundarySurfaces(Edges=item_4.Item1)
preview = CustomPreview(Geometry=boundary, Material=ColourSwatch(SwatchColor=RGBA(76, 75, 0, 59)))
preview_2 = CustomPreview(Geometry=crv_6, Material=gradient)

# ==== cluster Cluster_4
crv = ClusterInput()
num = ClusterInput()
ref_crv = ClusterInput()
crv_2 = Curve(simplify(graft(crv)))
num_2 = Number(num)
ref_crv_2 = Curve(ref_crv)
Z = UnitZ(Factor=1)
divide = DivideCurve(Curve=ref_crv_2, Count=50, Kinks=False)  # -> Points, Tangents, Parameters
xprod = CrossProduct(VectorA=Z, VectorB=divide.Tangents, Unitize=False)  # -> Vector, Length
pl = ConstructPlane(Origin=divide.Points, XAxis=xprod.Vector, YAxis=Z)  # -> flatten(Plane)
lng = ListLength(List=crv_2)
dup = DuplicateData(Data=flatten(divide.Points), Number=lng, Order=True)  # -> simplify(graft(Data))
pcx = CurvePlane(Curve=crv_2, Plane=pl)  # -> Points, ParamsC, ParamsP
cp = ClosestPoint(Point=dup, Cloud=pcx.Points)  # -> ClosestPoint, CPIndex, Distance
path_mapper = PathMapper(cp.Distance, source="{A;B}", target="{A}")
path_mapper_2 = PathMapper(cp.ClosestPoint, source="{A;B}", target="{A}")
sort = SortList(Keys=path_mapper, ValuesA=path_mapper_2)  # -> reverse(Keys), reverse(ValuesA)
item = ListItem(List=sort.Keys, Index=0, Wrap=True)
smaller = SmallerThan(FirstNumber=item, SecondNumber=num_2)  # -> SmallerThan, OrEqualTo
bool = Boolean(flatten(smaller.SmallerThan))
bool_2 = ClusterOutput(bool)

# ==== cluster Cluster_6
txt = ClusterInput()
panel = Panel("mask")
panel_2 = Panel("refined")
txt_2 = Text(txt)
c_script = CSharpScript(x=txt_2)  # -> out, A; inputs x: String
# ---------- c_script: C# ----------
    A = System.IO.Directory.GetFiles(x);
# ---------- end c_script ----------
txt_3 = Text(c_script.A)
split = TextSplit(Text=txt_3, Separators="_")
item = ListItem(List=split, Index=0, Wrap=True)  # -> Item1, Item, Item1_2
mindex = MemberIndex(Set=flatten(item.Item1), Member="rsl.csv")  # -> Index, Count
mindex_2 = MemberIndex(Set=flatten(item.Item1), Member="sl.csv")  # -> Index, Count
item_2 = ListItem(List=txt_3, Index=mindex.Index, Wrap=True)
item_3 = ListItem(List=txt_3, Index=mindex_2.Index, Wrap=True)
tsort = SortText(Keys=item_2, Culture=127)  # -> Keys, Values
tsort_2 = SortText(Keys=item_3, Culture=127)  # -> Keys, Values
cluster = Cluster_5(txt=tsort.Keys)  # -> crv_2, txt_4
cluster_2 = Cluster_5(txt=tsort_2.Keys)  # -> crv_2, txt_4
txt_4 = Text(cluster.txt_4)
crv = Curve(cluster.crv_2)
crv_2 = Curve(cluster_2.crv_2)
txt_5 = ClusterOutput(txt_4)
crv_3 = ClusterOutput(crv)
crv_4 = ClusterOutput(crv_2)

# ==== cluster NonClosedCrvs
crv = ClusterInput()
crv_2 = Curve(crv)
cls = Closed(Curve=crv_2)  # -> Closed, Periodic
cull = CullPattern(List=crv_2, CullPattern=cls.Closed)
area = Area(Geometry=cull)  # -> Area, Centroid
len = Length(Curve=cull)
larger = LargerThan(FirstNumber=area.Area, SecondNumber=len)  # -> LargerThan, OrEqualTo
cull_2 = CullPattern(List=cull, CullPattern=larger.LargerThan)
crv_3 = Curve(cull_2)
crv_4 = ClusterOutput(crv_3)

# ==== cluster DistanceCentroids
G = ClusterInput()
B = ClusterInput()
area = Area(Geometry=G)  # -> Area, Centroid
avr = Average(Input=area.Centroid)
dist = Distance(PointA=area.Centroid, PointB=avr)
avr_2 = Average(Input=dist)
multiplication = Multiplication(A=avr_2, B=B)
larger = LargerThan(FirstNumber=dist, SecondNumber=multiplication)  # -> LargerThan, OrEqualTo
larger_than = ClusterOutput(larger.LargerThan)

# ==== cluster Cluster_2
crv = ClusterInput()
crv_2 = Curve(crv)
redpline = Reduce(Polyline=crv_2, Tolerance=1)  # -> Polyline, Reduction
smoothpline = SmoothPolyline(Polyline=redpline.Polyline, Strength=1, Times=1)
crv_3 = Curve(smoothpline)
item = ListItem(List=crv_3, Index=0, Wrap=True)
merge = Merge(Data1=crv_3, Data2=item)
twnconcrvs = TweenConsecutiveCurves(Curves=merge, Factor=0.5, InterpolationType=0, Refit=0, PointSample=0)
weave = Weave(Pattern=[0, 1], Stream0=crv_3, Stream1=twnconcrvs, NullGaps=False)
item_2 = ListItem(List=weave, Index=0, Wrap=True)
merge_2 = Merge(Data1=weave, Data2=item_2)
twnconcrvs_2 = TweenConsecutiveCurves(Curves=merge_2, Factor=0.5, InterpolationType=0, Refit=0, PointSample=0)
weave_2 = Weave(Pattern=[0, 1], Stream0=weave, Stream1=twnconcrvs_2, NullGaps=False)
W = ClusterOutput(weave_2)

# ==== cluster Cluster_5
txt = ClusterInput()
txt_2 = Text(txt)
file = ReadFile(File=txt_2, PerLineParse=True)
split = TextSplit(Text=file, Separators=",")
item = ListItem(List=split, Index=0, Wrap=True)  # -> Item, simplify(Item1); disabled
num = Number(item.Item)  # disabled
item_2 = ListItem(List=split, Index=0, Wrap=True)  # -> simplify(Item), simplify(Item1)
bnd = Bounds(Numbers=flatten(item.Item))  # disabled
dedomain = DeconstructDomain(Domain=bnd)  # -> Start, End; disabled
multiplication = Multiplication(A=item_2.Item1, B=-1)
subtraction = Subtraction(A=dedomain.End, B=num)  # disabled
addition = Addition(A=dedomain.Start, B=subtraction)  # -> simplify(Result); disabled
path_mapper = PathMapper(item_2.Item, source="{A;B}", target="{A}")
path_mapper_2 = PathMapper(multiplication, source="{A;B}", target="{A}")
path_mapper_3 = PathMapper(item.Item1, source="{A;B}", target="{A}")  # disabled
path_mapper_4 = PathMapper(addition, source="{A;B}", target="{A}")  # disabled
pt = ConstructPoint(XCoordinate=path_mapper, YCoordinate=path_mapper_2, ZCoordinate=0)
pt_2 = ConstructPoint(XCoordinate=path_mapper_3, YCoordinate=path_mapper_4, ZCoordinate=0)  # disabled
pline = PolyLine(Vertices=pt, Closed=True)  # -> flatten(Polyline)
crv = Curve(pline)
txt_3 = Text(txt_2)
crv_2 = ClusterOutput(crv)
txt_4 = ClusterOutput(txt_3)
