# Grasshopper definition load_shorelines_from_folder3.gh (Grasshopper 1.0.7)

run = BooleanToggle(False)
path = FilePath(graft("D:\new_downloads\2017-08-05-05-37-18_NIR.csv"))  # disabled
iterator = CSharpScript(count="5000", run=run)  # -> out, index; inputs count: Int32, run: Boolean
# ---------- iterator: C# ----------
    if(counter < count && run) {
      counter++;
      Print("Creating Panel: " + counter.ToString() + " of " + count.ToString());
      Component.ExpireSolution(true);
      index = counter - 1;
    }else{
      counter = 0;
      index = -1;
      Print("inactive");
    }
# ---------- iterator: C# additional code ----------
  int counter = 0;
# ---------- end iterator ----------
run_status = Panel(iterator.out)
merge = Merge(Data1=path, Data2=path)  # disabled
addition = Addition(A=iterator.index, B=2)
path_2 = FilePath("D:\new_downloads\output_mask_countours-20241113T204716Z-001\output_mask_countours\")
path_3 = FilePath("D:\new_downloads\countour-20241130T170645Z-001\countour\")
path_4 = FilePath("D:\new_downloads\countour-20241204T170858Z-001\countour\")
path_5 = FilePath("D:\new_downloads\countour-20241203T005004Z-001\countour\")
path_6 = FilePath("D:\new_downloads\countour-20241203T025451Z-001\countour\")
txt = Text(merge)  # disabled
file = ReadFile(File=txt, PerLineParse=True)  # disabled
cluster = Cluster_7(txt=path_4)  # -> crv_3, txt_5, crv_4
split = TextSplit(Text=file, Separators=",")  # disabled
number_slider = Slider(101, range=0..101)
non_closed_crvs = NonClosedCrvs(crv=cluster.crv_4)
non_closed_crvs_2 = NonClosedCrvs(crv=cluster.crv_3)
item = ListItem(List=split, Index=0, Wrap=True)  # -> simplify(Item), simplify(Item1); disabled
panel = Panel("6")
multiplication = Multiplication(A=item.Item1, B=-1)  # disabled
item_2 = ListItem(List=non_closed_crvs_2, Index=panel, Wrap=True)
cluster_2 = Cluster_4(crv=non_closed_crvs_2, ref_crv=item_2, num="25")
path_mapper = PathMapper(item.Item, source="{A;B}", target="{A}")  # disabled
path_mapper_2 = PathMapper(multiplication, source="{A;B}", target="{A}")  # disabled
number_slider_2 = Slider(10, range=0..29)
bool = Boolean(flatten(cluster_2))
pt = ConstructPoint(XCoordinate=path_mapper, YCoordinate=path_mapper_2, ZCoordinate=0)  # disabled
cull = CullPattern(List=non_closed_crvs_2, CullPattern=bool)
cull_2 = CullPattern(List=non_closed_crvs, CullPattern=bool)
cull_3 = CullPattern(List=cluster.txt_5, CullPattern=bool)
pline = PolyLine(Vertices=pt, Closed=True)  # -> flatten(Polyline); disabled
cluster_3 = Cluster(crv=cull, txt=cull_3)  # -> crv_4, txt_4; disabled
int = Integer(addition)
distance_centroids = DistanceCentroids(G=cull_2, B="2")
cluster_4 = Cluster_3(crv=cluster_3.crv_4, txt=cluster_3.txt_4, int=int)  # disabled
crv = Curve(pline)  # disabled
txt_2 = Text(txt)  # disabled
crv_2 = Curve(crv)  # disabled
cull_4 = CullPattern(List=cull, CullPattern=invert(distance_centroids))
cull_5 = CullPattern(List=cull_3, CullPattern=invert(distance_centroids))
cull_6 = CullPattern(List=cull_2, CullPattern=invert(distance_centroids))
smoothpline = SmoothPolyline(Polyline=cull_4, Strength=1, Times=3)
cp = ControlPoints(Curve=smoothpline)  # -> Points, Weights, Knots
item_3 = ListItem(List=cull_4, Index=number_slider_2, Wrap=True)
item_4 = ListItem(List=cull_5, Index=number_slider_2, Wrap=True)
item_5 = ListItem(List=cull_6, Index=number_slider_2, Wrap=True)
intcrv = Interpolate(Vertices=cp.Points, Degree=3, Periodic=True, KnotStyle=1)  # -> flatten(Curve), Length, Domain
panel_2 = Panel(item_4)
item_6 = ListItem(List=intcrv.Curve, Index=0, Wrap=True)  # -> Item1, Item
merge_2 = Merge(Data1=item_6.Item, Data2=intcrv.Curve, Data3=item_6.Item1)
lng = ListLength(List=merge_2)
subtraction = Subtraction(A=lng, B="3")
series = Series(Start=0, Step=10, Count="4")
series_2 = Series(Start=0, Step=1, Count=subtraction)
series_3 = Series(Start=series_2, Step=1, Count="4")
multiplication_2 = Multiplication(A=series_3, B="10")
Z = UnitZ(Factor=multiplication_2)
item_7 = ListItem(List=merge_2, Index=series_3, Wrap=True)
move = Move(Geometry=item_7, Motion=Z)  # -> simplify(Geometry), Transform
Z_2 = UnitZ(Factor=series)
_4_input_curves = Curve(reparameterize(move.Geometry))
move_2 = Move(Geometry=item_7, Motion=Z_2)  # -> simplify(Geometry), Transform
_4_input_curves_2 = Curve(reparameterize(move_2.Geometry))
panel_3 = Panel("30")
panel_4 = Panel("""0
10
20
30""")
crv_3 = Curve(reparameterize(_4_input_curves_2))
days_in_set = Integer(panel_4)
item_8 = ListItem(List=days_in_set, Index=1, Wrap=True)  # -> Item, Item1
item_9 = ListItem(List=crv_3, Index=1, Wrap=True)
eval = EvaluateCurve(Curve=reparameterize(item_9), Parameter=0)  # -> Point, Tangent, Angle
crv_cp = CurveClosestPoint(Point=eval.Point, Curve=crv_3)  # -> Point, Parameter, Distance
addition_2 = Addition(A=item_8.Item, B=1)
subtraction_2 = Subtraction(A=item_8.Item1, B=item_8.Item)
seam = Seam(Curve=crv_3, Seam=crv_cp.Parameter)
series_4 = Series(Start=addition_2, Step=1, Count=subtraction_2)
divide = DivideCurve(Curve=seam, Count="200", Kinks=False)  # -> Points, Tangents, Parameters
pt_2 = ConstructPoint(XCoordinate=0, YCoordinate=0, ZCoordinate=series_4)
pt_3 = Point(graft(divide.Points))
pl = ConstructPlane(Origin=pt_2, XAxis=Vector(1, 0, 0), YAxis=Vector(0, 1, 0))  # -> flatten(Plane)
path_mapper_3 = PathMapper(pt_3, source="{A;B;C}", target="{A;C}")
intcrv_2 = Interpolate(Vertices=path_mapper_3, Degree=3, Periodic=False, KnotStyle=1)  # -> graft(Curve), Length, Domain
pcx = CurvePlane(Curve=intcrv_2.Curve, Plane=simplify(pl))  # -> Points, ParamsC, ParamsP
path_mapper_4 = PathMapper(pcx.Points, source="{A;B;C;D}", target="{A;D}")
intcrv_3 = Interpolate(Vertices=path_mapper_4, Degree=3, Periodic=True, KnotStyle=1)  # -> Curve, Length, Domain
path_mapper_5 = PathMapper(intcrv_3.Curve, source="{A;B}", target="{A}")
crv_4 = Curve(item_9)  # disabled
multiplication_3 = Multiplication(A=series_3, B="10")
merge_3 = Merge(Data1=crv_4, Data2=path_mapper_5)  # -> flatten(Result)
project = Project(Geometry=merge_3, Plane=PlaneXY(0, 0, 0))  # -> Geometry, Transform
lng_2 = ListLength(List=project.Geometry)
series_5 = Series(Start=0, Step=1, Count=lng_2)
Z_3 = UnitZ(Factor=series_5)
move_3 = Move(Geometry=project.Geometry, Motion=Z_3)  # -> simplify(Geometry), Transform
shift = ShiftList(List=move_3.Geometry, Shift=1, Wrap=False)
shift_2 = ShiftList(List=move_3.Geometry, Shift=-1, Wrap=False)
cluster_5 = Cluster_8(crv=project.Geometry, int=int)
rulesrf = RuledSurface(CurveA=shift, CurveB=shift_2)
preview = CustomPreview(Geometry=rulesrf, Material=ColourSwatch(SwatchColor=RGB(0, 255, 204)))

# ==== cluster Cluster
crv = ClusterInput()
txt = ClusterInput()
crv_2 = Curve(crv)
txt_2 = Text(txt)
area = Area(Geometry=crv_2)  # -> Area, Centroid
avr = Average(Input=area.Area)
avr_2 = Average(Input=area.Centroid)
pdecon = Deconstruct(Point=avr_2)  # -> XComponent, YComponent, ZComponent
pdecon_2 = Deconstruct(Point=area.Centroid)  # -> XComponent, YComponent, ZComponent
pt = ConstructPoint(XCoordinate=pdecon.XComponent, YCoordinate=pdecon.YComponent, ZCoordinate=expr("x*2", avr))
pt_2 = ConstructPoint(XCoordinate=pdecon_2.XComponent, YCoordinate=pdecon_2.YComponent, ZCoordinate=expr("x*2", area.Area))
len = Length(Curve=crv_2)
dist = Distance(PointA=pt_2, PointB=pt)
avr_3 = Average(Input=len)
avr_4 = Average(Input=dist)
smaller = SmallerThan(FirstNumber=dist, SecondNumber=expr("x*.8", avr_4))  # -> SmallerThan, OrEqualTo
smaller_2 = SmallerThan(FirstNumber=len, SecondNumber=expr("x*1.2", avr_3))  # -> SmallerThan, OrEqualTo
and = GateAnd(A=smaller_2.SmallerThan, B=smaller.SmallerThan)
dispatch = Dispatch(List=crv_2, DispatchPattern=and)  # -> ListA, ListB
dispatch_2 = Dispatch(List=txt_2, DispatchPattern=and)  # -> ListA, ListB
crv_3 = Curve(dispatch.ListA)
txt_3 = Text(dispatch_2.ListA)
crv_4 = ClusterOutput(crv_3)
txt_4 = ClusterOutput(txt_3)

# ==== cluster Cluster_3
crv = ClusterInput()
int = ClusterInput()
txt = ClusterInput()
crv_2 = Curve(crv)
int_2 = Integer(int)
txt_2 = Text(txt)
panel = Panel("5")
cluster = Cluster_2(crv=crv_2)
crv_3 = Curve(cluster)
lng = ListLength(List=crv_3)
mod = Modulus(A=int_2, B=lng)
item = ListItem(List=txt_2, Index=mod, Wrap=True)
expression = Expression(x=mod, y=lng, Expression="if(x<y,x,y-1)")
item_2 = ListItem(List=crv_2, Index=int_2, Wrap=True)  # disabled
si = SelfIntersection(A=item_2)  # disabled
panel_2 = Panel(item)
crv_4 = Curve(si)  # disabled
len = Length(Curve=si)  # disabled
int_3 = Integer("15")
split = SplitList(List=crv_3, Index=expression)  # -> ListA, ListB
sort = SortList(Keys=len, ValuesA=crv_4)  # -> Keys, reverse(ValuesA); disabled
expression_2 = Expression(x=expression, y=int_3, Expression="if(x>y,y, x)")
item_3 = ListItem(List=sort.ValuesA, Index=0, Wrap=True)  # disabled
disc = Discontinuity(Curve=item_3, Level=1)  # -> Points, Parameters; disabled
crv_cp = CurveClosestPoint(Point=disc.Points, Curve=item_2)  # -> Point, Parameter, Distance; disabled
pline = PolyLine(Vertices=crv_cp.Point, Closed=True)  # disabled
split_2 = SplitList(List=split.ListB, Index=expression_2)  # -> ListA, ListB
smoothpline = SmoothPolyline(Polyline=pline, Strength=1, Times=1)  # disabled
divide = DivideCurve(Curve=split_2.ListA, Count=150, Kinks=False)  # -> Points, Tangents, Parameters
crv_5 = Curve(smoothpline)  # disabled
intcrv = Interpolate(Vertices=divide.Points, Degree=3, Periodic=True, KnotStyle=1)  # -> flatten(Curve), Length, Domain
crv_6 = Curve(intcrv.Curve)
lng_2 = ListLength(List=crv_6)  # -> expr("x-1", Length)
range = Range(Domain=Domain(0, 1), Steps=lng_2)
gradient = Gradient(LowerLimit=0, UpperLimit=1, Parameter=range, stops=[0: RGB(192, 255, 255), 1: RGB(0, 0, 128)])
item_4 = ListItem(List=crv_6, Index=0, Wrap=True)  # -> Item1, Item
boundary = BoundarySurfaces(Edges=item_4.Item1)
preview = CustomPreview(Geometry=boundary, Material=ColourSwatch(SwatchColor=RGBA(76, 75, 0, 59)))
preview_2 = CustomPreview(Geometry=crv_6, Material=gradient)

# ==== cluster Cluster_4
crv = ClusterInput()
num = ClusterInput()
ref_crv = ClusterInput()
crv_2 = Curve(simplify(graft(crv)))
num_2 = Number(num)
ref_crv_2 = Curve(ref_crv)
Z = UnitZ(Factor=1)
divide = DivideCurve(Curve=ref_crv_2, Count=50, Kinks=False)  # -> Points, Tangents, Parameters
xprod = CrossProduct(VectorA=Z, VectorB=divide.Tangents, Unitize=False)  # -> Vector, Length
pl = ConstructPlane(Origin=divide.Points, XAxis=xprod.Vector, YAxis=Z)  # -> flatten(Plane)
lng = ListLength(List=crv_2)
dup = DuplicateData(Data=flatten(divide.Points), Number=lng, Order=True)  # -> simplify(graft(Data))
pcx = CurvePlane(Curve=crv_2, Plane=pl)  # -> Points, ParamsC, ParamsP
cp = ClosestPoint(Point=dup, Cloud=pcx.Points)  # -> ClosestPoint, CPIndex, Distance
path_mapper = PathMapper(cp.Distance, source="{A;B}", target="{A}")
path_mapper_2 = PathMapper(cp.ClosestPoint, source="{A;B}", target="{A}")
sort = SortList(Keys=path_mapper, ValuesA=path_mapper_2)  # -> reverse(Keys), reverse(ValuesA)
item = ListItem(List=sort.Keys, Index=0, Wrap=True)
smaller = SmallerThan(FirstNumber=item, SecondNumber=num_2)  # -> SmallerThan, OrEqualTo
bool = Boolean(flatten(smaller.SmallerThan))
bool_2 = ClusterOutput(bool)

# ==== cluster Cluster_7
txt = ClusterInput()
panel = Panel("mask")
panel_2 = Panel("refined")
txt_2 = Text(txt)
c_script = CSharpScript(x=txt_2)  # -> out, A; inputs x: String
# ---------- c_script: C# ----------
    A = System.IO.Directory.GetFiles(x);
# ---------- end c_script ----------
txt_3 = Text(c_script.A)
split = TextSplit(Text=txt_3, Separators="_")
item = ListItem(List=split, Index=0, Wrap=True)  # -> Item1, Item, Item1_2
mindex = MemberIndex(Set=flatten(item.Item1), Member="rsl.csv")  # -> Index, Count
mindex_2 = MemberIndex(Set=flatten(item.Item1), Member="sl.csv")  # -> Index, Count
item_2 = ListItem(List=txt_3, Index=mindex.Index, Wrap=True)
item_3 = ListItem(List=txt_3, Index=mindex_2.Index, Wrap=True)
tsort = SortText(Keys=item_2, Culture=127)  # -> Keys, Values
tsort_2 = SortText(Keys=item_3, Culture=127)  # -> Keys, Values
cluster = Cluster_6(txt=tsort.Keys)  # -> crv_2, txt_4
cluster_2 = Cluster_5(txt=tsort.Keys)  # -> crv_2, txt_4
cluster_3 = Cluster_5(txt=tsort_2.Keys)  # -> crv_2, txt_4
txt_4 = Text(cluster.txt_4)
crv = Curve(cluster.crv_2)
crv_2 = Curve(cluster_3.crv_2)
txt_5 = ClusterOutput(txt_4)
crv_3 = ClusterOutput(crv)
crv_4 = ClusterOutput(crv_2)

# ==== cluster NonClosedCrvs
crv = ClusterInput()
crv_2 = Curve(crv)
cls = Closed(Curve=crv_2)  # -> Closed, Periodic
cull = CullPattern(List=crv_2, CullPattern=cls.Closed)
area = Area(Geometry=cull)  # -> Area, Centroid
len = Length(Curve=cull)
larger = LargerThan(FirstNumber=area.Area, SecondNumber=len)  # -> LargerThan, OrEqualTo
cull_2 = CullPattern(List=cull, CullPattern=larger.LargerThan)
crv_3 = Curve(cull_2)
crv_4 = ClusterOutput(crv_3)

# ==== cluster DistanceCentroids
G = ClusterInput()
area = Area(Geometry=G)  # -> Area, Centroid
avr = Average(Input=area.Centroid)
dist = Distance(PointA=area.Centroid, PointB=avr)
B = ClusterInput()
avr_2 = Average(Input=dist)
multiplication = Multiplication(A=avr_2, B=B)
larger = LargerThan(FirstNumber=dist, SecondNumber=multiplication)  # -> LargerThan, OrEqualTo
larger_than = ClusterOutput(larger.LargerThan)

# ==== cluster Cluster_8
crv = ClusterInput()
int = ClusterInput()
crv_2 = Curve(crv)
int_2 = Integer(int)
panel = Panel("5")
crv_3 = Curve(crv_2)
lng = ListLength(List=crv_3)
mod = Modulus(A=int_2, B=lng)
expression = Expression(x=mod, y=lng, Expression="if(x<y,x,y-1)")
int_3 = Integer("15")
split = SplitList(List=crv_3, Index=expression)  # -> ListA, ListB
expression_2 = Expression(x=expression, y=int_3, Expression="if(x>y,y, x)")
split_2 = SplitList(List=split.ListB, Index=expression_2)  # -> ListA, ListB
divide = DivideCurve(Curve=split_2.ListA, Count=150, Kinks=False)  # -> Points, Tangents, Parameters
intcrv = Interpolate(Vertices=divide.Points, Degree=3, Periodic=True, KnotStyle=1)  # -> flatten(Curve), Length, Domain
crv_4 = Curve(intcrv.Curve)
lng_2 = ListLength(List=crv_4)  # -> expr("x-1", Length)
range = Range(Domain=Domain(0, 1), Steps=lng_2)
gradient = Gradient(LowerLimit=0, UpperLimit=1, Parameter=range, stops=[0: RGB(192, 255, 255), 1: RGB(0, 0, 128)])
item = ListItem(List=crv_4, Index=0, Wrap=True)  # -> Item1, Item
boundary = BoundarySurfaces(Edges=item.Item1)
preview = CustomPreview(Geometry=boundary, Material=ColourSwatch(SwatchColor=RGBA(76, 75, 0, 59)))
preview_2 = CustomPreview(Geometry=crv_4, Material=gradient)

# ==== cluster Cluster_2
crv = ClusterInput()
crv_2 = Curve(crv)
redpline = Reduce(Polyline=crv_2, Tolerance=1)  # -> Polyline, Reduction
smoothpline = SmoothPolyline(Polyline=redpline.Polyline, Strength=1, Times=1)
crv_3 = Curve(smoothpline)
item = ListItem(List=crv_3, Index=0, Wrap=True)
merge = Merge(Data1=crv_3, Data2=item)
twnconcrvs = TweenConsecutiveCurves(Curves=merge, Factor=0.5, InterpolationType=0, Refit=0, PointSample=0)
weave = Weave(Pattern=[0, 1], Stream0=crv_3, Stream1=twnconcrvs, NullGaps=False)
item_2 = ListItem(List=weave, Index=0, Wrap=True)
merge_2 = Merge(Data1=weave, Data2=item_2)
twnconcrvs_2 = TweenConsecutiveCurves(Curves=merge_2, Factor=0.5, InterpolationType=0, Refit=0, PointSample=0)
weave_2 = Weave(Pattern=[0, 1], Stream0=weave, Stream1=twnconcrvs_2, NullGaps=False)
W = ClusterOutput(weave_2)

# ==== cluster Cluster_5
txt = ClusterInput()
txt_2 = Text(txt)
file = ReadFile(File=txt_2, PerLineParse=True)
split = TextSplit(Text=file, Separators=",")
item = ListItem(List=split, Index=0, Wrap=True)  # -> Item, simplify(Item1); disabled
num = Number(item.Item)  # disabled
item_2 = ListItem(List=split, Index=0, Wrap=True)  # -> simplify(Item), simplify(Item1)
bnd = Bounds(Numbers=flatten(item.Item))  # disabled
dedomain = DeconstructDomain(Domain=bnd)  # -> Start, End; disabled
multiplication = Multiplication(A=item_2.Item1, B=-1)
subtraction = Subtraction(A=dedomain.End, B=num)  # disabled
addition = Addition(A=dedomain.Start, B=subtraction)  # -> simplify(Result); disabled
path_mapper = PathMapper(item_2.Item, source="{A;B}", target="{A}")
path_mapper_2 = PathMapper(multiplication, source="{A;B}", target="{A}")
path_mapper_3 = PathMapper(item.Item1, source="{A;B}", target="{A}")  # disabled
path_mapper_4 = PathMapper(addition, source="{A;B}", target="{A}")  # disabled
pt = ConstructPoint(XCoordinate=path_mapper, YCoordinate=path_mapper_2, ZCoordinate=0)
pt_2 = ConstructPoint(XCoordinate=path_mapper_3, YCoordinate=path_mapper_4, ZCoordinate=0)  # disabled
pline = PolyLine(Vertices=pt, Closed=True)  # -> flatten(Polyline)
crv = Curve(pline)
txt_3 = Text(txt_2)
crv_2 = ClusterOutput(crv)
txt_4 = ClusterOutput(txt_3)

# ==== cluster Cluster_6
txt = ClusterInput()
txt_2 = Text(txt)
file = ReadFile(File=txt_2, PerLineParse=True)
split = TextSplit(Text=file, Separators=",")
item = ListItem(List=split, Index=0, Wrap=True)  # -> Item, simplify(Item1); disabled
num = Number(item.Item)  # disabled
item_2 = ListItem(List=split, Index=0, Wrap=True)  # -> simplify(Item), simplify(Item1)
bnd = Bounds(Numbers=flatten(item.Item))  # disabled
dedomain = DeconstructDomain(Domain=bnd)  # -> Start, End; disabled
multiplication = Multiplication(A=item_2.Item, B=-1)
subtraction = Subtraction(A=dedomain.End, B=num)  # disabled
addition = Addition(A=dedomain.Start, B=subtraction)  # -> simplify(Result); disabled
path_mapper = PathMapper(multiplication, source="{A;B}", target="{A}")
path_mapper_2 = PathMapper(item_2.Item1, source="{A;B}", target="{A}")
path_mapper_3 = PathMapper(item.Item1, source="{A;B}", target="{A}")  # disabled
path_mapper_4 = PathMapper(addition, source="{A;B}", target="{A}")  # disabled
pt = ConstructPoint(XCoordinate=path_mapper_2, YCoordinate=path_mapper, ZCoordinate=0)
pt_2 = ConstructPoint(XCoordinate=path_mapper_3, YCoordinate=path_mapper_4, ZCoordinate=0)  # disabled
pline = PolyLine(Vertices=pt, Closed=True)  # -> flatten(Polyline)
crv = Curve(pline)
txt_3 = Text(txt_2)
crv_2 = ClusterOutput(crv)
txt_4 = ClusterOutput(txt_3)
