# Grasshopper definition load_shorelines_from_folder4_PancakeEmergency.gh (Grasshopper 1.0.7)

run = BooleanToggle(False)
path = FilePath(graft("D:\new_downloads\2017-08-05-05-37-18_NIR.csv"))  # disabled
iterator = CSharpScript(count="5000", run=run)  # -> out, index; inputs count: Int32, run: Boolean
# ---------- iterator: C# ----------
    if(counter < count && run) {
      counter++;
      Print("Creating Panel: " + counter.ToString() + " of " + count.ToString());
      Component.ExpireSolution(true);
      index = counter - 1;
    }else{
      counter = 0;
      index = -1;
      Print("inactive");
    }
# ---------- iterator: C# additional code ----------
  int counter = 0;
# ---------- end iterator ----------
run_status = Panel(iterator.out)
merge = Merge(Data1=path, Data2=path)  # disabled
addition = Addition(A=iterator.index, B=2)
path_2 = FilePath("D:\new_downloads\countour-20241205T192000Z-001\countour\")
path_3 = FilePath("D:\new_downloads\countour-20241205T195844Z-001\countour\")
path_4 = FilePath("D:\new_downloads\countour-20241204T194034Z-001\countour\")
path_5 = FilePath("D:\new_downloads\countour-20241218T163458Z-001\countour\")
txt = Text(merge)  # disabled
file = ReadFile(File=txt, PerLineParse=True)  # disabled
split = TextSplit(Text=file, Separators=",")  # disabled
item = ListItem(List=split, Index=0, Wrap=True)  # -> simplify(Item), simplify(Item1); disabled
cluster = Cluster_10(txt=path_5, threshold="5")
multiplication = Multiplication(A=item.Item1, B=-1)  # disabled
path_mapper = PathMapper(item.Item, source="{A;B}", target="{A}")  # disabled
path_mapper_2 = PathMapper(multiplication, source="{A;B}", target="{A}")  # disabled
pt = ConstructPoint(XCoordinate=path_mapper, YCoordinate=path_mapper_2, ZCoordinate=0)  # disabled
crv = Curve(cluster)
pline = PolyLine(Vertices=pt, Closed=True)  # -> flatten(Polyline); disabled
int = Integer(addition)
crv_2 = Curve(pline)  # disabled
txt_2 = Text(txt)  # disabled
lng = ListLength(List=crv)
crv_3 = Curve(crv_2)  # disabled
series = Series(Start=0, Step=10, Count=lng)
cluster_2 = Cluster_2(crv=crv, int=series)
crv_4 = Curve(flatten(cluster_2))
lng_2 = ListLength(List=crv_4)
series_2 = Series(Start=0, Step=1, Count=lng_2)
Z = UnitZ(Factor=series_2)
move = Move(Geometry=crv_4, Motion=Z)  # -> simplify(Geometry), Transform
shift = ShiftList(List=move.Geometry, Shift=1, Wrap=False)
shift_2 = ShiftList(List=move.Geometry, Shift=-1, Wrap=False)
rulesrf = RuledSurface(CurveA=shift, CurveB=shift_2)
cluster_3 = Cluster(crv=crv_4, int=int)  # disabled
preview = CustomPreview(Geometry=rulesrf, Material=ColourSwatch(SwatchColor=RGB(0, 255, 204)))

# ==== cluster Cluster
crv = ClusterInput()
int = ClusterInput()
crv_2 = Curve(crv)
int_2 = Integer(int)
panel = Panel("5")
crv_3 = Curve(crv_2)
lng = ListLength(List=crv_3)
mod = Modulus(A=int_2, B=lng)
expression = Expression(x=mod, y=lng, Expression="if(x<y,x,y-1)")
int_3 = Integer("15")
split = SplitList(List=crv_3, Index=expression)  # -> ListA, ListB
expression_2 = Expression(x=expression, y=int_3, Expression="if(x>y,y, x)")
split_2 = SplitList(List=split.ListB, Index=expression_2)  # -> ListA, ListB
divide = DivideCurve(Curve=split_2.ListA, Count=150, Kinks=False)  # -> Points, Tangents, Parameters
intcrv = Interpolate(Vertices=divide.Points, Degree=3, Periodic=True, KnotStyle=1)  # -> flatten(Curve), Length, Domain
crv_4 = Curve(intcrv.Curve)
lng_2 = ListLength(List=crv_4)  # -> expr("x-1", Length)
range = Range(Domain=Domain(0, 1), Steps=lng_2)
gradient = Gradient(LowerLimit=0, UpperLimit=1, Parameter=range, stops=[0: RGB(192, 255, 255), 1: RGB(0, 0, 128)])
item = ListItem(List=crv_4, Index=0, Wrap=True)  # -> Item1, Item
boundary = BoundarySurfaces(Edges=item.Item1)
preview = CustomPreview(Geometry=boundary, Material=ColourSwatch(SwatchColor=RGBA(76, 75, 0, 59)))
preview_2 = CustomPreview(Geometry=crv_4, Material=gradient)

# ==== cluster Cluster_2
crv = ClusterInput()
int = ClusterInput()
crv_2 = Curve(crv)
int_2 = Integer(int)
item = ListItem(List=crv_2, Index=0, Wrap=True)  # -> Item1, Item
item_2 = ListItem(List=int_2, Index=0, Wrap=True)  # -> Item1, Item
merge = Merge(Data1=item.Item, Data2=crv_2, Data3=item.Item1)
addition = Addition(A=item_2.Item1, B="10")
subtraction = Subtraction(A=item_2.Item, B="10")
merge_2 = Merge(Data1=subtraction, Data2=int_2, Data3=addition)  # -> flatten(Result)
lng = ListLength(List=merge)
subtraction_2 = Subtraction(A=lng, B="3")
series = Series(Start=0, Step=10, Count="4")
series_2 = Series(Start=0, Step=1, Count=subtraction_2)
series_3 = Series(Start=series_2, Step=1, Count="4")
item_3 = ListItem(List=merge_2, Index=series_3, Wrap=True)
item_4 = ListItem(List=merge, Index=series_3, Wrap=True)
Z = UnitZ(Factor=series)
item_5 = ListItem(List=item_3, Index=0, Wrap=True)
move = Move(Geometry=item_4, Motion=Z)  # -> simplify(Geometry), Transform
subtraction_3 = Subtraction(A=item_3, B=item_5)
_4_input_curves = Curve(reparameterize(move.Geometry))
item_6 = ListItem(List=subtraction_3, Index=1, Wrap=False)  # -> Item, Item1
crv_3 = Curve(reparameterize(_4_input_curves))
item_7 = ListItem(List=crv_3, Index=1, Wrap=True)
addition_2 = Addition(A=item_6.Item, B=1)
subtraction_4 = Subtraction(A=item_6.Item1, B=item_6.Item)
eval = EvaluateCurve(Curve=reparameterize(item_7), Parameter=0)  # -> Point, Tangent, Angle
series_4 = Series(Start=addition_2, Step=1, Count=subtraction_4)
crv_cp = CurveClosestPoint(Point=eval.Point, Curve=crv_3)  # -> Point, Parameter, Distance
pt = ConstructPoint(XCoordinate=0, YCoordinate=0, ZCoordinate=series_4)
seam = Seam(Curve=crv_3, Seam=crv_cp.Parameter)
divide = DivideCurve(Curve=seam, Count="200", Kinks=False)  # -> Points, Tangents, Parameters
pl = ConstructPlane(Origin=simplify(pt), XAxis=Vector(1, 0, 0), YAxis=Vector(0, 1, 0))
pt_2 = Point(graft(divide.Points))
path_mapper = PathMapper(pt_2, source="{A;B;C}", target="{A;C}")
group = Group(Objects=pl)
dup = DuplicateData(Data=group, Number="200", Order=True)
intcrv = Interpolate(Vertices=path_mapper, Degree=3, Periodic=False, KnotStyle=1)  # -> simplify(Curve), Length, Domain
ungroup = Ungroup(Group=dup)  # -> simplify(Objects)
pcx = CurvePlane(Curve=intcrv.Curve, Plane=simplify(ungroup))  # -> Points, ParamsC, ParamsP
path_mapper_2 = PathMapper(pcx.Points, source="{A;B;C}", target="{A;c}")
intcrv_2 = Interpolate(Vertices=path_mapper_2, Degree=3, Periodic=True, KnotStyle=1)  # -> flatten(Curve), Length, Domain
project = Project(Geometry=intcrv_2.Curve, Plane=PlaneXY(0, 0, 0))  # -> Geometry, Transform
crv_4 = Curve(project.Geometry)
crv_5 = ClusterOutput(crv_4)

# ==== cluster Cluster_10
threshold = ClusterInput()
txt = ClusterInput()
threshold_2 = Number(threshold)
cluster = Cluster_7(txt=txt)  # -> crv_5, txt_5, crv_6
panel = Panel(threshold_2)
non_closed_crvs = NonClosedCrvs(crv=cluster.crv_6)
non_closed_crvs_2 = NonClosedCrvs(crv=cluster.crv_5)
cluster_2 = Cluster_8(crv=non_closed_crvs_2)
cluster_3 = Cluster_9(C=cluster_2)
division = Division(A=cluster_3, B=panel)
cluster_4 = Cluster_4(crv=non_closed_crvs_2, ref_crv=cluster_2, num=division)
number_slider = Slider(10, range=0..29)  # disabled
bool = Boolean(flatten(cluster_4))
cull = CullPattern(List=non_closed_crvs_2, CullPattern=bool)
cull_2 = CullPattern(List=non_closed_crvs, CullPattern=bool)
cull_3 = CullPattern(List=cluster.txt_5, CullPattern=bool)
distance_centroids = DistanceCentroids(G=cull_2, B="2")
cull_4 = CullPattern(List=cull, CullPattern=invert(distance_centroids))
cull_5 = CullPattern(List=cull_3, CullPattern=invert(distance_centroids))
cull_6 = CullPattern(List=cull_2, CullPattern=invert(distance_centroids))
smoothpline = SmoothPolyline(Polyline=cull_4, Strength=1, Times=3)
item = ListItem(List=cull_4, Index=number_slider, Wrap=True)  # disabled
item_2 = ListItem(List=cull_5, Index=number_slider, Wrap=True)  # disabled
item_3 = ListItem(List=cull_6, Index=number_slider, Wrap=True)  # disabled
cp = ControlPoints(Curve=smoothpline)  # -> Points, Weights, Knots
intcrv = Interpolate(Vertices=cp.Points, Degree=3, Periodic=True, KnotStyle=1)  # -> flatten(Curve), Length, Domain
panel_2 = Panel(item_2)  # disabled
crv = Curve(intcrv.Curve)
crv_2 = ClusterOutput(crv)

# ==== cluster Cluster_4
crv = ClusterInput()
num = ClusterInput()
ref_crv = ClusterInput()
crv_2 = Curve(simplify(graft(crv)))
num_2 = Number(num)
ref_crv_2 = Curve(ref_crv)
Z = UnitZ(Factor=1)  # disabled
divide = DivideCurve(Curve=ref_crv_2, Count=50, Kinks=False)  # -> Points, Tangents, Parameters; disabled
xprod = CrossProduct(VectorA=Z, VectorB=divide.Tangents, Unitize=False)  # -> Vector, Length; disabled
pl = ConstructPlane(Origin=divide.Points, XAxis=xprod.Vector, YAxis=Z)  # -> flatten(Plane); disabled
lng = ListLength(List=crv_2)  # disabled
dup = DuplicateData(Data=flatten(divide.Points), Number=lng, Order=True)  # -> simplify(graft(Data)); disabled
pcx = CurvePlane(Curve=crv_2, Plane=pl)  # -> Points, ParamsC, ParamsP; disabled
cluster = Cluster_3(crv=crv)
cp = ClosestPoint(Point=dup, Cloud=pcx.Points)  # -> ClosestPoint, CPIndex, Distance; disabled
path_mapper = PathMapper(cp.Distance, source="{A;B}", target="{A}")  # disabled
path_mapper_2 = PathMapper(cp.ClosestPoint, source="{A;B}", target="{A}")  # disabled
sort = SortList(Keys=path_mapper, ValuesA=path_mapper_2)  # -> reverse(Keys), reverse(ValuesA); disabled
item = ListItem(List=sort.Keys, Index=0, Wrap=True)  # disabled
smaller = SmallerThan(FirstNumber=cluster, SecondNumber=num_2)  # -> SmallerThan, OrEqualTo
bool = Boolean(flatten(smaller.SmallerThan))
bool_2 = ClusterOutput(bool)

# ==== cluster Cluster_7
txt = ClusterInput()
panel = Panel("mask")
panel_2 = Panel("refined")
txt_2 = Text(txt)
c_script = CSharpScript(x=txt_2)  # -> out, A; inputs x: String
# ---------- c_script: C# ----------
    A = System.IO.Directory.GetFiles(x);
# ---------- end c_script ----------
txt_3 = Text(c_script.A)
split = TextSplit(Text=txt_3, Separators="_")
item = ListItem(List=split, Index=0, Wrap=True)  # -> Item1, Item, Item1_2
mindex = MemberIndex(Set=flatten(item.Item1), Member="wsl.csv")  # -> Index, Count; disabled
mindex_2 = MemberIndex(Set=flatten(item.Item1), Member="rsl.csv")  # -> Index, Count
mindex_3 = MemberIndex(Set=flatten(item.Item1), Member="sl.csv")  # -> Index, Count
item_2 = ListItem(List=txt_3, Index=mindex.Index, Wrap=True)  # disabled
item_3 = ListItem(List=txt_3, Index=mindex_2.Index, Wrap=True)
item_4 = ListItem(List=txt_3, Index=mindex_3.Index, Wrap=True)
tsort = SortText(Keys=item_3, Culture=127)  # -> Keys, Values
tsort_2 = SortText(Keys=item_2, Culture=127)  # -> Keys, Values; disabled
tsort_3 = SortText(Keys=item_4, Culture=127)  # -> Keys, Values
cluster = Cluster_6(txt=tsort.Keys)  # -> crv_2, txt_4
cluster_2 = Cluster_5(txt=tsort.Keys)  # -> crv_2, txt_4
cluster_3 = Cluster_5(txt=tsort_2.Keys)  # -> crv_2, txt_4; disabled
cluster_4 = Cluster_5(txt=tsort_3.Keys)  # -> crv_2, txt_4
item_5 = ListItem(List=cluster_3.crv_2, Index=0, Wrap=True)  # disabled
item_6 = ListItem(List=cluster_4.crv_2, Index=0, Wrap=True)  # disabled
txt_4 = Text(cluster.txt_4)
crv = Curve(cluster.crv_2)
crv_2 = Curve(cluster_4.crv_2)
crv_3 = Curve(item_5)  # disabled
crv_4 = Curve(item_6)  # disabled
txt_5 = ClusterOutput(txt_4)
crv_5 = ClusterOutput(crv)
crv_6 = ClusterOutput(crv_2)

# ==== cluster NonClosedCrvs
crv = ClusterInput()
crv_2 = Curve(crv)
cls = Closed(Curve=crv_2)  # -> Closed, Periodic
cull = CullPattern(List=crv_2, CullPattern=cls.Closed)
area = Area(Geometry=cull)  # -> Area, Centroid
len = Length(Curve=cull)
larger = LargerThan(FirstNumber=area.Area, SecondNumber=len)  # -> LargerThan, OrEqualTo
cull_2 = CullPattern(List=cull, CullPattern=larger.LargerThan)
crv_3 = Curve(cull_2)
crv_4 = ClusterOutput(crv_3)

# ==== cluster DistanceCentroids
G = ClusterInput()
area = Area(Geometry=G)  # -> Area, Centroid
avr = Average(Input=area.Centroid)
dist = Distance(PointA=area.Centroid, PointB=avr)
B = ClusterInput()
avr_2 = Average(Input=dist)
multiplication = Multiplication(A=avr_2, B=B)
larger = LargerThan(FirstNumber=dist, SecondNumber=multiplication)  # -> LargerThan, OrEqualTo
larger_than = ClusterOutput(larger.LargerThan)

# ==== cluster Cluster_8
crv = ClusterInput()
crv_2 = Curve(crv)
area = Area(Geometry=crv_2)  # -> Area, Centroid
len = Length(Curve=crv_2)
pdecon = Deconstruct(Point=area.Centroid)  # -> XComponent, YComponent, ZComponent
addition = Addition(A=len, B=area.Area)
pt = ConstructPoint(XCoordinate=pdecon.XComponent, YCoordinate=pdecon.YComponent, ZCoordinate=addition)
avr = Average(Input=pt)
dist = Distance(PointA=pt, PointB=avr)
sort = SortList(Keys=dist, ValuesA=crv_2)  # -> Keys, ValuesA
item = ListItem(List=sort.ValuesA, Index=0, Wrap=True)
i = ClusterOutput(item)

# ==== cluster Cluster_9
C = ClusterInput()
bbox = BoundingBox(Content=C, Plane=PlaneXY(0, 0, 0))  # -> Box, Box_2
debox = DeconstructBox(Box=bbox.Box)  # -> Plane, X, Y, Z
dedomain = DeconstructDomain(Domain=debox.Y)  # -> Start, End
dedomain_2 = DeconstructDomain(Domain=debox.X)  # -> Start, End
subtraction = Subtraction(A=dedomain.End, B=dedomain.Start)
subtraction_2 = Subtraction(A=dedomain_2.End, B=dedomain_2.Start)
max = Maximum(A=subtraction_2, B=subtraction)
R = ClusterOutput(max)

# ==== cluster Cluster_3
crv = ClusterInput()
crv_2 = Curve(simplify(graft(crv)))
shift = ShiftList(List=flatten(crv_2), Shift=1, Wrap=False)
shift_2 = ShiftList(List=flatten(crv_2), Shift=-1, Wrap=False)
item = ListItem(List=shift_2, Index=-2, Wrap=True)
item_2 = ListItem(List=shift, Index=1, Wrap=True)
merge = Merge(Data1=shift, Data2=item)
merge_2 = Merge(Data1=item_2, Data2=shift_2)
Z = UnitZ(Factor=1)
Z_2 = UnitZ(Factor=1)
divide = DivideCurve(Curve=merge_2, Count=50, Kinks=False)  # -> Points, Tangents, Parameters
divide_2 = DivideCurve(Curve=merge, Count=50, Kinks=False)  # -> Points, Tangents, Parameters
xprod = CrossProduct(VectorA=Z, VectorB=divide.Tangents, Unitize=False)  # -> Vector, Length
xprod_2 = CrossProduct(VectorA=Z_2, VectorB=divide_2.Tangents, Unitize=False)  # -> Vector, Length
pt = Point(simplify(graft(divide_2.Points)))
pt_2 = Point(simplify(graft(divide.Points)))
pl = ConstructPlane(Origin=divide.Points, XAxis=xprod.Vector, YAxis=Z)  # -> simplify(Plane)
pl_2 = ConstructPlane(Origin=divide_2.Points, XAxis=xprod_2.Vector, YAxis=Z_2)  # -> simplify(Plane)
pcx = CurvePlane(Curve=crv_2, Plane=pl)  # -> Points, ParamsC, ParamsP
pcx_2 = CurvePlane(Curve=crv_2, Plane=pl_2)  # -> Points, ParamsC, ParamsP
cp = ClosestPoint(Point=pt, Cloud=pcx_2.Points)  # -> ClosestPoint, CPIndex, Distance
cp_2 = ClosestPoint(Point=pt_2, Cloud=pcx.Points)  # -> ClosestPoint, CPIndex, Distance
path_mapper = PathMapper(cp_2.Distance, source="{A;B}", target="{A}")
path_mapper_2 = PathMapper(cp.Distance, source="{A;B}", target="{A}")
path_mapper_3 = PathMapper(cp_2.ClosestPoint, source="{A;B}", target="{A}")
path_mapper_4 = PathMapper(cp.ClosestPoint, source="{A;B}", target="{A}")
sort = SortList(Keys=path_mapper, ValuesA=path_mapper_3)  # -> reverse(Keys), reverse(ValuesA)
sort_2 = SortList(Keys=path_mapper_2, ValuesA=path_mapper_4)  # -> reverse(Keys), reverse(ValuesA)
item_3 = ListItem(List=sort.Keys, Index=0, Wrap=True)
item_4 = ListItem(List=sort_2.Keys, Index=0, Wrap=True)
min = Minimum(A=item_4, B=item_3)
R = ClusterOutput(min)

# ==== cluster Cluster_5
txt = ClusterInput()
txt_2 = Text(txt)
file = ReadFile(File=txt_2, PerLineParse=True)
split = TextSplit(Text=file, Separators=",")
item = ListItem(List=split, Index=0, Wrap=True)  # -> Item, simplify(Item1); disabled
num = Number(item.Item)  # disabled
item_2 = ListItem(List=split, Index=0, Wrap=True)  # -> simplify(Item), simplify(Item1)
bnd = Bounds(Numbers=flatten(item.Item))  # disabled
dedomain = DeconstructDomain(Domain=bnd)  # -> Start, End; disabled
multiplication = Multiplication(A=item_2.Item1, B=-1)
subtraction = Subtraction(A=dedomain.End, B=num)  # disabled
addition = Addition(A=dedomain.Start, B=subtraction)  # -> simplify(Result); disabled
path_mapper = PathMapper(item_2.Item, source="{A;B}", target="{A}")
path_mapper_2 = PathMapper(multiplication, source="{A;B}", target="{A}")
path_mapper_3 = PathMapper(item.Item1, source="{A;B}", target="{A}")  # disabled
path_mapper_4 = PathMapper(addition, source="{A;B}", target="{A}")  # disabled
pt = ConstructPoint(XCoordinate=path_mapper, YCoordinate=path_mapper_2, ZCoordinate=0)
pt_2 = ConstructPoint(XCoordinate=path_mapper_3, YCoordinate=path_mapper_4, ZCoordinate=0)  # disabled
pline = PolyLine(Vertices=pt, Closed=True)  # -> flatten(Polyline)
crv = Curve(pline)
txt_3 = Text(txt_2)
crv_2 = ClusterOutput(crv)
txt_4 = ClusterOutput(txt_3)

# ==== cluster Cluster_6
txt = ClusterInput()
txt_2 = Text(txt)
file = ReadFile(File=txt_2, PerLineParse=True)
split = TextSplit(Text=file, Separators=",")
item = ListItem(List=split, Index=0, Wrap=True)  # -> Item, simplify(Item1); disabled
num = Number(item.Item)  # disabled
item_2 = ListItem(List=split, Index=0, Wrap=True)  # -> simplify(Item), simplify(Item1)
bnd = Bounds(Numbers=flatten(item.Item))  # disabled
dedomain = DeconstructDomain(Domain=bnd)  # -> Start, End; disabled
multiplication = Multiplication(A=item_2.Item, B=-1)
subtraction = Subtraction(A=dedomain.End, B=num)  # disabled
addition = Addition(A=dedomain.Start, B=subtraction)  # -> simplify(Result); disabled
path_mapper = PathMapper(multiplication, source="{A;B}", target="{A}")
path_mapper_2 = PathMapper(item_2.Item1, source="{A;B}", target="{A}")
path_mapper_3 = PathMapper(item.Item1, source="{A;B}", target="{A}")  # disabled
path_mapper_4 = PathMapper(addition, source="{A;B}", target="{A}")  # disabled
pt = ConstructPoint(XCoordinate=path_mapper_2, YCoordinate=path_mapper, ZCoordinate=0)
pt_2 = ConstructPoint(XCoordinate=path_mapper_3, YCoordinate=path_mapper_4, ZCoordinate=0)  # disabled
pline = PolyLine(Vertices=pt, Closed=True)  # -> flatten(Polyline)
crv = Curve(pline)
txt_3 = Text(txt_2)
crv_2 = ClusterOutput(crv)
txt_4 = ClusterOutput(txt_3)
