# Grasshopper definition prep_data.gh (Grasshopper 1.0.7)
# plug-ins: LunchBox

txt = Text(["time,MT_001,MT_002,MT_003,MT_004,MT_005,MT_006,MT_007,MT_008,MT_009,MT_010,MT_011,MT_012,MT_013,MT_014,MT_015,MT_016,MT_017,MT_018,MT_019,MT_020", "2012-01-01 01:00:00,4.124365482233502,22.7596017069701,77.3240660295395,138.211382113821,72.25609756097563,348.2142857142858,8.620689655172415,279.461279461279,72.98951048951051,87.90322580645163,59.79880774962745,0.0,47.6782752902156,36.53477983407785,0.0,55.09681093394077,76.14555256064693,328.2747603833865,15.577889447236176,55.066079295154175", "2012-01-01 02:00:00,4.758883248730965,23.115220483641522,77.3240660295395,137.1951219512195,70.1219512195122,339.2857142857145,6.924816280384395,276.09427609427627,67.30769230769229,82.25806451612905,55.8867362146051,0.0,46.019900497512424,34.1416719846841,0.0,52.249430523918,73.22551662174303,305.9105431309903,15.45226130653265,51.1013215859031", "2012-01-01 03:00:00,4.124365482233502,22.937411095305798,77.3240660295395,136.686991869919,66.46341463414637,286.45833333333326,6.642170717919726,239.89898989898975,63.8111888111888,72.04301075268819,54.58271236959765,0.0,43.532338308457724,33.024888321633696,0.0,43.42255125284737,61.994609164420496,276.35782747603827,14.070351758793976,48.45814977973565", "2012-01-01 04:00:00,4.758883248730967,22.0483641536273,77.3240660295395,102.13414634146342,50.30487804878047,191.96428571428575,4.80497456189938,200.33670033670052,41.52097902097903,46.2365591397849,38.18926974664677,0.0,35.862354892205644,26.0051052967454,0.0,35.4498861047836,46.49595687331535,188.4984025559105,7.663316582914577,39.42731277533038", "2012-01-01 05:00:00,4.441624365482235,21.8705547652916,77.3240660295395,81.80894308943087,45.12195121951217,155.50595238095224,3.533069530808365,180.13468013467974,45.89160839160843,42.473118279569846,33.9046199701937,0.0,42.288557213930325,24.409700063816224,0.0,33.5990888382688,35.26504941599285,160.5431309904155,6.15577889447236,34.361233480176224"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])
split = SplitList(List=txt, Index=1)  # -> ListA, ListB
split_2 = TextSplit(Text=split.ListB, Separators=",")
item = ListItem(List=split_2, Index=1, Wrap=True)  # -> flatten(Item)
item_2 = ListItem(List=item, Index=0, Wrap=True)
panel = Panel(item_2)
item_3 = ListItem(List=split_2, Index=0, Wrap=True)  # -> flatten(Item)
split_3 = TextSplit(Text=split.ListA, Separators=",")
crv = Curve([<curve referenced from the Rhino model> x101])
obj = CSharpScript(obj=crv)  # -> name; inputs obj: Guid
# ---------- obj: C# ----------
var the_obj = doc.Objects.Find(obj);

name = the_obj.Attributes.Name;
# ---------- end obj ----------
csv = CreateCSV(DataGridHeaders=split_3, ValueTree=item_3, Delimiter=",")  # -> flatten(CSVString)
dom = ConstructDomain(DomainStart=0, DomainEnd=6.283185307)
split_4 = TextSplit(Text=obj, Separators="_")
range = Range(Domain=dom, Steps=20)
item_4 = ListItem(List=split_4, Index=0, Wrap=True)  # -> Item, flatten(Item1)
lng = ListLength(List=item_3)
cull_i = CullIndex(List=range, Indices=0, Wrap=True)
sort = SortList(Keys=item_4.Item1, ValuesA=crv)  # -> Keys, ValuesA
X = UnitX(Factor=1)
divide = DivideCurve(Curve=sort.ValuesA, Count=10, Kinks=False)  # -> simplify(Points), Tangents, Parameters
line = LineSDL(Start=Point(0, 0, 0), Direction=X, Length=10)
pline = PolyLine(Vertices=divide.Points, Closed=True)
rotate = Rotate(Geometry=line, Angle=cull_i, Plane=PlaneXY(0, 0, 0))  # -> Geometry, Transform
path = FilePath("/Users/walterzesk/Desktop/100_boundaries.csv")  # disabled
pcen = PolygonCenter(Polyline=pline)  # -> CenterV, CenterE, CenterA
addition = Addition(A="7*24", B=lng)
rev = Reverse(Vector=pcen.CenterV)
pdecon = Deconstruct(Point=pcen.CenterV)  # -> XComponent, YComponent, ZComponent
file = ReadFile(File=path, PerLineParse=True)  # disabled
range_2 = Range(Domain=Domain(0, 1), Steps=expr("x-1", addition))
move = Move(Geometry=graft(crv), Motion=rev)  # -> simplify(Geometry), Transform
split_5 = TextSplit(Text=file, Separators=",")  # disabled
panel_2 = Panel("3")  # disabled
ccx = CurveCurve(CurveA=flatten(rotate.Geometry), CurveB=move.Geometry)  # -> Points, ParamsA, ParamsB
partition = PartitionList(List=split_5, Size=panel_2)  # disabled
vlen = VectorLength(Vector=ccx.Points)
num2pt = NumbersToPoints(Numbers=partition, Mask=4)  # -> simplify(Points); disabled
path_mapper = PathMapper(vlen, source="{A;B}", target="{A}")
path_mapper_2 = PathMapper(num2pt, source="{A;B}", target="{A}")  # disabled
flip = FlipMatrix(Data=path_mapper)
intcrv = Interpolate(Vertices=path_mapper_2, Degree=3, Periodic=True, KnotStyle=1)  # -> Curve, Length, Domain; disabled
interp = InterpolateData(Data=flip, Parameter=range_2, Interpolation=2)
split_6 = SplitList(List=interp, Index=lng)  # -> ListA, ListB
flip_2 = FlipMatrix(Data=split_6.ListA)
flip_3 = FlipMatrix(Data=split_6.ListB)
concat = Concatenate(FragmentA=item_3, FragmentB=",")
join = TextJoin(Text=flip_3, Join=",")  # -> flatten(Result)
join_2 = TextJoin(Text=flip_2, Join=",")  # -> flatten(Result)
concat_2 = Concatenate(FragmentA=concat, FragmentB=join_2)
panel_3 = Panel(join)
merge = Merge(Data1=flatten(split.ListA), Data2=flatten(concat_2))
panel_4 = Panel(merge)
