# Grasshopper definition prep_data2.gh (Grasshopper 1.0.7)

crv = Curve([<curve referenced from the Rhino model> x5000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])  # disabled
obj = CSharpScript(obj=crv)  # -> name; inputs obj: Guid; disabled
# ---------- obj: C# ----------
var the_obj = doc.Objects.Find(obj);

name = the_obj.Attributes.Name;
# ---------- end obj ----------
split = TextSplit(Text=obj, Separators="_")  # disabled
item = ListItem(List=split, Index=0, Wrap=True)  # -> Item, flatten(Item1); disabled
sort = SortList(Keys=item.Item1, ValuesA=crv)  # -> Keys, ValuesA; disabled
dom = ConstructDomain(DomainStart=0, DomainEnd=6.283185307)  # disabled
X = UnitX(Factor=1)  # disabled
range = Range(Domain=dom, Steps=20)  # disabled
cull_i = CullIndex(List=range, Indices=0, Wrap=True)  # disabled
line = LineSDL(Start=Point(0, 0, 0), Direction=X, Length=10)  # disabled
cluster = Cluster(crv=sort.ValuesA)  # disabled
rotate = Rotate(Geometry=line, Angle=cull_i, Plane=PlaneXY(0, 0, 0))  # -> Geometry, Transform; disabled
ccx = CurveCurve(CurveA=flatten(rotate.Geometry), CurveB=graft(cluster))  # -> Points, ParamsA, ParamsB; disabled
calendar = Calendar()  # disabled
vlen = VectorLength(Vector=ccx.Points)  # -> simplify(Length); disabled
lng = ListLength(List=sort.ValuesA)  # disabled
path_mapper = PathMapper(vlen, source="{A;B}", target="{A}")  # disabled
panel = Panel("100")  # disabled
c_script = CSharpScript(start_time=calendar, len=lng)  # -> time_series; inputs len: Int32; disabled
# ---------- c_script: C# ----------
    List<DateTime> dates = new List<DateTime>();

    for(int i = 0 ; i < len ; i++){
      dates.Add(start_time.AddDays(i));
    }
    time_series = dates;
# ---------- end c_script ----------
flip = FlipMatrix(Data=path_mapper)  # disabled
multiplication = Multiplication(A=panel, B=flip)  # disabled
viewer = ParamViewer(multiplication)  # disabled
item_2 = ListItem(List=viewer, Index=0, Wrap=True)  # -> Item, Item1, Item2, Item3; disabled
branch = TreeBranch(Tree=multiplication, Path=item_2.Item2, MaintainPaths=True)  # -> flatten(Branch); disabled
flip_2 = FlipMatrix(Data=multiplication)  # disabled
txt = Text(c_script)  # disabled
txt_2 = Text(["time,MT_001,MT_002,MT_003,MT_004,MT_005,MT_006,MT_007,MT_008,MT_009,MT_010,MT_011,MT_012,MT_013,MT_014,MT_015,MT_016,MT_017,MT_018,MT_019,MT_020", "1/1/12 1:00,0.999553,1,0.999553,1,0.999553,1,0.999553,1,0.999553,1,0.999553,1,0.999553,1,0.999553,1,0.999553,1,0.999553,1", "1/1/12 2:00,0.999957,1.000522,0.999908,0.999717,0.998848,0.999141,0.998773,0.999583,0.999965,1.001377,1.000055,0.999665,0.998812,0.999125,0.998779,0.999618,0.99984,1.000545,0.99998,1.000347", "1/1/12 3:00,1.00036,1.001045,1.000264,0.999435,0.998143,0.998282,0.997993,0.999166,1.000377,1.002754,1.000558,0.99933,0.998072,0.99825,0.998006,0.999236,1.000127,1.001091,1.000407,1.000695", "1/1/12 4:00,1.000764,1.001567,1.000619,0.999152,0.997439,0.997423,0.997214,0.998748,1.000789,1.004131,1.001061,0.998995,0.997331,0.997374,0.997232,0.998854,1.000414,1.001636,1.000835,1.001042", "1/1/12 5:00,1.001168,1.002089,1.000975,0.998869,0.996734,0.996563,0.996434,0.998331,1.001201,1.005508,1.001563,0.99866,0.996591,0.996499,0.996458,0.998471,1.000701,1.002181,1.001262,1.00139"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])  # disabled
join = TextJoin(Text=flip_2, Join=",")  # -> flatten(Result); disabled
concat = Concatenate(FragmentA=txt, FragmentB=",")  # disabled
split_2 = SplitList(List=txt_2, Index=1)  # -> ListA, ListB; disabled
lng_2 = ListLength(List=branch)  # disabled
concat_2 = Concatenate(FragmentA=concat, FragmentB=join)  # disabled
series = Series(Start=0, Step=1, Count=lng_2)  # disabled
pt = ConstructPoint(XCoordinate=series, YCoordinate=branch, ZCoordinate=0)  # disabled
merge = Merge(Data1=flatten(split_2.ListA), Data2=flatten(concat_2))  # disabled
pline = PolyLine(Vertices=pt, Closed=False)  # disabled
panel_2 = Panel(merge)  # disabled

# ==== cluster Cluster
crv = ClusterInput()
crv_2 = Curve(crv)
divide = DivideCurve(Curve=crv_2, Count=10, Kinks=False)  # -> simplify(Points), Tangents, Parameters
pline = PolyLine(Vertices=divide.Points, Closed=True)
pcen = PolygonCenter(Polyline=pline)  # -> CenterV, CenterE, CenterA
rev = Reverse(Vector=pcen.CenterV)
pdecon = Deconstruct(Point=pcen.CenterV)  # -> XComponent, YComponent, ZComponent
move = Move(Geometry=graft(crv_2), Motion=rev)  # -> simplify(flatten(Geometry)), Transform
G = ClusterOutput(move.Geometry)
