# Grasshopper definition prep_data3.gh (Grasshopper 1.0.7)

crv = Curve([<curve referenced from the Rhino model> x5000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])
obj = CSharpScript(obj=crv)  # -> name; inputs obj: Guid
# ---------- obj: C# ----------
var the_obj = doc.Objects.Find(obj);

name = the_obj.Attributes.Name;
# ---------- end obj ----------
split = TextSplit(Text=obj, Separators="_")
item = ListItem(List=split, Index=0, Wrap=True)  # -> Item, flatten(Item1)
sort = SortList(Keys=item.Item1, ValuesA=crv)  # -> Keys, ValuesA
dom = ConstructDomain(DomainStart=0, DomainEnd=6.283185307)
X = UnitX(Factor=1)
range = Range(Domain=dom, Steps=20)
cull_i = CullIndex(List=range, Indices=0, Wrap=True)
line = LineSDL(Start=Point(0, 0, 0), Direction=X, Length=10)
lng = ListLength(List=sort.ValuesA)  # disabled
cluster = Cluster(crv=sort.ValuesA)
rotate = Rotate(Geometry=line, Angle=cull_i, Plane=PlaneXY(0, 0, 0))  # -> Geometry, Transform
c_script = CSharpScript(len=lng)  # -> time_series; inputs len: Int32; disabled
# ---------- c_script: C# ----------
    List<DateTime> dates = new List<DateTime>();
    DateTime start_time = DateTime.Now;
    for(int i = 0 ; i < len ; i++){
      dates.Add(start_time.AddDays(-i));
    }
    time_series = dates;
# ---------- end c_script ----------
ccx = CurveCurve(CurveA=flatten(rotate.Geometry), CurveB=graft(cluster))  # -> Points, ParamsA, ParamsB
vlen = VectorLength(Vector=ccx.Points)  # -> simplify(Length)
txt = Text(reverse(["05/06/2023 16:59:27", "05/05/2023 16:59:27", "05/04/2023 16:59:27", "05/03/2023 16:59:27", "05/02/2023 16:59:27", "05/01/2023 16:59:27"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]))
path_mapper = PathMapper(vlen, source="{A;B}", target="{A}")
split_2 = TextSplit(Text=txt, Separators=" ")
item_2 = ListItem(List=split_2, Index=0, Wrap=True)  # -> flatten(Item)
flip = FlipMatrix(Data=path_mapper)
concat = Concatenate(FragmentA=item_2, FragmentB=" 00:00:00")
multiplication = Multiplication(A="100", B=flip)
viewer = ParamViewer(multiplication)
item_3 = ListItem(List=viewer, Index=0, Wrap=True)  # -> Item, Item1, Item2, Item3
flip_2 = FlipMatrix(Data=multiplication)
txt_2 = Text(concat)
txt_3 = Text(["time,MT_001,MT_002,MT_003,MT_004,MT_005,MT_006,MT_007,MT_008,MT_009,MT_010,MT_011,MT_012,MT_013,MT_014,MT_015,MT_016,MT_017,MT_018,MT_019,MT_020", "1/1/12 1:00,0.999553,1,0.999553,1,0.999553,1,0.999553,1,0.999553,1,0.999553,1,0.999553,1,0.999553,1,0.999553,1,0.999553,1", "1/1/12 2:00,0.999957,1.000522,0.999908,0.999717,0.998848,0.999141,0.998773,0.999583,0.999965,1.001377,1.000055,0.999665,0.998812,0.999125,0.998779,0.999618,0.99984,1.000545,0.99998,1.000347", "1/1/12 3:00,1.00036,1.001045,1.000264,0.999435,0.998143,0.998282,0.997993,0.999166,1.000377,1.002754,1.000558,0.99933,0.998072,0.99825,0.998006,0.999236,1.000127,1.001091,1.000407,1.000695", "1/1/12 4:00,1.000764,1.001567,1.000619,0.999152,0.997439,0.997423,0.997214,0.998748,1.000789,1.004131,1.001061,0.998995,0.997331,0.997374,0.997232,0.998854,1.000414,1.001636,1.000835,1.001042", "1/1/12 5:00,1.001168,1.002089,1.000975,0.998869,0.996734,0.996563,0.996434,0.998331,1.001201,1.005508,1.001563,0.99866,0.996591,0.996499,0.996458,0.998471,1.000701,1.002181,1.001262,1.00139"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])
branch = TreeBranch(Tree=multiplication, Path=item_3.Item2, MaintainPaths=True)  # -> flatten(Branch)
join = TextJoin(Text=flip_2, Join=",")  # -> flatten(Result)
concat_2 = Concatenate(FragmentA=txt_2, FragmentB=",")
split_3 = SplitList(List=txt_3, Index=1)  # -> ListA, ListB
panel = Panel(concat)
lng_2 = ListLength(List=branch)
concat_3 = Concatenate(FragmentA=concat_2, FragmentB=join)
series = Series(Start=0, Step=1, Count=lng_2)
merge = Merge(Data1=flatten(split_3.ListA), Data2=flatten(concat_3))
pt = ConstructPoint(XCoordinate=series, YCoordinate=branch, ZCoordinate=0)
pline = PolyLine(Vertices=pt, Closed=False)
panel_2 = Panel("C:\Users\wzesk\Documents\GitHub\littoral\toy_island\raw_island_days2.csv")
path = FilePath("C:\Users\wzesk\Documents\GitHub\littoral\toy_island\raw_island_days.csv")
c_script_2 = CSharpScript(data=merge, path=panel_2, save=Toggle(False))  # -> out; inputs data: list of String, path: String, save: Boolean
# ---------- c_script_2: C# ----------
    if(save){
      using (var file = System.IO.File.CreateText(path))
      {
        foreach(var arr in data)
        {
          file.WriteLine(string.Join(",", arr));
        }
      }
    }
# ---------- end c_script_2 ----------
panel_3 = Panel(c_script_2)

# ==== cluster Cluster
crv = ClusterInput()
crv_2 = Curve(crv)
divide = DivideCurve(Curve=crv_2, Count=10, Kinks=False)  # -> simplify(Points), Tangents, Parameters
pline = PolyLine(Vertices=divide.Points, Closed=True)
pcen = PolygonCenter(Polyline=pline)  # -> CenterV, CenterE, CenterA
rev = Reverse(Vector=pcen.CenterV)
pdecon = Deconstruct(Point=pcen.CenterV)  # -> XComponent, YComponent, ZComponent
move = Move(Geometry=graft(crv_2), Motion=rev)  # -> simplify(flatten(Geometry)), Transform
G = ClusterOutput(move.Geometry)
