# Grasshopper definition prep_data5.gh (Grasshopper 1.0.7)

crv = Curve([<curve referenced from the Rhino model> x2160])
lng = ListLength(List=crv)
split = SplitList(List=crv, Index=10)  # -> ListA, ListB
obj = CSharpScript(obj=crv)  # -> name; inputs obj: Guid
# ---------- obj: C# ----------
var the_obj = doc.Objects.Find(obj);

name = the_obj.Attributes.Name;
# ---------- end obj ----------
c_script = CSharpScript(start_time="2017-06-01", len=lng)  # -> graft(time_series); inputs len: Int32
# ---------- c_script: C# ----------
    List<DateTime> dates = new List<DateTime>();

    for(int i = 0 ; i < len ; i++){
      dates.Add(start_time.AddDays(i));
    }
    time_series = dates;
# ---------- end c_script ----------
area = Area(Geometry=split.ListA)  # -> Area, Centroid
split_2 = TextSplit(Text=obj, Separators="_")
avr = Average(Input=area.Centroid)
item = ListItem(List=split_2, Index=0, Wrap=True)  # -> Item, flatten(Item1)
txt = Text(flatten(c_script))
dom = ConstructDomain(DomainStart=0, DomainEnd=6.283185307)
sort = SortList(Keys=item.Item1, ValuesA=crv)  # -> Keys, ValuesA
X = UnitX(Factor=1)
split_3 = TextSplit(Text=txt, Separators=" ")
range = Range(Domain=dom, Steps=20)
item_2 = ListItem(List=split_3, Index=0, Wrap=True)  # -> flatten(Item)
cull_i = CullIndex(List=range, Indices=0, Wrap=True)
line = LineSDL(Start=avr, Direction=X, Length=1000)
concat = Concatenate(FragmentA=item_2, FragmentB=" 00:00:00")
rotate = Rotate(Geometry=line, Angle=cull_i, Plane=avr)  # -> Geometry, Transform
ccx = CurveCurve(CurveA=flatten(rotate.Geometry), CurveB=simplify(graft(sort.ValuesA)))  # -> Points, ParamsA, ParamsB
vlen = VectorLength(Vector=ccx.Points)  # -> simplify(Length)
path_mapper = PathMapper(vlen, source="{A;B}", target="{A}")
flip = FlipMatrix(Data=path_mapper)
multiplication = Multiplication(A="100", B=flip)
flip_2 = FlipMatrix(Data=multiplication)
txt_2 = Text(["time,MT_001,MT_002,MT_003,MT_004,MT_005,MT_006,MT_007,MT_008,MT_009,MT_010,MT_011,MT_012,MT_013,MT_014,MT_015,MT_016,MT_017,MT_018,MT_019,MT_020", "1/1/12 1:00,0.999553,1,0.999553,1,0.999553,1,0.999553,1,0.999553,1,0.999553,1,0.999553,1,0.999553,1,0.999553,1,0.999553,1", "1/1/12 2:00,0.999957,1.000522,0.999908,0.999717,0.998848,0.999141,0.998773,0.999583,0.999965,1.001377,1.000055,0.999665,0.998812,0.999125,0.998779,0.999618,0.99984,1.000545,0.99998,1.000347", "1/1/12 3:00,1.00036,1.001045,1.000264,0.999435,0.998143,0.998282,0.997993,0.999166,1.000377,1.002754,1.000558,0.99933,0.998072,0.99825,0.998006,0.999236,1.000127,1.001091,1.000407,1.000695", "1/1/12 4:00,1.000764,1.001567,1.000619,0.999152,0.997439,0.997423,0.997214,0.998748,1.000789,1.004131,1.001061,0.998995,0.997331,0.997374,0.997232,0.998854,1.000414,1.001636,1.000835,1.001042", "1/1/12 5:00,1.001168,1.002089,1.000975,0.998869,0.996734,0.996563,0.996434,0.998331,1.001201,1.005508,1.001563,0.99866,0.996591,0.996499,0.996458,0.998471,1.000701,1.002181,1.001262,1.00139"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])
txt_3 = Text(concat)
split_4 = SplitList(List=txt_2, Index=1)  # -> ListA, ListB
concat_2 = Concatenate(FragmentA=txt_3, FragmentB=",")
join = TextJoin(Text=flip_2, Join=",")  # -> flatten(Result)
concat_3 = Concatenate(FragmentA=concat_2, FragmentB=join)
merge = Merge(Data1=flatten(split_4.ListA), Data2=flatten(concat_3))
path = FilePath("C:\Users\wzesk\Documents\GitHub\littoral\toy_island\raw_island_days.csv")
c_script_2 = CSharpScript(data=merge, path="D:\Github\littoral\toy_island\raw_island_banyan.csv", save=Toggle(False))  # -> out; inputs data: list of String, path: String, save: Boolean
# ---------- c_script_2: C# ----------
    if(save){
      using (var file = System.IO.File.CreateText(path))
      {
        foreach(var arr in data)
        {
          file.WriteLine(string.Join(",", arr));
        }
      }
    }
# ---------- end c_script_2 ----------
panel = Panel(c_script_2)
