# Grasshopper definition rebuild_island.gh (Grasshopper 1.0.7)

number_slider = Slider(27266, range=0..100001)
path = FilePath("D:\Github\tspdb\notebooks\island_banyan_act.csv")
path_2 = FilePath("D:\Github\tspdb\notebooks\island_banyan_pred.csv")
file = ReadFile(File=path, PerLineParse=True)
file_2 = ReadFile(File=path_2, PerLineParse=True)
split = SplitList(List=file, Index=1)  # -> flatten(ListA), ListB
split_2 = SplitList(List=file_2, Index=1)  # -> flatten(ListA), ListB
item = ListItem(List=split.ListB, Index=number_slider, Wrap=True)
item_2 = ListItem(List=split_2.ListB, Index=number_slider, Wrap=True)
split_3 = TextSplit(Text=item, Separators=",")
split_4 = TextSplit(Text=item_2, Separators=",")
split_5 = SplitList(List=split_3, Index=1)  # -> flatten(ListA), ListB
split_6 = SplitList(List=split_4, Index=1)  # -> flatten(ListA), ListB
dom = ConstructDomain(DomainStart=0, DomainEnd=6.283185307)
dom_2 = ConstructDomain(DomainStart=0, DomainEnd=6.283185307)
X = UnitX(Factor=1)
X_2 = UnitX(Factor=1)
range = Range(Domain=dom, Steps=20)
range_2 = Range(Domain=dom_2, Steps=20)
cull_i = CullIndex(List=range, Indices=0, Wrap=True)
cull_i_2 = CullIndex(List=range_2, Indices=0, Wrap=True)
rotate = Rotate(Geometry=X, Angle=cull_i, Plane=PlaneXY(0, 0, 0))  # -> Geometry, Transform
rotate_2 = Rotate(Geometry=X_2, Angle=cull_i_2, Plane=PlaneXY(0, 0, 0))  # -> Geometry, Transform
line = LineSDL(Start=Point(0, 0, 0), Direction=rotate.Geometry, Length=split_5.ListB)
line_2 = LineSDL(Start=Point(0, 0, 0), Direction=rotate_2.Geometry, Length=split_6.ListB)
end = EndPoints(Curve=line)  # -> Start, End
end_2 = EndPoints(Curve=line_2)  # -> Start, End
intcrv = Interpolate(Vertices=end_2.End, Degree=3, Periodic=True, KnotStyle=1)  # -> Curve, Length, Domain
intcrv_2 = Interpolate(Vertices=end.End, Degree=3, Periodic=True, KnotStyle=1)  # -> Curve, Length, Domain
preview = CustomPreview(Geometry=intcrv.Curve, Material=ColourSwatch(SwatchColor=RGB(56, 169, 255)))
preview_2 = CustomPreview(Geometry=intcrv_2.Curve, Material=ColourSwatch(SwatchColor=RGB(0, 255, 21)))
