# Grasshopper definition smooth_fit_through_shorelines.gh (Grasshopper 1.0.7)

_4_input_curves = Curve(reparameterize([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]))
panel = Panel("""0
7
80
29""")
cluster = Cluster(crv=_4_input_curves, span_in_days="30", days_in_set=panel)
crv = Curve(cluster)

# ==== cluster Cluster
crv = ClusterInput()
days_in_set = ClusterInput()
span_in_days = ClusterInput()
crv_2 = Curve(reparameterize(crv))
days_in_set_2 = Integer(days_in_set)
span_in_days_2 = Integer(span_in_days)
item = ListItem(List=crv_2, Index=0, Wrap=True)
panel = Panel(days_in_set_2)
series = Series(Start=0, Step=1, Count=span_in_days_2)
eval = EvaluateCurve(Curve=reparameterize(item), Parameter=0)  # -> Point, Tangent, Angle
item_2 = ListItem(List=series, Index=panel, Wrap=True)
crv_cp = CurveClosestPoint(Point=eval.Point, Curve=crv_2)  # -> Point, Parameter, Distance
cull_i = CullIndex(List=series, Indices=panel, Wrap=True)
Z = UnitZ(Factor=item_2)
seam = Seam(Curve=crv_2, Seam=crv_cp.Parameter)
divide = DivideCurve(Curve=seam, Count="200", Kinks=False)  # -> Points, Tangents, Parameters
pt = ConstructPoint(XCoordinate=0, YCoordinate=0, ZCoordinate=cull_i)
move = Move(Geometry=graft(crv_2), Motion=graft(Z))  # -> flatten(Geometry), Transform
move_2 = Move(Geometry=divide.Points, Motion=graft(Z))  # -> Geometry, Transform
pl = ConstructPlane(Origin=pt, XAxis=Vector(1, 0, 0), YAxis=Vector(0, 1, 0))  # -> graft(Plane)
flip = FlipMatrix(Data=move_2.Geometry)
intcrv = Interpolate(Vertices=flip, Degree=3, Periodic=False, KnotStyle=1)  # -> flatten(Curve), Length, Domain
pcx = CurvePlane(Curve=intcrv.Curve, Plane=simplify(pl))  # -> Points, ParamsC, ParamsP
path_mapper = PathMapper(pcx.Points, source="{A;B}", target="{A}")
intcrv_2 = Interpolate(Vertices=path_mapper, Degree=3, Periodic=True, KnotStyle=1)  # -> flatten(Curve), Length, Domain
ins = InsertItems(List=intcrv_2.Curve, Item=move.Geometry, Indices=panel, Wrap=True)
crv_3 = Curve(ins)
crv_4 = ClusterOutput(crv_3)
