# Grasshopper definition tracking_tests [May-08 '24, 2108].gh (Grasshopper 1.0.7)

list = ValueList({"SLR/Budget": 0, "Migration": 1, "Rotation": 2, "Oscillation": 3}, selected="SLR/Budget")
base_radius = Panel("3000")
steps = Panel("1500")
cluster = Cluster(base_radius=base_radius, steps=steps, type=list)  # -> _2d_2, _3d_2
panel = Panel("D:\Github\littoral\toy_island\data_exchange\migration_act.csv")
shift = ShiftList(List=cluster._2d_2, Shift=1, Wrap=False)  # -> simplify(graft(List))
shift_2 = ShiftList(List=cluster._2d_2, Shift=-1, Wrap=False)  # -> simplify(graft(List))
panel_2 = Panel("_output.csv")
crv = Curve(shift_2)
panel_3 = Panel("""SLR_Budget
Migration
Rotation
Oscillation""")
lng = ListLength(List=flatten(shift_2))
item = ListItem(List=panel_3, Index=list, Wrap=True)
panel_4 = Panel(lng)
divide = DivideCurve(Curve=shift, Count="200", Kinks=False)  # -> Points, Tangents, Parameters
merge = Merge(Data1="D:\Github\littoral\toy_island\data_exchange\", Data2=item, Data3="_output.csv")
num = Number(base_radius)
c_script = CSharpScript(start_time="2000-01-01", len=panel_4)  # -> graft(time_series); inputs len: Int32
# ---------- c_script: C# ----------
    List<DateTime> dates = new List<DateTime>();

    for(int i = 0 ; i < len ; i++){
      dates.Add(start_time.AddDays(i));
    }
    time_series = dates;
# ---------- end c_script ----------
incurve = PointInCurve(Point=divide.Points, Curve=shift_2)  # -> Relationship, Point
cir = Circle(Plane=PlaneXY(0, 0, 0), Radius=num)
file = ReadFile(File=panel, PerLineParse=True)
join = TextJoin(Text=merge)
crv_cp = CurveClosestPoint(Point=divide.Points, Curve=shift_2)  # -> Point, Parameter, Distance
expression = Expression(x=incurve.Relationship, Expression="if(x = 0,1,-1)")
split = SplitList(List=file, Index=1)  # -> ListA, ListB
panel_5 = Panel(join)
txt = Text(flatten(c_script))
split_2 = TextSplit(Text=split.ListB, Separators=",")
split_3 = TextSplit(Text=txt, Separators=" ")
multiplication = Multiplication(A=expression, B=crv_cp.Distance)  # -> simplify(Result)
dom = ConstructDomain(DomainStart=expr("-x", ".001"), DomainEnd=".001")
split_4 = SplitList(List=split_2, Index=1)  # -> ListA, simplify(ListB)
divide_2 = DivideCurve(Curve=cir, Count="200", Kinks=False)  # -> Points, Tangents, Parameters
item_2 = ListItem(List=split_3, Index=0, Wrap=True)  # -> flatten(Item)
cluster_2 = Cluster_2(num=multiplication, domain=dom)
hframe = HorizontalFrame(Curve=cir, Parameter=divide_2.Parameters)
viewer = ParamViewer(multiplication)
concat = Concatenate(FragmentA=item_2, FragmentB=" 00:00:00")
deplane = DeconstructPlane(Plane=hframe)  # -> Origin, XAxis, YAxis, ZAxis
item_3 = ListItem(List=viewer, Index=0, Wrap=True)
rev = Reverse(Vector=deplane.YAxis)
addition = Addition(A=multiplication, B=cluster_2)
txt_2 = Text(concat)
concat_2 = Concatenate(FragmentA=txt_2, FragmentB=",")
vdis = VectorDisplay(Anchor=deplane.Origin, Vector=deplane.YAxis)
branch = TreeBranch(Tree=multiplication, Path=item_3, MaintainPaths=True)  # -> flatten(Branch)
join_2 = TextJoin(Text=addition, Join=",")  # -> flatten(Result)
lng_2 = ListLength(List=branch)
cluster_3 = Cluster_9(crv=cir, int=Slider(617, range=0..1999))
c_script_2 = CSharpScript(num=lng_2)  # -> series; inputs num: Int32
# ---------- c_script_2: C# ----------
    List<string> numbers = new List<string>();
    for(int i = 0 ; i < num ; i++){
      numbers.Add("TR_" + i.ToString("D3"));
    }
    series = numbers;
# ---------- end c_script_2 ----------
concat_3 = Concatenate(FragmentA="time", FragmentB=",")
join_3 = TextJoin(Text=c_script_2, Join=",")
concat_4 = Concatenate(FragmentA=concat_2, FragmentB=join_2)
concat_5 = Concatenate(FragmentA=concat_3, FragmentB=join_3)
merge_2 = Merge(Data1=flatten(concat_5), Data2=flatten(concat_4))
c_script_3 = CSharpScript(data=merge_2, path=panel_5, save=Toggle(False))  # -> out; inputs data: list of String, path: String, save: Boolean
# ---------- c_script_3: C# ----------
    if(save){
      using (var file = System.IO.File.CreateText(path))
      {
        foreach(var arr in data)
        {
          file.WriteLine(string.Join(",", arr));
        }
      }
    }
# ---------- end c_script_3 ----------
panel_6 = Panel(c_script_3)

# ==== cluster Cluster
base_radius = ClusterInput()
steps = ClusterInput()
type = ClusterInput()
base_radius_2 = Number(base_radius)
steps_2 = Integer(steps)
type_2 = Integer(type)
vec = Vector(Vector(-0.8199580837, 0.5724235678, 0))
cir = Circle(Plane=PlaneXY(0, 0, 0), Radius=base_radius_2)
panel = Panel("1.01")
amp = Amplitude(Vector=vec, Amplitude="1")
series = Series(Start=0, Step="1", Count=steps_2)
scale_nu = ScaleNU(Geometry=cir, Plane=PlaneXY(0, 0, 0), ScaleX=0.8, ScaleY=1.1, ScaleZ=1)  # -> Geometry, Transform
graph = GraphMapper(series, x0=0, x1=1500, y0=0, y1=1, container_name="Sine", Equation_px=[0, 0.05932884663], Equation_py=[0, 0.9825236201])
expression = Expression(x=steps_2, y="100", z="1", Expression="(x/y)*z")
dom = ConstructDomain(DomainStart=expr("-x", expression), DomainEnd=expression)
bnd = Bounds(Numbers=graph)
remap = RemapNumbers(Value=graph, Source=bnd, Target=dom)  # -> Mapped, Clipped
amp_2 = Amplitude(Vector=vec, Amplitude=remap.Mapped)
scale = Scale(Center=Point(0, 0, 0), Factor=0.999)  # -> Geometry, Transform
move = Move(Motion=amp)  # -> Geometry, Transform
rotate = Rotate(Angle=".001", Plane=PlaneXY(0, 0, 0))  # -> Geometry, Transform
move_2 = Move(Motion=amp_2)  # -> Geometry, Transform
dup = DuplicateData(Data=scale.Transform, Number=steps_2, Order=True)
dup_2 = DuplicateData(Data=rotate.Transform, Number=steps_2, Order=True)
dup_3 = DuplicateData(Data=move.Transform, Number=steps_2, Order=True)
filter = StreamFilter(Gate=type_2, Stream0=dup, Stream1=dup_3, Stream2=dup_2, Stream3=move_2.Transform)
Z = UnitZ(Factor=10)
crv = Curve(scale_nu.Geometry)
move_3 = Move(Motion=Z)  # -> Geometry, Transform
c_script = CSharpScript(x=crv, t=filter)  # -> A; inputs x: GeometryBase, t: list of Transform
# ---------- c_script: C# ----------
    List<Rhino.Geometry.GeometryBase> geom_out = new List<Rhino.Geometry.GeometryBase>();
    var current = x.Duplicate();
    foreach (Rhino.Geometry.Transform trans in t){
      geom_out.Add(current);
      x.Transform(trans);
      current = x.Duplicate();
    }
    A = geom_out;
# ---------- end c_script ----------
c_script_2 = CSharpScript(x=crv, t=filter, v=move_3.Transform)  # -> A; inputs x: GeometryBase, t: list of Transform, v: Transform
# ---------- c_script_2: C# ----------
    List<Rhino.Geometry.GeometryBase> geom_out = new List<Rhino.Geometry.GeometryBase>();
    var current = x;
    foreach (Rhino.Geometry.Transform trans in t){
      geom_out.Add(current);
      x.Transform(trans);
      x.Transform(v);
      current = x.Duplicate();
    }
    A = geom_out;
# ---------- end c_script_2 ----------
_2d = Curve(c_script)
_3d = Curve(c_script_2)
_3d_2 = ClusterOutput(_3d)
_2d_2 = ClusterOutput(_2d)

# ==== cluster Cluster_2
num = ClusterInput()
domain = ClusterInput()
num_2 = Number(num)
domain_2 = Domain(domain)
viewer = ParamViewer(num_2)
dpath = DeconstructPath(Branch=viewer)  # -> simplify(Indices)
lng = ListLength(List=num_2)  # -> simplify(Length)
random = Random(Range=domain_2, Number=lng, Seed=dpath)  # -> simplify(Random)
randomization = Number(random)
randomization_2 = ClusterOutput(randomization)

# ==== cluster Cluster_9
offsets = ClusterInput()
crv = ClusterInput()
int = ClusterInput()
offsets_2 = Text(offsets)
crv_2 = Curve(crv)
int_2 = Integer(int)
cluster = Cluster_4(T=offsets_2, C=",")
viewer = ParamViewer(cluster)
branch = TreeBranch(Tree=cluster, Path=viewer, MaintainPaths=True)
clean = CleanTree(RemoveNulls=True, RemoveInvalid=True, RemoveEmpty=True, Tree=branch)
viewer_2 = ParamViewer(clean)
lng = ListLength(List=viewer_2)
smaller = SmallerThan(FirstNumber=lng, SecondNumber=int_2)  # -> SmallerThan, OrEqualTo
filter = StreamFilter(Gate=smaller.SmallerThan, Stream0=int_2, Stream1=lng)
cluster_2 = Cluster_7(num=clean, int=filter)
cluster_3 = Cluster_6(num=cluster_2)
c_script = CSharpScript(start_curve=crv_2, offsets=cluster_3)  # -> out, crv_out, offset_tracks, last_crv, prev_crvs, planes, pts_out; inputs start_curve: Curve, offsets: tree of Double
# ---------- c_script: C# ----------
    Rhino.Geometry.Curve w_crv = start_curve;

    List<Rhino.Geometry.Line> tracks = new List<Rhino.Geometry.Line>();
    List<Rhino.Geometry.Curve> crv_seq = new List<Rhino.Geometry.Curve>();

    for(int i = 0; i < offsets.BranchCount ; i++){
      tracks = new List<Rhino.Geometry.Line>();//clearing tracks list

      List<double> offset_step = offsets.Branch(i);
      int cnt = offset_step.Count;
      var t_vals = w_crv.DivideByCount(cnt, true);
      crv_seq.Add(w_crv);

      List<Rhino.Geometry.Point3d> pts = new List<Rhino.Geometry.Point3d>();
      List<Rhino.Geometry.Plane> plns = new List<Rhino.Geometry.Plane>();

      int pt_cnt = 0;
      foreach(var t_val in t_vals){
        var crv_tan = w_crv.TangentAt(t_val);
        var crv_norm = Rhino.Geometry.Vector3d.CrossProduct(crv_tan, Rhino.Geometry.Vector3d.ZAxis);
        var pln = new Rhino.Geometry.Plane(w_crv.PointAt(t_val), crv_norm, Rhino.Geometry.Vector3d.ZAxis);
        var pt = pln.PointAt(-offset_step[pt_cnt], 0);
        pts.Add(pt);
        plns.Add(pln);
        tracks.Add(new Rhino.Geometry.Line(plns[pt_cnt].Origin, pt));
        pt_cnt++;
      }
      planes = plns;
      pts_out = pts;

      //reset start
      var str_pt = w_crv.PointAtStart;
      w_crv = Rhino.Geometry.Curve.CreatePeriodicCurve(Rhino.Geometry.Curve.CreateInterpolatedCurve(pts, 3));
      w_crv = w_crv.Rebuild(cnt / 4, 3, false);
      
      double str_t = 0;
      w_crv.ClosestPoint(str_pt, out str_t);
      w_crv.ChangeClosedCurveSeam(str_t);

      Rhino.Geometry.Intersect.CurveIntersections self_intersect = Rhino.Geometry.Intersect.Intersection.CurveSelf(w_crv, 0.01);

      if(self_intersect.Count > 0){
        List < double > tx = new List<double>();
        for(int ix = 0 ; ix < self_intersect.Count ; ix++){
          tx.Add(self_intersect[ix].ParameterA);
          tx.Add(self_intersect[ix].ParameterB);
          Print("intersection at: " + self_intersect[ix].ParameterA.ToString() + " and " + self_intersect[ix].ParameterB.ToString());
        }
        Rhino.Geometry.Curve[] crvs = w_crv.Split(tx);
        Print(crvs.Length.ToString());
        if(crvs.Length > 1){
          Print(crvs.Length.ToString());
          Print(crvs[0].ToString());
          Print(w_crv.ToString());
          Rhino.Geometry.Curve s_crv = crvs[0];
          for(int cr = 0 ; cr < crvs.Length ; cr++){
            if( crvs[cr].GetLength() > s_crv.GetLength()){
              s_crv = crvs[cr];
            }
          }
          s_crv = Rhino.Geometry.Curve.CreatePeriodicCurve(s_crv);
          s_crv = s_crv.Rebuild(cnt / 4, 3, false);


          //reset start
          str_pt = w_crv.PointAtStart;
          str_t = 0;
          s_crv.ClosestPoint(str_pt, out str_t);
          s_crv.ChangeClosedCurveSeam(str_t);

          w_crv = s_crv;
        }
      }
    }
    prev_crvs = crv_seq;
    offset_tracks = tracks;
    crv_out = w_crv;
# ---------- end c_script ----------
pt = Point(c_script.pts_out)
item = ListItem(List=c_script.out, Index=0, Wrap=True)  # -> Item, Item1
crv_3 = Curve(crv_2)
split = SplitList(List=reverse(c_script.prev_crvs), Index=10)  # -> reverse(ListA), ListB
lng_2 = ListLength(List=split.ListA)  # -> expr("x-1", Length)
item_2 = ListItem(List=c_script.prev_crvs, Index=0, Wrap=True)  # -> Item1, Item
range = Range(Domain=Domain(0, 1), Steps=lng_2)
gradient = Gradient(LowerLimit=0, UpperLimit=1, Parameter=range, stops=[0.0572: RGB(192, 255, 255), 0.948: RGB(0, 128, 128)])
crv_4 = Curve(item_2.Item1)
preview = CustomPreview(Geometry=crv_4, Material=ColourSwatch(SwatchColor=RGB(137, 161, 50)))
swatch = ColourSwatch(SwatchColor=RGB(199, 242, 239))  # disabled
swatch_2 = ColourSwatch(SwatchColor=RGB(150, 204, 124))  # disabled
crv_5 = Curve(c_script.crv_out)
cluster_4 = Cluster_8(crv=crv_5)
preview_2 = CustomPreview(Geometry=crv_5, Material=ColourSwatch(SwatchColor=RGB(0, 37, 122)))
preview_3 = CustomPreview(Geometry=crv_3, Material=swatch)  # disabled
preview_4 = CustomPreview(Geometry=c_script.offset_tracks, Material=swatch_2)  # disabled
preview_5 = CustomPreview(Geometry=split.ListA, Material=gradient)

# ==== cluster Cluster_4
T = ClusterInput()
C = ClusterInput()
split = TextSplit(Text=T, Separators=C)  # -> simplify(Result)
len = TextLength(Text=split)
larger = LargerThan(FirstNumber=len, SecondNumber=0)  # -> LargerThan, OrEqualTo
cull = CullPattern(List=split, CullPattern=larger.LargerThan)
lng = ListLength(List=cull)
cluster = Cluster_3(int=lng)
cull_2 = CullPattern(List=cull, CullPattern=cluster)
num = Number(cull_2)
num_2 = ClusterOutput(num)

# ==== cluster Cluster_6
num = ClusterInput()
num_2 = Number(simplify(num))
len = TextLength(Text=num_2)
smaller = SmallerThan(FirstNumber=len, SecondNumber="1")  # -> SmallerThan, OrEqualTo
concat = Concatenate(FragmentA=num_2, FragmentB="0")
p_n_c = PickNChoose(Pattern=smaller.SmallerThan, Stream0=num_2, Stream1=concat)  # -> simplify(Result)
num_3 = Number(p_n_c)
cluster = Cluster_5(num=num_3)
num_4 = ClusterOutput(cluster)

# ==== cluster Cluster_7
num = ClusterInput()
num_2 = Number(simplify(num))
viewer = ParamViewer(num_2)
int = ClusterInput()
int_2 = Integer(int)
split = SplitList(List=viewer, Index=int_2)  # -> ListA, ListB
branch = TreeBranch(Tree=num_2, Path=split.ListA, MaintainPaths=True)
B = ClusterOutput(branch)

# ==== cluster Cluster_8
crv = ClusterInput()
crv_2 = Curve(crv)
eval = EvaluateCurve(Curve=reparameterize(crv_2), Parameter=0.5)  # -> Point, Tangent, Angle
vdis = VectorDisplay(Anchor=eval.Point, Vector=eval.Tangent)

# ==== cluster Cluster_3
int = ClusterInput()
int_2 = Integer(int)
c_script = CSharpScript(nums=flatten(int_2))  # -> out, A; inputs nums: list of Int32
# ---------- c_script: C# ----------
    A = Mode(nums);
# ---------- c_script: C# additional code ----------
  static List<int> Mode(List<int> values)
  {
    int[] sorted = new int[values.Count];
    values.CopyTo(sorted, 0);
    Array.Sort(sorted);

    List<int> result = new List<int>();
    var counts = new Dictionary<int, int>();
    int max = 0;
    foreach (int num in sorted)

    {
      if (counts.ContainsKey(num))
        counts[num] = counts[num] + 1;
      else
        counts[num] = 1;
    }

    foreach (var key in counts.Keys)
    {
      if (counts[key] > max)
      {
        max = counts[key];
        result.Add(max);
      }
    }

    return result;

  }
# ---------- end c_script ----------
viewer = ParamViewer(int_2)
replace = ReplacePaths(Data=int_2, Search=viewer, Replace=flatten(int_2))
panel = Panel(c_script.A)
lng = ListLength(List=replace)
viewer_2 = ParamViewer(replace)
sort = SortList(Keys=flatten(lng), ValuesA=viewer_2)  # -> Keys, reverse(ValuesA)
item = ListItem(List=sort.ValuesA, Index=0, Wrap=True)
branch = TreeBranch(Tree=replace, Path=item, MaintainPaths=True)
avr = Average(Input=branch)  # -> flatten(ArithmeticMean)
equals = Equality(FirstNumber=avr, SecondNumber=int_2)  # -> Equality, Inequality
bool = Boolean(equals.Equality)
bool_2 = ClusterOutput(bool)

# ==== cluster Cluster_5
num = ClusterInput()
num_2 = Number(num)
ma = MassAddition(Input=num_2)  # -> Result, PartialResults
viewer = ParamViewer(num_2)
bool = Boolean(ma.Result)
dispatch = Dispatch(List=viewer, DispatchPattern=flatten(bool))  # -> ListA, ListB
branch = TreeBranch(Tree=num_2, Path=dispatch.ListA, MaintainPaths=True)
branch_2 = TreeBranch(Tree=num_2, Path=dispatch.ListB, MaintainPaths=True)
num_3 = Number(branch)
abs = Absolute(Value=num_3)
division = Division(A=num_3, B=abs)
avr = Average(Input=abs)
division_2 = Division(A=abs, B=avr)
multiplication = Multiplication(A=avr, B=division)
larger = LargerThan(FirstNumber=division_2, SecondNumber="10")  # -> LargerThan, OrEqualTo
p_n_c = PickNChoose(Pattern=larger.LargerThan, Stream0=num_3, Stream1=multiplication)
merge = Merge(Data1=p_n_c, Data2=branch_2)
num_4 = Number(merge)
num_5 = ClusterOutput(num_4)
