# Grasshopper definition tracking_tests.gh (Grasshopper 1.0.7)

list = ValueList({"SLR/Budget": 0, "Migration": 1, "Rotation": 2, "Oscillation": 3}, selected="SLR/Budget")
base_radius = Panel("3000")
steps = Panel("1500")
cluster = Cluster(base_radius=base_radius, steps=steps, type=list)  # -> _2d_2, _3d_2
shift = ShiftList(List=cluster._2d_2, Shift=1, Wrap=False)  # -> simplify(graft(List))
shift_2 = ShiftList(List=cluster._2d_2, Shift=-1, Wrap=False)  # -> simplify(graft(List))
crv = Curve(shift_2)
panel = Panel("""SLR_Budget
Migration
Rotation
Oscillation""")
lng = ListLength(List=flatten(shift_2))
item = ListItem(List=panel, Index=list, Wrap=True)
panel_2 = Panel(lng)
divide = DivideCurve(Curve=shift, Count="200", Kinks=False)  # -> Points, Tangents, Parameters
merge = Merge(Data1="D:\Github\littoral\toy_island\", Data2=item, Data3="_output.csv")
c_script = CSharpScript(start_time="2000-01-01", len=panel_2)  # -> graft(time_series); inputs len: Int32
# ---------- c_script: C# ----------
    List<DateTime> dates = new List<DateTime>();

    for(int i = 0 ; i < len ; i++){
      dates.Add(start_time.AddDays(i));
    }
    time_series = dates;
# ---------- end c_script ----------
incurve = PointInCurve(Point=divide.Points, Curve=shift_2)  # -> Relationship, Point
join = TextJoin(Text=merge)
crv_cp = CurveClosestPoint(Point=divide.Points, Curve=shift_2)  # -> Point, Parameter, Distance
expression = Expression(x=incurve.Relationship, Expression="if(x = 0,1,-1)")
panel_3 = Panel(join)
txt = Text(flatten(c_script))
split = TextSplit(Text=txt, Separators=" ")
multiplication = Multiplication(A=expression, B=crv_cp.Distance)  # -> simplify(Result)
dom = ConstructDomain(DomainStart=expr("-x", ".001"), DomainEnd=".001")
item_2 = ListItem(List=split, Index=0, Wrap=True)  # -> flatten(Item)
cluster_2 = Cluster_2(num=multiplication, domain=dom)
viewer = ParamViewer(multiplication)
concat = Concatenate(FragmentA=item_2, FragmentB=" 00:00:00")
item_3 = ListItem(List=viewer, Index=0, Wrap=True)
addition = Addition(A=multiplication, B=cluster_2)
txt_2 = Text(concat)
concat_2 = Concatenate(FragmentA=txt_2, FragmentB=",")
branch = TreeBranch(Tree=multiplication, Path=item_3, MaintainPaths=True)  # -> flatten(Branch)
join_2 = TextJoin(Text=addition, Join=",")  # -> flatten(Result)
lng_2 = ListLength(List=branch)
c_script_2 = CSharpScript(num=lng_2)  # -> series; inputs num: Int32
# ---------- c_script_2: C# ----------
    List<string> numbers = new List<string>();
    for(int i = 0 ; i < num ; i++){
      numbers.Add("TR_" + i.ToString("D3"));
    }
    series = numbers;
# ---------- end c_script_2 ----------
concat_3 = Concatenate(FragmentA="time", FragmentB=",")
join_3 = TextJoin(Text=c_script_2, Join=",")
concat_4 = Concatenate(FragmentA=concat_2, FragmentB=join_2)
concat_5 = Concatenate(FragmentA=concat_3, FragmentB=join_3)
merge_2 = Merge(Data1=flatten(concat_5), Data2=flatten(concat_4))
c_script_3 = CSharpScript(data=merge_2, path=panel_3, save=Toggle(False))  # -> out; inputs data: list of String, path: String, save: Boolean
# ---------- c_script_3: C# ----------
    if(save){
      using (var file = System.IO.File.CreateText(path))
      {
        foreach(var arr in data)
        {
          file.WriteLine(string.Join(",", arr));
        }
      }
    }
# ---------- end c_script_3 ----------
panel_4 = Panel(c_script_3)

# ==== cluster Cluster
base_radius = ClusterInput()
steps = ClusterInput()
type = ClusterInput()
base_radius_2 = Number(base_radius)
steps_2 = Integer(steps)
type_2 = Integer(type)
vec = Vector(Vector(-0.8199580837, 0.5724235678, 0))
cir = Circle(Plane=PlaneXY(0, 0, 0), Radius=base_radius_2)
panel = Panel("1.01")
amp = Amplitude(Vector=vec, Amplitude="1")
series = Series(Start=0, Step="1", Count=steps_2)
scale_nu = ScaleNU(Geometry=cir, Plane=PlaneXY(0, 0, 0), ScaleX=0.8, ScaleY=1.1, ScaleZ=1)  # -> Geometry, Transform
graph = GraphMapper(series, x0=0, x1=1500, y0=0, y1=1, container_name="Sine", Equation_px=[0, 0.05932884663], Equation_py=[0, 0.9825236201])
expression = Expression(x=steps_2, y="100", z="1", Expression="(x/y)*z")
dom = ConstructDomain(DomainStart=expr("-x", expression), DomainEnd=expression)
bnd = Bounds(Numbers=graph)
remap = RemapNumbers(Value=graph, Source=bnd, Target=dom)  # -> Mapped, Clipped
amp_2 = Amplitude(Vector=vec, Amplitude=remap.Mapped)
scale = Scale(Center=Point(0, 0, 0), Factor=0.999)  # -> Geometry, Transform
move = Move(Motion=amp)  # -> Geometry, Transform
rotate = Rotate(Angle=".001", Plane=PlaneXY(0, 0, 0))  # -> Geometry, Transform
move_2 = Move(Motion=amp_2)  # -> Geometry, Transform
dup = DuplicateData(Data=scale.Transform, Number=steps_2, Order=True)
dup_2 = DuplicateData(Data=rotate.Transform, Number=steps_2, Order=True)
dup_3 = DuplicateData(Data=move.Transform, Number=steps_2, Order=True)
filter = StreamFilter(Gate=type_2, Stream0=dup, Stream1=dup_3, Stream2=dup_2, Stream3=move_2.Transform)
Z = UnitZ(Factor=10)
crv = Curve(scale_nu.Geometry)
move_3 = Move(Motion=Z)  # -> Geometry, Transform
c_script = CSharpScript(x=crv, t=filter)  # -> A; inputs x: GeometryBase, t: list of Transform
# ---------- c_script: C# ----------
    List<Rhino.Geometry.GeometryBase> geom_out = new List<Rhino.Geometry.GeometryBase>();
    var current = x.Duplicate();
    foreach (Rhino.Geometry.Transform trans in t){
      geom_out.Add(current);
      x.Transform(trans);
      current = x.Duplicate();
    }
    A = geom_out;
# ---------- end c_script ----------
c_script_2 = CSharpScript(x=crv, t=filter, v=move_3.Transform)  # -> A; inputs x: GeometryBase, t: list of Transform, v: Transform
# ---------- c_script_2: C# ----------
    List<Rhino.Geometry.GeometryBase> geom_out = new List<Rhino.Geometry.GeometryBase>();
    var current = x;
    foreach (Rhino.Geometry.Transform trans in t){
      geom_out.Add(current);
      x.Transform(trans);
      x.Transform(v);
      current = x.Duplicate();
    }
    A = geom_out;
# ---------- end c_script_2 ----------
_2d = Curve(c_script)
_3d = Curve(c_script_2)
_3d_2 = ClusterOutput(_3d)
_2d_2 = ClusterOutput(_2d)

# ==== cluster Cluster_2
num = ClusterInput()
domain = ClusterInput()
num_2 = Number(num)
domain_2 = Domain(domain)
viewer = ParamViewer(num_2)
dpath = DeconstructPath(Branch=viewer)  # -> simplify(Indices)
lng = ListLength(List=num_2)  # -> simplify(Length)
random = Random(Range=domain_2, Number=lng, Seed=dpath)  # -> simplify(Random)
randomization = Number(random)
randomization_2 = ClusterOutput(randomization)
