# Grasshopper definition universal_coastline_tracker.gh (Grasshopper 1.0.7)

crv = Curve([<curve referenced from the Rhino model> x5000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])
crv_2 = Curve(crv)
obj = CSharpScript(obj=crv_2)  # -> name; inputs obj: Guid
# ---------- obj: C# ----------
var the_obj = doc.Objects.Find(obj);

name = the_obj.Attributes.Name;
# ---------- end obj ----------
split = TextSplit(Text=obj, Separators="d")
number_slider = Slider(1, range=0..1)  # disabled
path = FilePath("D:\Github\CoastSat\data\offsets copy.csv")  # disabled
item = ListItem(List=split, Index=0, Wrap=True)  # -> Item, flatten(Item1)
file = ReadFile(File=path, PerLineParse=True)  # disabled
path_2 = FilePath("D:\Github\CoastSat\data\initial_coast.csv")  # disabled
crv_3 = Curve(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)
crv_4 = Curve(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)
range = Range(Domain=Domain(0, 1), Steps=1000)
split_2 = SplitList(List=file, Index=1)  # -> ListA, ListB; disabled
fragment = TextFragment(Text=item.Item1, Start=2)
panel = Panel("")  # disabled
panel_2 = Panel(",")  # disabled
file_2 = ReadFile(File=path_2, PerLineParse=True)  # disabled
tweencrv = TweenCurve(CurveA=crv_4, CurveB=crv_3, Factor=range, BlendType=0)
sort = SortList(Keys=fragment, ValuesA=crv_2)  # -> Keys, ValuesA
rep = ReplaceText(Text=split_2.ListB, Find=panel_2, Replace=panel, RecursiveReplace=False)  # disabled
panel_3 = Panel(split_2.ListA)  # disabled
split_3 = SplitList(List=file_2, Index=1)  # -> ListA, ListB; disabled
expression = Expression(x=split_3.ListB, Expression="Format(\"{0:0.000000000}\", x)")  # disabled
len = TextLength(Text=rep)  # disabled
panel_4 = Panel("12")  # disabled
crv_5 = Curve(tweencrv)
crv_6 = Curve(sort.ValuesA)
smaller = SmallerThan(FirstNumber=len, SecondNumber=panel_4)  # -> SmallerThan, OrEqualTo; disabled
crv_7 = Curve(crv_6)
cull = CullPattern(List=split_2.ListB, CullPattern=invert(smaller.SmallerThan))  # disabled
panel_5 = Panel(split_3.ListA)  # disabled
lng = ListLength(List=split_2.ListB)  # disabled
panel_6 = Panel("100")  # disabled
split_4 = TextSplit(Text=cull, Separators=panel_2)  # -> simplify(Result); disabled
split_5 = TextSplit(Text=expression, Separators=panel_2)  # -> simplify(Result); disabled
panel_7 = Panel("1")  # disabled
lng_2 = ListLength(List=crv_7)
range_2 = Range(Domain=Domain(0, 1), Steps=expr("x-1", lng))  # disabled
range_3 = Range(Domain=Domain(0, 1), Steps=expr("x-1", panel_6))  # disabled
split_6 = SplitList(List=split_4, Index=panel_7)  # -> ListA, ListB; disabled
panel_8 = Panel("100000")  # disabled
item_2 = ListItem(List=split_5, Index=0, Wrap=True)  # -> Item, Item1; disabled
graph = GraphMapper(
    range_2,
    x0=0,
    x1=1,
    y0=-1,
    y1=1,
    container_name="Sine Summation",
    Equation0_px=[0.1955802292, 0.3],
    Equation0_py=[0.08140295744, 0.3],
    Equation1_px=[0.6, 0.9140871763],
    Equation1_py=[0.3, 0.5835343599])  # disabled
graph_2 = GraphMapper(
    range_3,
    x0=0,
    x1=1,
    y0=0,
    y1=1,
    amplitude=0.4642924666,
    container_name="Perlin",
    decay=0.004807174206,
    frequency=0.06683892012,
    x_offset=0.5,
    y_offset=0.5)  # disabled
viewer = ParamViewer(split_6.ListB)  # disabled
subtraction = Subtraction(A=lng_2, B=1)
multiplication = Multiplication(A=item_2.Item1, B=panel_8)  # disabled
multiplication_2 = Multiplication(A=item_2.Item, B=panel_8)  # disabled
branch = TreeBranch(Tree=split_6.ListB, Path=viewer, MaintainPaths=True)  # disabled
cluster = Cluster_6(num=branch, A=number_slider)  # disabled
pt = ConstructPoint(XCoordinate=multiplication_2, YCoordinate=multiplication, ZCoordinate=0)  # -> flatten(Point); disabled
item_3 = ListItem(List=crv_7, Index=0, Wrap=False)
cluster_2 = Cluster_5(num=cluster)  # disabled
crv_8 = Curve(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)
intcrv = Interpolate(Vertices=pt, Degree=3, Periodic=True, KnotStyle=1)  # -> Curve, Length, Domain; disabled
project = Project(Geometry=item_3, Plane=PlaneXY(0, 0, 0))  # -> Geometry, Transform
cluster_3 = Cluster_3(V=Slider(0.901, range=0..1), B=lng_2)
multiplication_3 = Multiplication(A=graft(graph), B=graph_2)  # -> simplify(Result); disabled
panel_9 = Panel("5")  # disabled
ccx = CurveCurve(CurveA=crv_8, CurveB=crv_4)  # -> Points, ParamsA, ParamsB
flip = FlipCurve(Curve=project.Geometry)  # -> Curve, Flag
multiplication_4 = Multiplication(A=multiplication_3, B=panel_9)  # -> simplify(Result); disabled
eval = EvaluateCurve(Curve=crv_4, Parameter=ccx.ParamsB)  # -> Point, Tangent, Angle
multiplication_5 = Multiplication(A=cluster_2, B=panel_8)  # disabled
line = LineSDL(Start=ccx.Points, Direction=eval.Tangent, Length=1)
c_script = CSharpScript(start_curve=intcrv.Curve, offsets=multiplication_5)  # -> out, crv_out, offset_tracks, last_crv, prev_crvs, planes, pts_out; inputs start_curve: Curve, offsets: tree of Double; disabled
# ---------- c_script: C# ----------
    Rhino.Geometry.Curve w_crv = start_curve;

    List<Rhino.Geometry.Line> tracks = new List<Rhino.Geometry.Line>();
    List<Rhino.Geometry.Curve> crv_seq = new List<Rhino.Geometry.Curve>();

    for(int i = 0; i < offsets.BranchCount ; i++){
      List<double> offset_step = offsets.Branch(i);
      int cnt = offset_step.Count;
      var t_vals = w_crv.DivideByCount(cnt, true);
      crv_seq.Add(w_crv);
      Rhino.Geometry.Plane[] plns = w_crv.GetPerpendicularFrames(t_vals);
      planes = plns;
      int pt_cnt = 0;
      List<Rhino.Geometry.Point3d> pts = new List<Rhino.Geometry.Point3d>();

      foreach(var t_val in t_vals){
        var pt = plns[pt_cnt].PointAt(-offset_step[pt_cnt], 0);
        pts.Add(pt);
        tracks.Add(new Rhino.Geometry.Line(plns[pt_cnt].Origin, pt));

        pt_cnt++;
      }
      pts_out = pts;
      w_crv = Rhino.Geometry.Curve.CreatePeriodicCurve(Rhino.Geometry.Curve.CreateInterpolatedCurve(pts, 3));
    }
    prev_crvs = crv_seq;
    offset_tracks = tracks;
    crv_out = w_crv;
# ---------- end c_script ----------
crv_9 = Curve(intcrv.Curve)  # disabled
lng_3 = ListLength(List=c_script.prev_crvs)  # -> expr("x-1", Length); disabled
pt_2 = Point(c_script.pts_out)  # disabled
range_4 = Range(Domain=Domain(0, 1), Steps=lng_3)  # disabled
gradient = Gradient(LowerLimit=0, UpperLimit=1, Parameter=range_4, stops=[0.0572: RGB(192, 255, 255), 0.948: RGB(0, 0, 128)])  # disabled
swatch = ColourSwatch(SwatchColor=RGB(0, 37, 122))  # disabled
swatch_2 = ColourSwatch(SwatchColor=RGB(199, 242, 239))  # disabled
swatch_3 = ColourSwatch(SwatchColor=RGB(150, 204, 124))  # disabled
crv_10 = Curve(c_script.crv_out)  # disabled
preview = CustomPreview(Geometry=crv_9, Material=swatch_2)  # disabled
preview_2 = CustomPreview(Geometry=c_script.offset_tracks, Material=swatch_3)  # disabled
preview_3 = CustomPreview(Geometry=c_script.prev_crvs, Material=gradient)  # disabled
preview_4 = CustomPreview(Geometry=crv_10, Material=swatch)  # disabled

run = BooleanToggle(False)

iterator = CSharpScript(count=subtraction, run=run)  # -> out, index; inputs count: Int32, run: Boolean
# ---------- iterator: C# ----------
    if(counter < count && run) {
      counter++;
      Print("Creating Panel: " + counter.ToString() + " of " + count.ToString());
      Component.ExpireSolution(true);
      index = counter - 1;
    }else{
      counter = 0;
      index = -1;
      Print("inactive");
    }
# ---------- iterator: C# additional code ----------
  int counter = 0;
# ---------- end iterator ----------

run_status = Panel(iterator.out)

addition = Addition(A=iterator.index, B=2)
int = Integer(addition)
item_4 = ListItem(List=crv_7, Index=int, Wrap=False)  # -> Item1, Item
project_2 = Project(Geometry=item_4.Item, Plane=PlaneXY(0, 0, 0))  # -> Geometry, Transform
project_3 = Project(Geometry=item_4.Item1, Plane=PlaneXY(0, 0, 0))  # -> Geometry, Transform
flip_2 = FlipCurve(Curve=project_3.Geometry, Guide=flip.Curve)  # -> Curve, Flag
flip_3 = FlipCurve(Curve=project_2.Geometry, Guide=flip.Curve)  # -> Curve, Flag
trim = TrimWithRegion(Curve=flip_2.Curve, Region=crv_8)  # -> reparameterize(Inside), Outside
cluster_4 = Cluster(crv=flip_2.Curve, int=expr("x-1", "50"))  # -> pln_2, pt_2, vec_2
cls = Closed(Curve=flip_2.Curve)  # -> Closed, Periodic
cluster_5 = Cluster_2(crv=flip_3.Curve, pt=cluster_4.pt_2, vec=cluster_4.vec_2, dist=".5")  # -> pt_4, vec_4
intcrv_2 = Interpolate(Vertices=cluster_5.pt_4, Degree=3, Periodic=cls.Periodic, KnotStyle=1)  # -> Curve, Length, Domain
dispatch = Dispatch(List=intcrv_2.Curve, DispatchPattern=cls.Periodic)  # -> ListA, ListB
plcoord = PlaneCoordinates(Point=cluster_5.pt_4, System=cluster_4.pln_2)  # -> XCoordinate, YCoordinate, ZCoordinate
ext = ExtendCurve(Curve=dispatch.ListB, Type=0, Start=10, End=10)
crv_11 = Curve(dispatch.ListA)
vdis = VectorDisplay(Anchor=cluster_5.pt_4, Vector=cluster_4.vec_2)
join = TextJoin(Text=plcoord.YCoordinate, Join=",")
rec = DataRecorder(join, DataLimit=-10, RecordData=True)
panel_10 = Panel(rec)

# ==== cluster Cluster
int = ClusterInput()
crv = ClusterInput()
crv_2 = Curve(crv)
int_2 = Integer(int)
divide = DivideCurve(Curve=crv_2, Count=expr("x+2", int_2), Kinks=False)  # -> Points, Tangents, Parameters
panel = Panel("""0
-1""")
cls = Closed(Curve=crv_2)  # -> Closed, Periodic
cull_i = CullIndex(List=divide.Parameters, Indices=panel, Wrap=True)
midpt = CurveMiddle(Curve=crv_2)
filter = StreamFilter(Gate=cls.Periodic, Stream0=cull_i, Stream1=divide.Parameters)
hframe = HorizontalFrame(Curve=crv_2, Parameter=filter)
rev = Reverse(Vector=midpt)
deplane = DeconstructPlane(Plane=hframe)  # -> Origin, XAxis, YAxis, ZAxis
rev_2 = Reverse(Vector=deplane.YAxis)
unit = UnitVector(Vector=rev)
avr = Average(Input=deplane.YAxis)
avr_2 = Average(Input=rev_2)
dist = Distance(PointA=unit, PointB=avr)
dist_2 = Distance(PointA=unit, PointB=avr_2)
larger = LargerThan(FirstNumber=dist, SecondNumber=dist_2)  # -> LargerThan, OrEqualTo
filter_2 = StreamFilter(Gate=larger.LargerThan, Stream0=rev_2, Stream1=deplane.YAxis)
pt = Point(deplane.Origin)
vec = Vector(deplane.YAxis)
pln = Plane(hframe)
pln_2 = ClusterOutput(pln)
pt_2 = ClusterOutput(pt)
vec_2 = ClusterOutput(vec)

# ==== cluster Cluster_2
crv = ClusterInput()
pt = ClusterInput()
vec = ClusterInput()
dist = ClusterInput()
pt_2 = Point(pt)
vec_2 = Vector(vec)
dist_2 = Number(dist)
crv_2 = Curve(crv)
amp = Amplitude(Vector=vec_2, Amplitude=expr("-x", dist_2))
move = Move(Geometry=pt_2, Motion=amp)  # -> Geometry, Transform
crv_3 = Curve(crv_2)
line = LineSDL(Start=move.Geometry, Direction=vec_2, Length=expr("x*2", dist_2))
clx = CurveLine(Curve=crv_3, Line=line)  # -> Points, Params, Count
midpt = CurveMiddle(Curve=crv_3)  # disabled
crv_cp = CurveClosestPoint(Point=clx.Points, Curve=graft(line))  # -> Point, Parameter, Distance
rev = Reverse(Vector=midpt)  # disabled
sort = SortList(Keys=crv_cp.Parameter, ValuesA=clx.Params)  # -> Keys, reverse(ValuesA)
unit = UnitVector(Vector=rev)  # disabled
item = ListItem(List=sort.ValuesA, Index=0, Wrap=True)  # -> flatten(Item)
hframe = HorizontalFrame(Curve=crv_3, Parameter=item)
deplane = DeconstructPlane(Plane=hframe)  # -> Origin, XAxis, YAxis, ZAxis
rev_2 = Reverse(Vector=deplane.YAxis)  # disabled
avr = Average(Input=deplane.YAxis)  # disabled
avr_2 = Average(Input=rev_2)  # disabled
dist_3 = Distance(PointA=unit, PointB=avr)  # disabled
dist_4 = Distance(PointA=unit, PointB=avr_2)  # disabled
larger = LargerThan(FirstNumber=dist_3, SecondNumber=dist_4)  # -> LargerThan, OrEqualTo; disabled
filter = StreamFilter(Gate=larger.LargerThan, Stream0=rev_2, Stream1=deplane.YAxis)  # disabled
vec_3 = Vector(deplane.YAxis)
pt_3 = Point(deplane.Origin)
vec_4 = ClusterOutput(vec_3)
pt_4 = ClusterOutput(pt_3)

# ==== cluster Cluster_3
B = ClusterInput()
V = ClusterInput()
dom = ConstructDomain(DomainStart=1, DomainEnd=expr("x-1", B))
remap = RemapNumbers(Value=V, Source=Domain(0, 1), Target=dom)  # -> Mapped, Clipped
R = ClusterOutput(remap.Mapped)

# ==== cluster Cluster_5
num = ClusterInput()
num_2 = Number(simplify(num))
len = TextLength(Text=num_2)
smaller = SmallerThan(FirstNumber=len, SecondNumber="1")  # -> SmallerThan, OrEqualTo
concat = Concatenate(FragmentA=num_2, FragmentB="0")
p_n_c = PickNChoose(Pattern=smaller.SmallerThan, Stream0=num_2, Stream1=concat)  # -> simplify(Result)
num_3 = Number(p_n_c)
cluster = Cluster_4(num=num_3)
num_4 = ClusterOutput(cluster)

# ==== cluster Cluster_6
num = ClusterInput()
num_2 = Number(simplify(num))
viewer = ParamViewer(num_2)
A = ClusterInput()
lng = ListLength(List=viewer)
multiplication = Multiplication(A=A, B=lng)
int = Integer(multiplication)
split = SplitList(List=viewer, Index=int)  # -> ListA, ListB
branch = TreeBranch(Tree=num_2, Path=split.ListA, MaintainPaths=True)
B = ClusterOutput(branch)

# ==== cluster Cluster_4
num = ClusterInput()
num_2 = Number(num)
ma = MassAddition(Input=num_2)  # -> Result, PartialResults
viewer = ParamViewer(num_2)
bool = Boolean(ma.Result)
dispatch = Dispatch(List=viewer, DispatchPattern=flatten(bool))  # -> ListA, ListB
branch = TreeBranch(Tree=num_2, Path=dispatch.ListA, MaintainPaths=True)
branch_2 = TreeBranch(Tree=num_2, Path=dispatch.ListB, MaintainPaths=True)
num_3 = Number(branch)
abs = Absolute(Value=num_3)
division = Division(A=num_3, B=abs)
avr = Average(Input=abs)
division_2 = Division(A=abs, B=avr)
multiplication = Multiplication(A=avr, B=division)
larger = LargerThan(FirstNumber=division_2, SecondNumber="10")  # -> LargerThan, OrEqualTo
p_n_c = PickNChoose(Pattern=larger.LargerThan, Stream0=num_3, Stream1=multiplication)
merge = Merge(Data1=p_n_c, Data2=branch_2)
num_4 = Number(merge)
num_5 = ClusterOutput(num_4)
