# Grasshopper definition update dates.gh (Grasshopper 1.0.7)

path = FilePath("C:\Users\wzesk\Documents\GitHub\littoral\toy_island\raw_island.csv")
file = ReadFile(File=path, PerLineParse=True)
split = SplitList(List=file, Index=1)  # -> flatten(ListA), ListB
split_2 = TextSplit(Text=split.ListB, Separators=",")
split_3 = SplitList(List=split_2, Index=1)  # -> flatten(ListA), ListB
lng = ListLength(List=split_3.ListA)
c_script = CSharpScript(start_time="2012-01-01", len=lng)  # -> graft(time_series); inputs len: Int32
# ---------- c_script: C# ----------
    List<DateTime> dates = new List<DateTime>();

    for(int i = 0 ; i < len ; i++){
      dates.Add(start_time.AddHours(i));
    }
    time_series = dates;
# ---------- end c_script ----------
txt = Text(c_script)
merge = Merge(Data1=simplify(txt), Data2=simplify(split_3.ListB))
join = TextJoin(Text=merge, Join=",")  # -> flatten(Result)
merge_2 = Merge(Data1=simplify(split.ListA), Data2=simplify(join))
panel = Panel(merge_2)
